# Grasshopper definition heathUI_0.5.0-dev.gh (Grasshopper 1.0.8)
# plug-ins: RhinoCodePluginGH, Heteroptera, Human UI, Human, LadybugGrasshopper, MetaHopper, eleFront, Wombat, Telepathy

# ----
# Click here
button = Button()
restart_heath = RemoteSender(button)

# ----
# CLICK BUTTON
# TO RESTART
# HEATH
number_slider = Slider(500, range=0..1000)
selobj = GetSelectedObjects()  # -> ComponentObjects, ParamObjects, OtherObjects
# Dev notes
# Sprint 3
# - Assign type changed to import geometry
# - Pre-window with link to github and mail
# - Attribute description changed to Heath geometry type
# - Wireframe mode for all modules with preview checkbox
# - Zoom button for locating visualisations
# - Heating setpoint is strictly lower than cooling setpoint
# - Added tooltips to construction modules and sliders
# - Preview in geometry module is updated when model is scaled
# - Preview is only active when its corresponding tab is active
# - The chackboxes in analysis module is changed to a pulldown menu
# - Preview all option is available is geometry tab
# - A legend is made to the preview in the geometry tab
# - Bug in the create model in assembly module is made, now the model components can be shown
# - The option to show all is added in the show model components
# - Ticks have been added to the sliders, along with the setting of appropriate ranges
# - Units have been added to the sliders
# - Python dependencies have been tested for the Grasshopper script
# - Crate window construction have been added to the construction module
# - Select window construction possibility, (from created windows) have been added to the construction module
# - Matplotlib bug is fixed so that it can display an arbitrary amount of features
# - Daylight simulation has been added to the analysis module
# - Detailed energy simulation have been added to the analysis module, (NOT YET)
# - The help button have been poplated
# - Handling if the simulation fails, with appropriate information provided, (NOT YET)
setscribble = SetScribbleProperties(Scribble=selobj.OtherObjects, ScribbleSize=number_slider)

panel = Panel("""Could not save geometry. 
It was not of the correct type.""")
panel_2 = Panel("Preview geometry")
slider = CreateSlider(
    Slider=Slider(50, range=0..100),
    SnapValue=Slider(5, range=0..10),
    ShowBounds=False,
    ShowTicks=True,
    ShowTooltip=False,
    ShowValLabel=True,
    showLabel=False)
slider_2 = CreateSlider(
    Slider=Slider(50, range=0..100),
    SnapValue=Slider(5, range=0..10),
    ShowBounds=False,
    ShowTicks=True,
    ShowTooltip=False,
    ShowValLabel=True,
    showLabel=False)
slider_3 = CreateSlider(
    Slider=Slider(1, range=0..10),
    SnapValue=Slider(1, range=0..1),
    ShowBounds=False,
    ShowTicks=True,
    ShowTooltip=False,
    ShowValLabel=True,
    showLabel=False)
label = CreateLabel(LabelText="Louver depth", LabelSize=12, Justification=0)
label_2 = CreateLabel(LabelText="Distance between louvers", LabelSize=12, Justification=0)
label_3 = CreateLabel(LabelText="Number of louvers", LabelSize=12, Justification=0)
slider_4 = CreateSlider(
    Slider=Slider(50, range=0..100),
    SnapValue=Slider(5, range=0..10),
    ShowBounds=False,
    ShowTicks=True,
    ShowTooltip=False,
    ShowValLabel=True,
    showLabel=False)
toggle = CreateToggle(Default=False)
label_4 = CreateLabel(LabelText="Generate windows using WWR [%]", LabelSize=12, Justification=0)
label_5 = CreateLabel(LabelText="Louver angle", LabelSize=12, Justification=0)
slider_5 = CreateSlider(
    Slider=Slider(30, range=5..95),
    SnapValue=Slider(5, range=0..10),
    ShowBounds=False,
    ShowTicks=True,
    ShowTooltip=True,
    ShowValLabel=True,
    showLabel=False)
true_button = CreateTrueOnlyButton(ButtonName="?", ButtonStyle=2)
label_6 = CreateLabel(LabelText="Honeybee model", LabelSize=18, Justification=0)
empty = EmptyObjectToEmptyBranch()
label_7 = CreateLabel(LabelText=panel, LabelSize=12, Justification=0)
true_button_2 = CreateTrueOnlyButton(ButtonName="Construction database", ButtonStyle=0)
empty_2 = EmptyObjectToEmptyBranch()
label_8 = CreateLabel(LabelText="Weather visualization", LabelSize=18, Justification=0)
true_button_3 = CreateTrueOnlyButton(ButtonName="Material database", ButtonStyle=0)
true_button_4 = CreateTrueOnlyButton(ButtonName="Window database", ButtonStyle=0)
empty_3 = EmptyObjectToEmptyBranch()
empty_4 = EmptyObjectToEmptyBranch()
empty_5 = EmptyObjectToEmptyBranch()
empty_6 = EmptyObjectToEmptyBranch()
empty_7 = EmptyObjectToEmptyBranch()
empty_8 = EmptyObjectToEmptyBranch()
values = ValueListener(Elements=true_button, SomeProperty=True)  # -> Values, Indices
values_2 = ValueListener(Elements=true_button_2, SomeProperty=True)  # -> Values, Indices
values_3 = ValueListener(Elements=slider_3, SomeProperty=True)  # -> Values, Indices
values_4 = ValueListener(Elements=slider_2, SomeProperty=True)  # -> Values, Indices
values_5 = ValueListener(Elements=slider, SomeProperty=True)  # -> Values, Indices
values_6 = ValueListener(Elements=true_button_3, SomeProperty=True)  # -> Values, Indices
values_7 = ValueListener(Elements=true_button_4, SomeProperty=True)  # -> Values, Indices
values_8 = ValueListener(Elements=slider_4, SomeProperty=True)  # -> Values, Indices
entwine = Entwine(Branch00=label, Branch01=slider, FlattenInputs=True)  # -> flatten(Result)
entwine_2 = Entwine(Branch00=label_2, Branch01=slider_2, FlattenInputs=True)  # -> flatten(Result)
entwine_3 = Entwine(Branch00=label_3, Branch01=slider_3, FlattenInputs=True)  # -> flatten(Result)
entwine_4 = Entwine(Branch00=label_5, Branch01=slider_4, FlattenInputs=True)  # -> flatten(Result)
values_9 = ValueListener(Elements=slider_5, SomeProperty=True)  # -> Values, Indices
tooltip = AttachTooltipToElement(ElementsToAttachTo=slider_5, TooltipContent="Doubleclick to input value", ShowDelay=500, Duration=2000)
values_10 = ValueListener(Elements=toggle, SomeProperty=True)  # -> Values, Indices
info_save_geometry = RemoteSender(values.Values)
label_9 = CreateLabel(LabelText="Program settings", LabelSize=18, Justification=0)
distance_between_louvers = RemoteSender(values_4.Values)
louver_depth = RemoteSender(values_5.Values)
adjustelem = AdjustElementAppearance(
    ElementsToAdjust=true_button,
    Foreground=ColourSwatch(SwatchColor=RGB(0, 0, 0)),
    Background=ColourSwatch(SwatchColor=RGB(230, 230, 230)),
    FontSize=Slider(12, range=0..300))
louver_angle = RemoteSender(values_8.Values)
number_of_louvers = RemoteSender(values_3.Values)
panel_3 = Panel(values_2.Values)
open_construction_database = RemoteSender(values_2.Values)
open_material_database = RemoteSender(values_6.Values)
panel_4 = Panel(values_6.Values)
panel_5 = Panel(values_7.Values)
open_window_database = RemoteSender(values_7.Values)
filter = StreamFilter(Gate=values_10.Values, Stream0="0", Stream1=values_9.Values)
entwine_5 = Entwine(Branch00=toggle, Branch01=slider_5, FlattenInputs=True)  # -> flatten(Result)
stack = CreateStack(UIElements=entwine, Horizontal=invert(True))
stack_2 = CreateStack(UIElements=entwine_2, Horizontal=invert(True))
stack_3 = CreateStack(UIElements=entwine_3, Horizontal=invert(True))
stack_4 = CreateStack(UIElements=entwine_4, Horizontal=invert(True))
adjustpos = AdjustElementPositioning(ElementsToAdjust=true_button, AbsolutePositioning=False, Width=Slider(29, range=0..300))
number_of_louvers_2 = RemoteReceiver(number_of_louvers)
number_of_louvers_3 = RemoteReceiver(number_of_louvers)
number_of_louvers_4 = RemoteReceiver(number_of_louvers)
division = Division(A=filter, B="100")
hideshow = HideShowElement(ElementToHideShow=slider_5, Show=values_10.Values, Collapse=invert(True), Disable=False)
stack_5 = CreateStack(UIElements=entwine_5, Horizontal=True)
generate_wwr = RemoteSender(division)
hideshow_2 = HideShowElement(ElementToHideShow=stack, Show=number_of_louvers_2, Collapse=True, Disable=False)
hideshow_3 = HideShowElement(ElementToHideShow=stack_4, Show=number_of_louvers_4, Collapse=True, Disable=False)
hideshow_4 = HideShowElement(ElementToHideShow=stack_2, Show=number_of_louvers_3, Collapse=True, Disable=False)
entwine_6 = Entwine(Branch00=label_4, Branch01=stack_5, FlattenInputs=True)  # -> flatten(Result)
entwine_7 = Entwine(Branch00=stack_3, Branch01=stack, Branch02=stack_2, Branch03=stack_4, FlattenInputs=True)  # -> flatten(Result)
stack_6 = CreateStack(UIElements=entwine_6, Horizontal=invert(True))
stack_7 = CreateStack(UIElements=entwine_7, Horizontal=True)
adjustpos_2 = AdjustElementPositioning(ElementsToAdjust=label_4, Margin="0, 5, 0, 0", AbsolutePositioning=False, HorizontalAlignment=0, VerticalAlignment=2)
adjustpos_3 = AdjustElementPositioning(ElementsToAdjust=slider_5, Margin="20, 10, 0, 0", AbsolutePositioning=False, HorizontalAlignment=0, VerticalAlignment=2)
entwine_8 = Entwine(Branch00=true_button_4, Branch01=true_button_3, Branch02=true_button_2, FlattenInputs=True)  # -> flatten(Result)

# ----
# Louvers
location = Data()

adjustelem_2 = AdjustElementAppearance(ElementsToAdjust=label_7, Foreground=ColourSwatch(SwatchColor=RGB(255, 0, 0)))

# ----
# Generate using WWR
location_2 = Data(stack_6)

# ----
# Location
location_3 = Data()

# ----
# For testing
data = Data(["Heating", "Solar", "Service Hot Water", "Electric Equipment", "Lighting", "People", "Infiltration", "Mechanical Ventilation", "Opaque Conduction", "Window Conduction", "Cooling", "Storage"])
panel_6 = Panel(data)
data_2 = Data(Tree({0;0}: [0, 0, 0, 0, 0, 0, 0, 0, 0, 0, 0, 0], {0;1}: [0.1154636743, 0.2088814282, 0.4621754872, 0.6375773836, 0.7940293548, 0.7463955098, 0.7771035315, 0.6868606807, 0.5770758629, 0.3882011428, 0.1539180345, 0.1039965989], {0;2}: [0.2845266784, 0.2593931982, 0.3068475988, 0.3112341165, 0.3274388209, 0.3004628568, 0.2994641541, 0.2849765538, 0.2931936837, 0.2954218727, 0.2799234578, 0.2870384056], {0;3}: [3.26489514, 2.948937546, 3.26489514, 3.159575942, 3.26489514, 3.159575942, 3.26489514, 3.26489514, 3.159575942, 3.26489514, 3.159575942, 3.26489514], {0;4}: [0.4188465123, 0.3783129788, 0.4188465123, 0.4053353345, 0.4188465123, 0.4053353345, 0.4188465123, 0.4188465123, 0.4053353345, 0.4188465123, 0.4053353345, 0.4188465123], {0;5}: [145.0707, 131.0316, 145.0707, 140.391, 145.0707, 140.391, 145.0707, 145.0707, 140.391, 145.0707, 140.391, 145.0707], {0;6}: [-13.42394635, -12.17954569, -11.63497027, -9.703517743, -7.231149303, -5.714291235, -5.026111258, -5.365052955, -6.984852185, -8.612623152, -10.78235179, -12.63972442], {0;7}: [-127.6578232, -115.5253908, -130.3991254, -128.4476678, -136.7388039, -132.9998708, -138.3167409, -138.9867771, -132.4821465, -134.6450452, -126.8261408, -128.9392353], {0;8}: [-4.317090982, -3.828538366, -4.007361586, -3.591511594, -3.312717163, -3.049022121, -3.055337228, -3.177779608, -3.37671771, -3.733105664, -3.928085146, -4.22849013], {0;9}: [-1.904284325, -1.611011521, -1.522864461, -1.139056545, -0.6851745139, -0.4758042193, -0.339572292, -0.4501261671, -0.7765412269, -1.097827525, -1.460511454, -1.777338546], {0;10}: [-0.7767994186, -0.568607221, -0.5137867107, -0.7067512703, -0.665388473, -1.639501883, -1.948212559, -0.6954699949, -0.143473928, -0.2547466496, -0.4393643663, -0.5620924752], {0;11}: [-1.074487752, -1.11403151, -1.445356325, -1.316217828, -1.242676437, -1.124279386, -1.145035073, -1.051073081, -1.062449287, -1.094716512, -0.9532992481, -0.9985958205]))
panel_7 = Panel(data_2)
num = Number(panel_7)

# ----
# Create construction
panel_8 = Panel("gypsum")
number_slider_2 = Slider(0.3, range=0..1)
searchmats = HBSearchMaterials(keywords="insulation")  # -> opaque_mats, window_mats; plug-in component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
searchmats_2 = HBSearchMaterials(keywords="concrete")  # -> opaque_mats, window_mats; plug-in component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
searchmats_3 = HBSearchMaterials()  # -> opaque_mats, window_mats; plug-in component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
searchmats_4 = HBSearchMaterials(keywords="air")  # -> opaque_mats, window_mats; plug-in component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
searchmats_5 = HBSearchMaterials(keywords="plywood")  # -> opaque_mats, window_mats; plug-in component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
searchmats_6 = HBSearchMaterials(keywords=panel_8)  # -> opaque_mats, window_mats; plug-in component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
searchconstrs = HBSearchConstructions()  # -> opaque_constrs, window_constrs, shade_constrs; plug-in component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
searchconstrs_2 = HBSearchConstructions()  # -> opaque_constrs, window_constrs, shade_constrs; plug-in component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
list = ItemSelector(
    searchmats.opaque_mats,
    {"AtticFloor Insulation", "Generic 25mm Insulation", "Generic 50mm Insulation", "I01 25mm insulation board", "I02 50mm insulation board", "IEAD NonRes Roof Insulation-1.76", "IEAD Roof Insulation R-3.47 IP", "Insulation 1m", "Mass NonRes Wall Insulation-0.43", "Mass Wall Insulation R-4.23 IP"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}, selected="AtticFloor Insulation")
list_2 = ItemSelector(
    searchmats_2.opaque_mats,
    {"100mm Normalweight concrete floor", "12 in. Normalweight Concrete Floor", "4 in. Normalweight Concrete Floor", "4 in. Normalweight Concrete Wall", "6 in. Heavyweight Concrete Roof", "6 in. Normalweight Concrete Floor", "8 in. Concrete Block Basement Wall", "8 in. Concrete Block Wall", "8 in. Normalweight Concrete Floor", "8 in. Normalweight Concrete Wall", "8IN CONCRETE HW RefBldg", "8IN Concrete HW", "Concrete Pavement", "Generic HW Concrete", "Generic LW Concrete", "HW CONCRETE", "HW CONCRETE 8 in", "M11 100mm lightweight concrete", "M15 200mm heavyweight concrete", "MAT-CC05 4 HW CONCRETE", "MAT-CC05 8 HW CONCRETE", "NACM_Concrete 4in_140lb/ft3"}, selected="100mm Normalweight concrete floor")
list_3 = ItemSelector(
    searchmats_6.opaque_mats,
    {"1/2 in. Gypsum Board", "1/2IN Gypsum", "5/8 in. Gypsum Board", "G01 13mm gypsum board", "G01a 19mm gypsum board", "Generic Gypsum Board", "Gypsum Board - 1/2 in. CBES", "Gypsum Or Plaster Board - 3/8 in.", "NACM_Gypsum Board 5/8in"}, selected="1/2 in. Gypsum Board")
list_4 = ItemSelector(
    searchmats_4.opaque_mats,
    {"F04 Wall air space resistance", "F05 Ceiling air space resistance", "Generic Ceiling Air Gap", "Generic Wall Air Gap", "Typical Air Wall"}, selected="F04 Wall air space resistance")
list_5 = ItemSelector(searchmats_5.opaque_mats, {"5/8 in. Plywood", "Plywood - 5/8 in. CBES"}, selected="5/8 in. Plywood")
number_slider_3 = Slider(0.3, range=0..1)
opaquemat = HBOpaqueMaterial(
    name="XPS insulation",
    thickness=number_slider_2,
    conductivity=Slider(0.036, range=0..0.1),
    density=Slider(28, range=0..100),
    spec_heat=Slider(1500, range=0..10000))  # -> mat; plug-in component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
list_6 = ItemSelector(
    searchconstrs.window_constrs,
    {"ASHRAE 189.1-2009 ExtWindow ClimateZone 1", "ASHRAE 189.1-2009 ExtWindow ClimateZone 2", "ASHRAE 189.1-2009 ExtWindow ClimateZone 3", "ASHRAE 189.1-2009 ExtWindow ClimateZone 4-5", "ASHRAE 189.1-2009 ExtWindow ClimateZone 6", "ASHRAE 189.1-2009 ExtWindow ClimateZone 7-8"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}, selected="U 0.17 SHGC 0.36 Simple Glazing Window")
list_7 = ItemSelector(
    searchconstrs_2.window_constrs,
    {"ASHRAE 189.1-2009 ExtWindow ClimateZone 1", "ASHRAE 189.1-2009 ExtWindow ClimateZone 2", "ASHRAE 189.1-2009 ExtWindow ClimateZone 3", "ASHRAE 189.1-2009 ExtWindow ClimateZone 4-5", "ASHRAE 189.1-2009 ExtWindow ClimateZone 6", "ASHRAE 189.1-2009 ExtWindow ClimateZone 7-8"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}, selected="ASHRAE 189.1-2009 ExtWindow ClimateZone 1")
merge = Merge(Data1=list_2, Data2=list_4, Data3=list_5, Data4=opaquemat, Data5=list_3)
merge_2 = Merge(
    Data1=Slider(0.1, range=0..1),
    Data2=Slider(0.11, range=0..1),
    Data3=Slider(0.016, range=0..0.1),
    Data4=number_slider_2,
    Data5=Slider(0.012, range=0..0.1))
interiorsubset = HBInteriorConstructionSubset()  # -> interior_set; plug-in component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
groundsubset = HBGroundConstructionSubset()  # -> ground_set; plug-in component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
cluster = Cluster(materials=merge, construction_name="Construction 1", thicknesses=merge_2)  # -> error_2, construction_2
bldgvintages = HBBuildingVintages({"ASHRAE 90.1 2019  |  IECC 2021": "2019", "ASHRAE 90.1 2016  |  IECC 2018": "2016", "ASHRAE 90.1 2013  |  IECC 2015": "2013", "ASHRAE 90.1 2010  |  IECC 2012": "2010", "ASHRAE 90.1 2007  |  IECC 2009": "2007", "ASHRAE 90.1 2004  |  IECC 2006": "2004", "1980-2004 (CBECS)": "1980_2004", "Pre-1980 (CBECS)": "pre_1980"}, selected="ASHRAE 90.1 2019  |  IECC 2021")
cluster_2 = Cluster_2(window_construction=list_7, gwp_a1_a3="2.5", gwp_a4="0.042", density_kg_m2="38.2")
decnstrconstr = HBDeconstructConstruction(constr=list_6)  # -> materials, layers, r_val_si, r_val_ip, u_fac_si, u_fac_ip, shgc, t_sol, t_vis; plug-in component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
constructiontypes = HBConstructionTypes({"SteelFramed", "WoodFramed", "Mass", "Metal Building"}, selected="WoodFramed")
climatezones = HBClimateZones({"1 - Very Hot": "1", "2 - Hot": "2", "3 - Warm": "3", "4 - Mixed": "4", "5 - Cool": "5", "6 - Cold": "6", "7 - Very Cold": "7", "8 - Subarctic": "8"}, selected="5 - Cool")
data_3 = Data(cluster_2)
panel_9 = Panel(decnstrconstr.u_fac_ip)
panel_10 = Panel(decnstrconstr.u_fac_si)
exteriorsubset = HBExteriorConstructionSubset(exterior_wall=cluster.construction_2)  # -> exterior_set; plug-in component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
subfacesubset = HBSubfaceSubset(window=data_3)  # -> subface_set; plug-in component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
panel_11 = Panel(cluster.construction_2)
constrsetclimate = HBConstructionSetByClimate(climate_zone=climatezones, vintage=bldgvintages, constr_type=constructiontypes)  # -> constr_set; plug-in component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
constructionset = HBConstructionSet(base_constr_set=constrsetclimate, exterior_subset=exteriorsubset, subface_subset=subfacesubset)  # -> constr_set; plug-in component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
decnstrconstrset = HBDeconstructConstructionSet(constr_set=constructionset)  # -> exterior_wall, exterior_roof, exposed_floor, ground_wall, ground_roof, ground_floor, window, skylight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; plug-in component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
panel_12 = Panel(decnstrconstrset.exterior_wall)

# ----
# Brimstone FLY!
fly = BrimstoneFly()
# ---------- fly: Python ----------
"""This component sets up global information for Brimstone
    Inputs:
    Output:
        """

import Grasshopper
import sys
sys.path.append(Grasshopper.Folders.UserObjectFolders[0])

import brimstone
reload(brimstone)

import scriptcontext

ghenv.Component.Name = 'Brimstone - Fly!'
ghenv.Component.NickName = 'Fly!'

scriptcontext.sticky["brimstone_flying"] = 'true'
scriptcontext.sticky["brimstone_kdb_hb_json"] = 'brimstone_data/230721klimatdatabas_hb_materials.json' # json which adds honeybee material info to klimatdatabas materials
scriptcontext.sticky["brimstone_hb_kdb_csv"] = 'brimstone_data/230728_HBKlimatdatabas.csv' # csv file which translates honeybee material names to klimatdatabas material names
ghenv.Component.Message = brimstone.globals.version
# ---------- end fly ----------

# ----
# Heath launch window
panel_13 = Panel("Start")
restart_heath_2 = RemoteReceiver(restart_heath)
panel_14 = Panel("Heath provides a user interface for life cycle building performance assessment in the Rhino environment.")
gate = StreamGate(Stream=panel_13, Gate=restart_heath_2)  # -> Target0, Target1
true_button_5 = CreateTrueOnlyButton(ButtonName="Github Heath", ButtonStyle=0)
true_button_6 = CreateTrueOnlyButton(ButtonName=gate.Target0, ButtonStyle=0)
tb = CreateTextBlock(TextSize=16, Justification=1)
tb_2 = CreateTextBlock(TextSize=12, Justification=0)
values_11 = ValueListener(Elements=true_button_5, SomeProperty=True)  # -> Values, Indices
values_12 = ValueListener(Elements=true_button_6, SomeProperty=True)  # -> Values, Indices
settextblock = SetTextBlockContents(TextBlockToModify=tb, NewTextBlockContents="Email: sawen@chalmers.se")
settextblock_2 = SetTextBlockContents(TextBlockToModify=tb_2, NewTextBlockContents=panel_14)
launch_heath = RemoteSender(values_12.Values)
launch_heath_2 = RemoteReceiver(launch_heath)
launchwin = LaunchWindow(
    Show=invert(launch_heath_2),
    Name="Heath",
    Width=Slider(275, range=0..1000),
    Height=Slider(220, range=0..1000),
    ChildStatus=0,
    EnableHorizScroll=False)
github_heath = RemoteSender(values_11.Values)
accent_colors = ValueList({"Amber", "Blue", "Brown", "Cobalt", "Crimson", "Cyan", "Emerald", "Green", "Indigo", "Lime", "Magenta", "Mauve", "Olive", "Orange", "Pink", "Purple", "Red", "Sienna", "Steel", "Taupe", "Teal", "Violet", "Yellow"}, selected="Blue")
pt = ConstructPoint(XCoordinate=Slider(142, range=0..1000), YCoordinate=Slider(193, range=0..1000), ZCoordinate=0)
winprops = SetWindowProperties(
    Window=launchwin,
    StartingLocation=pt,
    Theme=0,
    AccentColor=accent_colors,
    ShowTitleBar=True,
    BackgroundColor=RGB(255, 255, 255),
    ScaleFactor=1)
entwine_9 = Entwine(Branch00=tb_2, Branch01=true_button_5, Branch02=true_button_6, Branch03=tb, FlattenInputs=True)  # -> flatten(Result)
adjustpos_4 = AdjustElementPositioning(ElementsToAdjust=tb_2, AbsolutePositioning=False, Height=Slider(60, range=0..100))
adjustpos_5 = AdjustElementPositioning(ElementsToAdjust=tb, Margin="0, 8, 0, 0", AbsolutePositioning=False, Height=Slider(20, range=0..100))
addelems = AddElements(Window=launchwin, Elements=flatten(entwine_9), DoVLChecking=True)  # -> AddedElements, ElementNames
heath_launch_elements = RemoteSender(addelems.AddedElements)

winstat = WindowStatus(Window=launchwin)

# ---- group: Launch
# Launch Heath
fly_2 = HeathFly()  # -> flying
# ---------- fly_2: Python ----------
# Copyright (c) 2024, Heath.
# You should have received a copy of the GNU Affero General Public License
# along with Heath; If not, see <http://www.gnu.org/licenses/>.
# 
# @license AGPL-3.0-or-later <https://spdx.org/licenses/AGPL-3.0-or-later>

import Grasshopper, scriptcontext
import os, sys, importlib

sys.path.append(Grasshopper.Folders.UserObjectFolders[0])

# make sure we can import ladybug tools
ladybug_tools_path = "ladybug_tools\\python\\Lib\\site-packages\\"
program_files_dir = os.path.dirname(f"{os.environ['ProgramFiles']}\\{ladybug_tools_path}")
if os.path.isdir(program_files_dir):
    sys.path.append(program_files_dir)
else:
    user_folder_dir = os.path.dirname(f"{os.path.expanduser('~')}\\{ladybug_tools_path}")
    if os.path.isdir(user_folder_dir):
        sys.path.append(user_folder_dir)
    else:
        raise Exception("Couldn't find Ladybug tools python module path")

try:
    import heath
    importlib.reload(heath)
except Exception as e:
    # hack to allow the module to reside in the repo
    sys.path.append(os.path.join(os.path.dirname(ghdoc.Path), '..\src'))
    import heath
    importlib.reload(heath)

ghenv.Component.Name = 'Heath - Fly!'
ghenv.Component.NickName = 'Fly!'

scriptcontext.sticky["heath_flying"] = 'true'
ghenv.Component.Message = heath.heath_globals.version

flying = True
# ---------- end fly_2 ----------
heath_flying = RemoteSender(fly_2)

# ----
# Heath github
panel_15 = Panel("https://github.com/sawenchalmers/heath")
github_heath_2 = RemoteReceiver(github_heath)
py3 = Python3Script(url=panel_15, launch=github_heath_2)
# ---------- py3: Python ----------
"""Grasshopper Script"""
import webbrowser as wb
if launch == True:
    wb.open(url, 2, True)
# ---------- end py3 ----------

heath_flying_2 = RemoteReceiver(heath_flying)
py3_2 = Python3Script(get=heath_flying_2)  # -> mpl_folder
# ---------- py3_2: Python ----------
"""Grasshopper Script"""
import heath

if __name__ == "__main__":
    if get:
        print(ghdoc)
        mpl_folder = heath.get_results_folder(ghdoc)
# ---------- end py3_2 ----------
filepicker = CreateFilePicker(ButtonLabelText="Save location", DialogType=1, MustExist=True, Filter="Textdokument|*.txt", StartingPath=py3_2)
values_13 = ValueListener(Elements=filepicker, SomeProperty=True)  # -> Values, Indices

# ----
# Transparent window
panel_16 = Panel("Import geometry")
pickbtn = CreateRhinoPickButton(
    ButtonName=panel_16,
    Prompt="Please select geometry...",
    AllowMultiple=invert(True),
    AllowNone=True,
    Type=2,
    ButtonStyle=0)
values_14 = ValueListener(Elements=pickbtn, SomeProperty=True)  # -> Values, Indices
launchxpwin = LaunchTransparentWindow(Show=Toggle(False), Name="Control Window", Width=370, Height=400, ChildStatus=0, EnableHorizScroll=False)
addelems_2 = AddElements(Window=launchxpwin, Elements=flatten(pickbtn), DoVLChecking=True)  # -> AddedElements, ElementNames
panel_17 = Panel(values_14.Values)

save_location = RemoteSender(values_13.Values)
bool = Boolean(values_13.Values)
null = NullItem(Item=bool)  # -> NullFlags, InvalidFlags, Description
adjustpos_6 = AdjustElementPositioning(
    ElementsToAdjust=filepicker,
    AbsolutePositioning=invert(False),
    Width=Slider(90, range=0..100),
    Height=Slider(32, range=0..100),
    HorizontalAlignment=1,
    VerticalAlignment=2)

# ----
# Modal UI locations
number_slider_4 = Slider(575, range=0..1000)
pt_2 = ConstructPoint(XCoordinate=Slider(210, range=0..1000), YCoordinate=Slider(210, range=0..1000), ZCoordinate=0)
pt_3 = ConstructPoint(XCoordinate=Slider(65, range=0..1000), YCoordinate=Slider(210, range=0..1000), ZCoordinate=0)
pt_4 = ConstructPoint(XCoordinate=number_slider_4, YCoordinate=Slider(210, range=0..1000), ZCoordinate=0)
heath_window_location = RemoteSender(pt_3)
database_modal_location = RemoteSender(pt_2)
create_modal_location = RemoteSender(pt_4)

heath_window_location_2 = RemoteReceiver(heath_window_location)
toggle_2 = BooleanToggle(True)

# ----
# Get Klimatdatabas data
list_8 = ValueList({"Swedish": "sv", "English": "en"}, selected="English")
list_9 = ValueList({"File": "file", "API": "api"}, selected="API")
get_categories = BrimstoneGetCategories(mode=list_9, language=list_8)  # -> out, json_data, categories, klimatdatabas_version
# ---------- get_categories: Python ----------
"""Gets Klimatdatabas from the Boverket API or a file, extracts json data, and resource category names
    Inputs:
        mode: api or file mode
        language: language of database to retrieve
        json_path: path to json file if file mode
    Output:
        json_data: json file as dictionary
        categories: Categories present in the database
        klimatdatabas_version: String representing the version of Klimatdatabas used"""

import scriptcontext
import brimstone
import Grasshopper
import os, io

ghenv.Component.Name = 'Brimstone - Get Categories'
ghenv.Component.NickName = 'Get Categories'
ver = brimstone.globals.version
ghenv.Component.Message = ver

import json

from System.Net import WebRequest
from System.IO import StreamReader
from System.Text import Encoding

def main(mode):    
    if mode == "file":
        json_file = brimstone.globals.kdb_json_path
        json_path = os.path.join(Grasshopper.Folders.UserObjectFolders[0], json_file)
        if not os.path.exists(json_path):
            raise Exception("Failed to open json file, it should reside in [UserComponents folder]/brimstone_data/")
        json_data = get_json_data_from_file(json_path)
    elif mode == "api":
        json_data = get_json_data_from_api()
    else:
        raise Exception("Mode {mode} not supported".format(mode = mode))
    
    categories = get_categories(json_data)
    version = json_data.get("Version") 
    
    return categories, json_data, version

def get_json_data_from_file(json_path):
    f = io.open(json_path, encoding='utf-8')
    json_data = json.load(f)
    return json_data
    
def get_json_data_from_api():
    version = "02.04.000"
    lng = language if language else "en"
    format = "json"

    url = "https://api.boverket.se/klimatdatabas/v2/get-all-resources/{version}/{language}/{format}".format(
        version=version, language=lng, format=format)
    
    request = WebRequest.Create(url)
    
    request.Method = "GET"
    request.Timeout = 5000
    #request.ContentType = "application/json"
    response = request.GetResponse()
    
    stream_reader = StreamReader(response.GetResponseStream())
    json_data = json.loads(stream_reader.ReadToEnd())
    return json_data
    
def get_categories(json_data):
    categories = []
    try:
        for metaCategory in json_data['Categories']:
            for cat in metaCategory["Children"]:
                categories.append(cat["Title"])
    except KeyError:
        raise Exception("Format of JSON data is not supported.")
    return categories

if __name__ == "__main__":
    if not scriptcontext.sticky["brimstone_flying"]:
        raise Exception("The 'Brimstone - Fly' component needs to exist on the canvas")
    categories, json_data, klimatdatabas_version = main(mode)
    json_data = [json_data] # need to put it in an array so GH understands it as a dictionary
# ---------- end get_categories ----------
list_10 = ItemSelector(
    get_categories.categories,
    {"Mineral materials", "Windows, doors and glass", "Paints and sealants", "Concrete", "Insulation", "Steel and other metals", "Blocks and tiles", "Building boards", "Waterproofing", "Solid woods", "Energy and fuel"}, selected="Mineral materials")
panel_18 = Panel(get_categories.klimatdatabas_version)

# ---- group: Request specific outputs
toggle_3 = BooleanToggle(True)
simoutput = HBSimulationOutput(zone_energy_use=toggle_3, gains_and_losses=toggle_3, comfort_metrics=toggle_3, surface_energy_flow=toggle_3)  # -> report, sim_output; plug-in component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
simpar = HBSimulationParameter(output=simoutput.sim_output, timestep=6)  # -> sim_par; plug-in component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

# ----
toggle_4 = BooleanToggle(True)

# ----
# Temporary data for developing UI
element_types = Data(["Aperture", "Grasshopper.Kernel.Types.GH_ObjectWrapper", "Grasshopper.Kernel.Types.GH_ObjectWrapper", "Grasshopper.Kernel.Types.GH_ObjectWrapper"])
gwp_by_element_type = Data(["50", "40", "75", "25"])
placeholder_data = Panel(element_types)
placeholder_data_2 = Panel(gwp_by_element_type)
ma = MassAddition(Input=placeholder_data_2)  # -> Result, PartialResults
total_gwp = Data(ma.Result)
lca_element_types = RemoteSender(placeholder_data)
lca_gwp_by_element_type = RemoteSender(placeholder_data_2)
lca_total_gwp = RemoteSender(total_gwp)

shading_geometry = Data()

# ----
# Create test model
building = Geometry([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])
adjacent_rooms_1 = Geometry([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])
ground = Geometry(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)
site = Geometry([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])
panel_19 = Panel("""Heath::Test model::Rooms
Heath::Test model::Windows
Heath::Test model::Adjacent
Heath::Test model::Context""")
adjacent_rooms_2 = Geometry([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])
entwine_10 = Entwine(Branch00="Room", Branch01="Window", Branch02="Adjacent", Branch03="Context", FlattenInputs=True)
merge_3 = Merge(Data1=ground, Data2=site, Data3=building, Data4=adjacent_rooms_1)
merge_4 = Merge(Data1=ground, Data2=site, Data3=building, Data4=adjacent_rooms_2)
lng = ListLength(List=flatten(entwine_10))
ef_layer = EleFrontLayer(FullPath=panel_19)  # -> graft(Layer), FullPath, Hidden, Locked, DisplayColour, MaterialName, Linetype, PrintColour, PrintWidth
repeat = RepeatData(Data="Heath geometry type", Length=lng)  # -> graft(Data)
ef_att = EleFrontAttributes(Keys=repeat, Values=entwine_10, Layer=ef_layer.Layer)  # -> Attributes, Keys, Values, Name, Layer, ColourSource, DisplayColour, MaterialSource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

# ----
# Model 1
windows1 = Geometry([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])
room1 = Geometry(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)
adjacent_1 = Geometry([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])
context_1 = Geometry(merge_3)

# ----
# Model 2
geo = Geometry(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)
adjacent_2 = Geometry([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])
geo_2 = Geometry([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])
context_2 = Geometry(merge_4)

entwine_11 = Entwine(Branch00=room1, Branch01=windows1, Branch02=adjacent_1, Branch03=context_1, FlattenInputs=True)
lng_2 = ListLength(List=entwine_11)
repeat_2 = RepeatData(Data=ef_att.Attributes, Length=lng_2)

# ----
# Display the windows
number_slider_5 = Slider(2, range=1..2)
generic_shgc = Data(0.4240807069)
generic_u_value = Data(1.687787378)

# ----
# Display the construction parts??
panel_20 = Panel("Generic")

# ----
# Assembly model
panel_21 = Panel("Assembly module")
checkbox = CreateCheckbox(Label="Doors", StartingValue=False)
checkbox_2 = CreateCheckbox(Label="Context", StartingValue=False)
checkbox_3 = CreateCheckbox(Label="Windows", StartingValue=False)
checkbox_4 = CreateCheckbox(Label="All", StartingValue=False)
checkbox_5 = CreateCheckbox(Label="Ground", StartingValue=False)
checkbox_6 = CreateCheckbox(Label="Floors", StartingValue=False)
label_10 = CreateLabel(LabelText="Show components", LabelSize=12, Justification=0)
checkbox_7 = CreateCheckbox(Label="Roof", StartingValue=False)
checkbox_8 = CreateCheckbox(Label="Walls", StartingValue=False)
textbox = CreateTextBox(Label="Model name", DefaultText="My model", UpdateButton=invert(True), showLabel=True)
button_2 = CreateButton(ButtonName="Create model", ButtonStyle=0)
values_15 = ValueListener(Elements=button_2, SomeProperty=True)  # -> Values, Indices
freeze_gate = StreamFreezeGate(Data=values_15.Values, PassingSwitch=invert(values_15.Values))
freeze_gate_2 = StreamFreezeGate(Data=values_15.Values, PassingSwitch=values_15.Values)
values_16 = ValueListener(Elements=checkbox, SomeProperty=True)  # -> Values, Indices
values_17 = ValueListener(Elements=checkbox_2, SomeProperty=True)  # -> Values, Indices
values_18 = ValueListener(Elements=checkbox_3, SomeProperty=True)  # -> Values, Indices
button_3 = CreateButton(ButtonName="Bake model", ButtonStyle=0)
values_19 = ValueListener(Elements=button_3, SomeProperty=True)  # -> Values, Indices
values_20 = ValueListener(Elements=checkbox_4, SomeProperty=True)  # -> Values, Indices
values_21 = ValueListener(Elements=checkbox_5, SomeProperty=True)  # -> Values, Indices
values_22 = ValueListener(Elements=checkbox_6, SomeProperty=True)  # -> Values, Indices
slider_6 = CreateSlider(
    Slider=Slider(0.3, range=0.05..1),
    SnapValue=Slider(0.05, range=0..1),
    ShowBounds=False,
    ShowTicks=True,
    ShowTooltip=False,
    ShowValLabel=True,
    showLabel=False)
slider_7 = CreateSlider(
    Slider=Slider(0.3, range=0.05..1),
    SnapValue=Slider(0.05, range=0..1),
    ShowBounds=False,
    ShowTicks=True,
    ShowTooltip=True,
    ShowValLabel=True,
    showLabel=False)
values_23 = ValueListener(Elements=checkbox_7, SomeProperty=True)  # -> Values, Indices
label_11 = CreateLabel(LabelText="Set wall thickness [m]", LabelSize=12, Justification=0)
label_12 = CreateLabel(LabelText="Set roof thickness [m]", LabelSize=12, Justification=0)
values_24 = ValueListener(Elements=checkbox_8, SomeProperty=True)  # -> Values, Indices
freeze_gate_3 = StreamFreezeGate(Data=values_19.Values, PassingSwitch=invert(values_19.Values))
bool_2 = Boolean(invert(freeze_gate))
values_25 = ValueListener(Elements=textbox, SomeProperty=True)  # -> Values, Indices
bool_3 = Boolean(invert(freeze_gate_3))
tap = TapBuffer(Reset=False, Incremental=True, Valve=bool_2, Hold=True)
values_26 = ValueListener(Elements=slider_6, SomeProperty=True)  # -> Values, Indices
values_27 = ValueListener(Elements=slider_7, SomeProperty=True)  # -> Values, Indices
tooltip_2 = AttachTooltipToElement(ElementsToAttachTo=slider_6, TooltipContent="Doubleclick to input value", ShowDelay=500, Duration=2000)
tooltip_3 = AttachTooltipToElement(ElementsToAttachTo=slider_7, TooltipContent="Doubleclick to input value", ShowDelay=500, Duration=2000)
entwine_12 = Entwine(Branch00=label_11, Branch01=slider_6, FlattenInputs=True)  # -> flatten(Result)
model_name = RemoteSender(values_25.Values)
panel_22 = Panel(values_25.Values)
tap_2 = TapBuffer(Reset=False, Incremental=True, Valve=bool_3, Hold=True)
entwine_13 = Entwine(Branch00=label_12, Branch01=slider_7, FlattenInputs=True)  # -> flatten(Result)
dam = DataDam(DataA=tap, BufferDelay=2500000, BufferMode=2)
wall_thickness = RemoteSender(values_26.Values)
roof_thickness = RemoteSender(values_27.Values)
dam_2 = DataDam(DataA=tap_2, BufferDelay=2500000, BufferMode=2)
equals = Equality(FirstNumber=tap, SecondNumber=dam)  # -> Equality, Inequality
equals_2 = Equality(FirstNumber=tap_2, SecondNumber=dam_2)  # -> Equality, Inequality
entwine_14 = Entwine(
    Branch00=label_10,
    Branch01=checkbox_4,
    Branch02=checkbox_8,
    Branch03=checkbox_7,
    Branch04=checkbox_6,
    Branch05=checkbox_5,
    Branch06=checkbox_3,
    Branch07=checkbox,
    Branch08=checkbox_2,
    FlattenInputs=True)  # -> flatten(Result)
stack_8 = CreateStack(UIElements=entwine_14, Horizontal=invert(True))
entwine_15 = Entwine(Branch00=button_2, Branch01=button_3, FlattenInputs=True)  # -> flatten(Result)
border = CreateBorder(
    UIElement=stack_8,
    BorderThickness=Slider(1, range=0..10),
    BorderColor=ColourSwatch(SwatchColor=RGB(217, 217, 217)),
    CornerRadius=Slider(2, range=0..10))
adjustpos_7 = AdjustElementPositioning(ElementsToAdjust=border, Margin="25, 5, 0, 0", AbsolutePositioning=False, HorizontalAlignment=0, VerticalAlignment=2)
adjustpos_8 = AdjustElementPositioning(
    ElementsToAdjust=textbox,
    Margin="0, 5, 0, 10",
    AbsolutePositioning=False,
    Width=Slider(210, range=0..300),
    Height=Slider(30, range=0..300),
    HorizontalAlignment=0)
adjustpos_9 = AdjustElementPositioning(
    ElementsToAdjust=[slider_6, slider_7],
    AbsolutePositioning=False,
    Width=Slider(200, range=0..300),
    Height=Slider(25, range=0..300),
    HorizontalAlignment=0,
    VerticalAlignment=2)
stack_9 = CreateStack(UIElements=entwine_15, Horizontal=True)

stack_10 = CreateStack(UIElements=entwine_13, Horizontal=invert(True))
stack_11 = CreateStack(UIElements=entwine_12, Horizontal=invert(True))
adjustpos_10 = AdjustElementPositioning(ElementsToAdjust=[stack_10, stack_11], Margin="0, 5, 0, 0", AbsolutePositioning=False)
entwine_16 = Entwine(Branch00=label_6, Branch01=textbox, FlattenInputs=True)  # -> flatten(Result)
adjustpos_11 = AdjustElementPositioning(ElementsToAdjust=entwine_15, Margin="5, 10, 0, 0", AbsolutePositioning=False, HorizontalAlignment=0)

# ----
# Visualize model
location_4 = Data(border)

# ----
# Model name
model_name_2 = Data(entwine_16)

# ----
# Create model
create_model = Data(stack_9)

# ----
# Visualize module
panel_23 = Panel("""properties.energy.construction.display_name
properties.energy.construction.layers
properties.energy.construction.thickness
properties.energy.construction.mass_area_density
properties.energy.construction.area_heat_capacity
properties.energy.construction.r_value
properties.energy.construction.u_value
properties.energy.construction.u_factor
properties.energy.construction.shgc
properties.energy.r_factor
properties.energy.u_factor
properties.energy.shgc""")
panel_24 = Panel("""properties.energy.program_type.display_name
properties.energy.construction_set.display_name
properties.energy.is_conditioned
properties.energy.people.people_per_area
properties.energy.people.area_per_person
properties.energy.lighting.watts_per_area
properties.energy.electric_equipment.watts_per_area
properties.energy.gas_equipment.watts_per_area
properties.energy.service_hot_water.flow_per_area""")
panel_25 = Panel("""Sky dome
Sky mask
Wind rose
Dry bulb temperature line chart
Dry bulb temperature 2D chart
Direct sun hours
Incident radiation""")
panel_26 = Panel("""display_name
identifier
multiplier
exclude_floor_area
story
volume
floor_area
exposed_area
exterior_wall_area
exterior_aperture_area
average_floor_height""")
panel_27 = Panel("""display_name
identifier
boundary_condition
has_parent
parent
azimuth
altitude
area
perimeter
type
is_operable
is_glass""")
button_4 = CreateButton(ButtonName="Run weather visualization", ButtonStyle=0)
button_5 = CreateButton(ButtonName="Zoom", ButtonStyle=0)
button_6 = CreateButton(ButtonName="Bake", ButtonStyle=0)
values_28 = ValueListener(Elements=button_5, SomeProperty=True)  # -> Values, Indices
values_29 = ValueListener(Elements=button_6, SomeProperty=True)  # -> Values, Indices
values_30 = ValueListener(Elements=button_4, SomeProperty=True)  # -> Values, Indices
pulldown = CreatePulldownMenu(Label="Type", ListItems=panel_25, showLabel=True)
checkbox_9 = CreateCheckbox(Label="Visualize", StartingValue=False)
panel_28 = Panel("""Program
Construction Set
Is Conditioned
People per Area [ppl/m2]
Area per Person [m2/ppl]
Lighting per Area [W/m2]
Electric Equipment per Area [W/m2]
Gas Equipment per Area [W/m2]
Hot Water per Area [L/h-m2]""")
panel_29 = Panel("""Display Name
Simulation Name (Identifier)
Boundary Condition
Has Parent
Parent
Azimuth
Altitude
Area
Perimeter
Face Type
Aperture Is Operable
Door Is Glass""")
panel_30 = Panel("""Construction
Materials
Thickness [m]
Density [kg/m2]
Heat Capacity [J/K-m2]
Construction R-Value [m2-K/W]
Construction U-Value [W/m2-K]
Construction U-Factor [W/m2-K]
Construction SHGC [Unshaded]
R-Factor [m2-K/W]
U-Factor [W/m2-K]
SHGC [Unshaded]""")
panel_31 = Panel("""Display Name
Simulation Name (Identifier)
Multiplier
Floor Area Excluded
Story
Volume
Gross Floor Area
Exposed Area
Exterior Wall Area
Exterior Aperture Area
Average Floor Elevation""")
zoom_weather_visualization = RemoteSender(values_28.Values)
freeze_gate_4 = StreamFreezeGate(Data=values_29.Values, PassingSwitch=invert(values_29.Values))
freeze_gate_5 = StreamFreezeGate(Data=values_30.Values, PassingSwitch=invert(values_30.Values))
values_31 = ValueListener(Elements=checkbox_9, SomeProperty=True)  # -> Values, Indices
values_32 = ValueListener(Elements=pulldown, SomeProperty=True)  # -> Values, Indices
bool_4 = Boolean(invert(freeze_gate_4))
bool_5 = Boolean(invert(freeze_gate_5))
entwine_17 = Entwine(Branch00=pulldown, Branch01=checkbox_9, FlattenInputs=True)  # -> flatten(Result)
weather_visualization_type = RemoteSender(values_32.Indices)
tap_3 = TapBuffer(Reset=False, Incremental=True, Valve=bool_4, Hold=True)
tap_4 = TapBuffer(Reset=False, Incremental=True, Valve=bool_5, Hold=True)
stack_12 = CreateStack(UIElements=entwine_17, Horizontal=True)
pulldown_2 = CreatePulldownMenu(Label="Room attribute", ListItems=panel_31, showLabel=True)
pulldown_3 = CreatePulldownMenu(Label="Room energy attribute", ListItems=panel_28, showLabel=True)
checkbox_10 = CreateCheckbox(Label="Visualize", StartingValue=False)
checkbox_11 = CreateCheckbox(Label="Visualize", StartingValue=False)
label_13 = CreateLabel(LabelText="Attributes visualization", LabelSize=18, Justification=0)
checkbox_12 = CreateCheckbox(Label="Visualize", StartingValue=False)
pulldown_4 = CreatePulldownMenu(Label="Face attribute", ListItems=panel_29, showLabel=True)
dam_3 = DataDam(DataA=tap_3, BufferDelay=2500000, BufferMode=2)
dam_4 = DataDam(DataA=tap_4, BufferDelay=2500000, BufferMode=2)
entwine_18 = Entwine(Branch00=button_4, Branch01=button_5, Branch02=button_6, FlattenInputs=True)  # -> flatten(Result)
pulldown_5 = CreatePulldownMenu(Label="Face energy attribute", ListItems=panel_30, showLabel=True)
checkbox_13 = CreateCheckbox(Label="Visualize", StartingValue=False)
equals_3 = Equality(FirstNumber=tap_4, SecondNumber=dam_4)  # -> Equality, Inequality
equals_4 = Equality(FirstNumber=tap_3, SecondNumber=dam_3)  # -> Equality, Inequality
values_33 = ValueListener(Elements=checkbox_11, SomeProperty=True)  # -> Values, Indices
values_34 = ValueListener(Elements=pulldown_3, SomeProperty=True)  # -> Values, Indices
entwine_19 = Entwine(Branch00=pulldown_2, Branch01=checkbox_10, FlattenInputs=True)  # -> flatten(Result)
entwine_20 = Entwine(Branch00=pulldown_3, Branch01=checkbox_11, FlattenInputs=True)  # -> flatten(Result)
values_35 = ValueListener(Elements=pulldown_2, SomeProperty=True)  # -> Values, Indices
values_36 = ValueListener(Elements=pulldown_4, SomeProperty=True)  # -> Values, Indices
values_37 = ValueListener(Elements=checkbox_10, SomeProperty=True)  # -> Values, Indices
values_38 = ValueListener(Elements=checkbox_12, SomeProperty=True)  # -> Values, Indices
entwine_21 = Entwine(Branch00=pulldown_4, Branch01=checkbox_12, FlattenInputs=True)  # -> flatten(Result)
values_39 = ValueListener(Elements=pulldown_5, SomeProperty=True)  # -> Values, Indices
entwine_22 = Entwine(Branch00=pulldown_5, Branch01=checkbox_13, FlattenInputs=True)  # -> flatten(Result)
values_40 = ValueListener(Elements=checkbox_13, SomeProperty=True)  # -> Values, Indices
stack_13 = CreateStack(UIElements=entwine_18, Horizontal=True)
item = ListItem(List=panel_24, Index=values_34.Indices, Wrap=invert(True))
item_2 = ListItem(List=panel_26, Index=values_35.Indices, Wrap=invert(True))
stack_14 = CreateStack(UIElements=entwine_20, Horizontal=True)
item_3 = ListItem(List=panel_27, Index=values_36.Indices, Wrap=invert(True))
stack_15 = CreateStack(UIElements=entwine_19, Horizontal=True)
item_4 = ListItem(List=panel_23, Index=values_39.Indices, Wrap=invert(True))
stack_16 = CreateStack(UIElements=entwine_21, Horizontal=True)
stack_17 = CreateStack(UIElements=entwine_22, Horizontal=True)
room_energy_attribute = RemoteSender(item)
room_attribute = RemoteSender(item_2)
entwine_23 = Entwine(Branch00=stack_13, Branch01=stack_12, FlattenInputs=True)  # -> flatten(Result)
face_attribute = RemoteSender(item_3)
face_energy_attribute = RemoteSender(item_4)
stack_18 = CreateStack(UIElements=entwine_23, Horizontal=invert(True))
hideshow_5 = HideShowElement(ElementToHideShow=checkbox_10, Show=True, Collapse=True, Disable=values_33.Values)
hideshow_6 = HideShowElement(ElementToHideShow=checkbox_11, Show=True, Collapse=True, Disable=values_37.Values)
hideshow_7 = HideShowElement(ElementToHideShow=checkbox_12, Show=True, Collapse=True, Disable=values_40.Values)
hideshow_8 = HideShowElement(ElementToHideShow=checkbox_13, Show=True, Collapse=True, Disable=values_38.Values)
entwine_24 = Entwine(Branch00=label_13, Branch01=stack_15, Branch02=stack_14, Branch03=stack_16, Branch04=stack_17, FlattenInputs=True)  # -> flatten(Result)
border_2 = CreateBorder(
    UIElement=stack_18,
    BorderThickness=Slider(1, range=0..10),
    BorderColor=ColourSwatch(SwatchColor=RGB(217, 217, 217)),
    CornerRadius=Slider(2, range=0..10))
adjustpos_12 = AdjustElementPositioning(ElementsToAdjust=stack_18, AbsolutePositioning=False, Width=Slider(300, range=0..300), HorizontalAlignment=0)
adjustpos_13 = AdjustElementPositioning(ElementsToAdjust=pulldown, Margin="5, 5, 0, 0", AbsolutePositioning=False, Width=Slider(215, range=0..400))
adjustpos_14 = AdjustElementPositioning(ElementsToAdjust=checkbox_9, Margin="5, 5, 0, 0", AbsolutePositioning=False)
stack_19 = CreateStack(UIElements=entwine_24, Horizontal=invert(True))
adjustpos_15 = AdjustElementPositioning(
    ElementsToAdjust=[pulldown_2, pulldown_3, pulldown_4, pulldown_5],
    AbsolutePositioning=False,
    Width=Slider(239, range=0..400),
    HorizontalAlignment=0)
adjustpos_16 = AdjustElementPositioning(ElementsToAdjust=border_2, AbsolutePositioning=False, HorizontalAlignment=0, VerticalAlignment=2)
border_3 = CreateBorder(
    UIElement=stack_19,
    BorderThickness=Slider(1, range=0..10),
    BorderColor=ColourSwatch(SwatchColor=RGB(217, 217, 217)),
    CornerRadius=Slider(2, range=0..10))
adjustpos_17 = AdjustElementPositioning(ElementsToAdjust=border_3, Margin="0, 0, 0, 10", AbsolutePositioning=False, HorizontalAlignment=0, VerticalAlignment=2)

adjustpos_18 = AdjustElementPositioning(ElementsToAdjust=[checkbox_10, checkbox_11, checkbox_12, checkbox_13], Margin="0, 0, 10, 0", AbsolutePositioning=False)
entwine_25 = Entwine(Branch00=label_13, Branch01=border_3, FlattenInputs=True)  # -> flatten(Result)
entwine_26 = Entwine(Branch00=label_8, Branch01=border_2, FlattenInputs=True)  # -> flatten(Result)

# ----
# Attributes visualization
location_5 = Data(entwine_25)

# ----
# Run weather visualization
location_6 = Data(entwine_26)

entwine_27 = Entwine(Branch00=location_5, Branch01=location_6, FlattenInputs=True)  # -> flatten(Result)
stack_20 = CreateStack(UIElements=entwine_27, Horizontal=invert(True))

# ----
# Geometry module
panel_32 = Panel("""The document is currently in {0}.
Honeybee models require models in meters.""")
panel_33 = Panel("""Room
Window
Adjacent
Context
None""")
panel_34 = Panel("""All
Room
Window
Adjacent
Context""")
panel_35 = Panel("""gbg
mumindalen
villa villekulla""")
button_7 = CreateButton(ButtonName="Change document units", ButtonStyle=0)
tb_3 = CreateTextBlock(TextSize=12, Justification=0)
label_14 = CreateLabel(LabelText="Import", LabelSize=18, Justification=0)
number_slider_6 = Slider(15, range=0..20)
number_slider_7 = Slider(15, range=0..20)
number_slider_8 = Slider(15, range=0..20)
number_slider_9 = Slider(15, range=0..20)
pulldown_6 = CreatePulldownMenu(Label="Geometry type", ListItems=panel_33, showLabel=True)
button_8 = CreateButton(ButtonName="Save geometry", ButtonStyle=0)
number_slider_10 = Slider(10, range=0..10)
number_slider_11 = Slider(10, range=0..10)
number_slider_12 = Slider(10, range=0..10)
number_slider_13 = Slider(10, range=0..10)
checkbox_14 = CreateCheckbox(Label="Preview", StartingValue=False)
pulldown_7 = CreatePulldownMenu(Label="Geometry type", ListItems=panel_34, showLabel=True)
label_15 = CreateLabel(LabelText="Preview", LabelSize=18, Justification=0)
pt_5 = ConstructPoint(XCoordinate=Slider(10, range=0..10), YCoordinate=Slider(-20, range=-100..0), ZCoordinate=0)
pt_6 = ConstructPoint(XCoordinate=Slider(10, range=0..10), YCoordinate=Slider(-20, range=-100..0), ZCoordinate=0)
pt_7 = ConstructPoint(XCoordinate=Slider(10, range=0..10), YCoordinate=Slider(-20, range=-100..0), ZCoordinate=0)
pt_8 = ConstructPoint(XCoordinate=Slider(10, range=0..10), YCoordinate=Slider(-20, range=-100..0), ZCoordinate=0)
pulldown_8 = CreatePulldownMenu(ListItems=panel_35, showLabel=True)
label_16 = CreateLabel(LabelText="Set location", LabelSize=18, Justification=0)
button_9 = CreateButton(ButtonName="Create test model", ButtonStyle=0)
button_10 = CreateButton(ButtonName="Get climate data", ButtonStyle=0)
values_41 = ValueListener(Elements=pulldown_6, SomeProperty=True)  # -> Values, Indices
values_42 = ValueListener(Elements=button_7, SomeProperty=True)  # -> Values, Indices
rectangle = Rectangle(Plane=PlaneXY(0, 0, 0), XSize=number_slider_10, YSize=number_slider_10, Radius=0)  # -> Rectangle, Length
rectangle_2 = Rectangle(Plane=PlaneXY(0, 0, 0), XSize=number_slider_11, YSize=number_slider_11, Radius=0)  # -> Rectangle, Length
rectangle_3 = Rectangle(Plane=pt_5, XSize=number_slider_6, YSize=number_slider_6, Radius=0)  # -> Rectangle, Length
rectangle_4 = Rectangle(Plane=pt_6, XSize=number_slider_7, YSize=number_slider_7, Radius=0)  # -> Rectangle, Length
rectangle_5 = Rectangle(Plane=PlaneXY(0, 0, 0), XSize=number_slider_12, YSize=number_slider_12, Radius=0)  # -> Rectangle, Length
rectangle_6 = Rectangle(Plane=PlaneXY(0, 0, 0), XSize=number_slider_13, YSize=number_slider_13, Radius=0)  # -> Rectangle, Length
rectangle_7 = Rectangle(Plane=pt_7, XSize=number_slider_8, YSize=number_slider_8, Radius=0)  # -> Rectangle, Length
rectangle_8 = Rectangle(Plane=pt_8, XSize=number_slider_9, YSize=number_slider_9, Radius=0)  # -> Rectangle, Length
entwine_28 = Entwine(Branch00=pulldown_7, Branch01=checkbox_14, FlattenInputs=True)  # -> flatten(Result)
values_43 = ValueListener(Elements=checkbox_14, SomeProperty=True)  # -> Values, Indices
values_44 = ValueListener(Elements=button_9, SomeProperty=True)  # -> Values, Indices
geometrytype_validate = RemoteSender(values_41.Indices)
geometrytype = RemoteSender(values_41.Values)
change_document_units = RemoteSender(values_42.Values)
tb_4 = CreateTextBlock(TextSize=12, Justification=0)
tb_5 = CreateTextBlock(TextSize=12, Justification=0)
shapes = CreateShapes(Shapes=rectangle.Rectangle, StrokeColor=RGB(0, 0, 0), Scale=1, ClickMode=3)
shapes_2 = CreateShapes(Shapes=rectangle_2.Rectangle, StrokeColor=RGB(0, 0, 0), Scale=1, ClickMode=3)
values_45 = ValueListener(Elements=button_10, SomeProperty=True)  # -> Values, Indices
tb_6 = CreateTextBlock(TextSize=12, Justification=0)
tb_7 = CreateTextBlock(TextSize=12, Justification=0)
shapes_3 = CreateShapes(Shapes=rectangle_5.Rectangle, StrokeColor=RGB(0, 0, 0), Scale=1, ClickMode=3)
shapes_4 = CreateShapes(Shapes=rectangle_6.Rectangle, StrokeColor=RGB(0, 0, 0), Scale=1, ClickMode=3)
values_46 = ValueListener(Elements=pulldown_8, SomeProperty=True)  # -> Values, Indices
values_47 = ValueListener(Elements=pulldown_7, SomeProperty=True)  # -> Values, Indices
stack_21 = CreateStack(UIElements=entwine_28, Horizontal=True)
freeze_gate_6 = StreamFreezeGate(Data=values_44.Values, PassingSwitch=invert(values_44.Values))
settextblock_3 = SetTextBlockContents(TextBlockToModify=tb_4, NewTextBlockContents="Window geometry")
settextblock_4 = SetTextBlockContents(TextBlockToModify=tb_5, NewTextBlockContents="Context geometry")
getclimatedata = RemoteSender(values_45.Values)
settextblock_5 = SetTextBlockContents(TextBlockToModify=tb_6, NewTextBlockContents="Room geometry")
settextblock_6 = SetTextBlockContents(TextBlockToModify=tb_7, NewTextBlockContents="Adjacent geometry")
location_7 = RemoteSender(values_46.Values)
previewtype = RemoteSender(values_47.Values)
bool_6 = Boolean(invert(freeze_gate_6))
entwine_29 = Entwine(Branch00=tb_3, Branch01=button_7, FlattenInputs=True)  # -> flatten(Result)
setshapes = SetShapes(
    ShapeToModify=shapes,
    ShapeCurves=rectangle_3.Rectangle,
    FillColors=ColourSwatch(SwatchColor=RGBA(128, 0, 102, 75)),
    StrokeColors=ColourSwatch(SwatchColor=RGB(255, 255, 255)),
    Scale=1)
setshapes_2 = SetShapes(
    ShapeToModify=shapes_2,
    ShapeCurves=rectangle_4.Rectangle,
    FillColors=ColourSwatch(SwatchColor=RGBA(128, 125, 0, 75)),
    StrokeColors=ColourSwatch(SwatchColor=RGB(255, 255, 255)),
    Scale=1)
setshapes_3 = SetShapes(
    ShapeToModify=shapes_3,
    ShapeCurves=rectangle_7.Rectangle,
    FillColors=ColourSwatch(SwatchColor=RGBA(4, 128, 0, 75)),
    StrokeColors=ColourSwatch(SwatchColor=RGB(255, 255, 255)),
    Scale=1)
setshapes_4 = SetShapes(
    ShapeToModify=shapes_4,
    ShapeCurves=rectangle_8.Rectangle,
    FillColors=ColourSwatch(SwatchColor=RGBA(0, 17, 128, 75)),
    StrokeColors=ColourSwatch(SwatchColor=RGB(255, 255, 255)),
    Scale=1)
tap_5 = TapBuffer(Reset=False, Incremental=True, Valve=bool_6, Hold=True)
entwine_30 = Entwine(Branch00=shapes, Branch01=tb_4, FlattenInputs=True)  # -> flatten(Result)
entwine_31 = Entwine(Branch00=shapes_2, Branch01=tb_5, FlattenInputs=True)  # -> flatten(Result)
entwine_32 = Entwine(Branch00=shapes_3, Branch01=tb_6, FlattenInputs=True)  # -> flatten(Result)
entwine_33 = Entwine(Branch00=shapes_4, Branch01=tb_7, FlattenInputs=True)  # -> flatten(Result)
stack_22 = CreateStack(UIElements=entwine_29, Horizontal=invert(True))
dam_5 = DataDam(DataA=tap_5, BufferDelay=2500000, BufferMode=2)
stack_23 = CreateStack(UIElements=entwine_30, Horizontal=True)
stack_24 = CreateStack(UIElements=entwine_31, Horizontal=True)
equals_5 = Equality(FirstNumber=tap_5, SecondNumber=dam_5)  # -> Equality, Inequality
stack_25 = CreateStack(UIElements=entwine_32, Horizontal=True)
stack_26 = CreateStack(UIElements=entwine_33, Horizontal=True)
adjustpos_19 = AdjustElementPositioning(ElementsToAdjust=tb_4, Margin="5, 5, 0, 0", AbsolutePositioning=False)
adjustelem_3 = AdjustElementAppearance(ElementsToAdjust=tb_4, Foreground=ColourSwatch(SwatchColor=RGB(0, 0, 0)))
adjustpos_20 = AdjustElementPositioning(ElementsToAdjust=tb_5, Margin="5, 5, 0, 0", AbsolutePositioning=False)
adjustelem_4 = AdjustElementAppearance(ElementsToAdjust=tb_5, Foreground=ColourSwatch(SwatchColor=RGB(0, 0, 0)))
adjustpos_21 = AdjustElementPositioning(ElementsToAdjust=tb_6, Margin="5, 5, 0, 0", AbsolutePositioning=False)
adjustelem_5 = AdjustElementAppearance(ElementsToAdjust=tb_6, Foreground=ColourSwatch(SwatchColor=RGB(0, 0, 0)))
adjustpos_22 = AdjustElementPositioning(ElementsToAdjust=tb_7, Margin="5, 5, 0, 0", AbsolutePositioning=False)
adjustelem_6 = AdjustElementAppearance(ElementsToAdjust=tb_7, Foreground=ColourSwatch(SwatchColor=RGB(0, 0, 0)))
adjustpos_23 = AdjustElementPositioning(ElementsToAdjust=pulldown_7, AbsolutePositioning=False, Width=Slider(150, range=0..300), HorizontalAlignment=0)
adjustpos_24 = AdjustElementPositioning(ElementsToAdjust=button_9, Margin="10, 15, 0, 0", AbsolutePositioning=False, HorizontalAlignment=0)
adjustpos_25 = AdjustElementPositioning(ElementsToAdjust=button_10, AbsolutePositioning=False, Width=Slider(120, range=0..300), HorizontalAlignment=0)
adjustpos_26 = AdjustElementPositioning(ElementsToAdjust=pulldown_8, AbsolutePositioning=False, Width=Slider(150, range=0..300), HorizontalAlignment=0)
adjustpos_27 = AdjustElementPositioning(ElementsToAdjust=stack_22, Margin="5, 5, 0, 0", AbsolutePositioning=False, Width=Slider(160, range=0..800))
adjustpos_28 = AdjustElementPositioning(ElementsToAdjust=pulldown_6, AbsolutePositioning=False, Width=Slider(180, range=0..300), HorizontalAlignment=0)
entwine_34 = Entwine(Branch00=stack_25, Branch01=stack_23, Branch02=stack_26, Branch03=stack_24, FlattenInputs=True)  # -> flatten(Result)
entwine_35 = Entwine(Branch00=label_16, Branch01=pulldown_8, Branch02=button_10, FlattenInputs=True)  # -> flatten(Result)

values_48 = ValueListener(Elements=button_8, SomeProperty=True)  # -> Values, Indices

# ----
# Preview label
preview = Data(label_15)

adjustelem_7 = AdjustElementAppearance(ElementsToAdjust=tb_3, Foreground=ColourSwatch(SwatchColor=RGB(0, 0, 0)))
freeze_gate_7 = StreamFreezeGate(Data=values_48.Values, PassingSwitch=invert(values_48.Values))
presavegeometry = RemoteSender(values_48.Values)

# ----
# Document units
doc_units = DocumentUnits()
change_document_units_2 = RemoteReceiver(change_document_units)
document_units = RemoteSender(doc_units)
gate_2 = StreamGate(Stream="4", Gate=change_document_units_2)  # -> Target0, Target1
unit_warning = UnitWarning(UnitSystem=gate_2.Target1)

bool_7 = Boolean(invert(freeze_gate_7))
entwine_36 = Entwine(Branch00=button_8, Branch01=true_button, FlattenInputs=True)  # -> flatten(Result)
geometry_module_state_preview_type = RemoteSender(values_47.Indices)
tap_6 = TapBuffer(Reset=False, Incremental=True, Valve=bool_7, Hold=True)
adjustpos_29 = AdjustElementPositioning(ElementsToAdjust=button_7, AbsolutePositioning=False, Width=Slider(150, range=0..800), HorizontalAlignment=0)
stack_27 = CreateStack(UIElements=entwine_36, Horizontal=True)
dam_6 = DataDam(DataA=tap_6, BufferDelay=2500000, BufferMode=2)
equals_6 = Equality(FirstNumber=tap_6, SecondNumber=dam_6)  # -> Equality, Inequality
entwine_37 = Entwine(Branch00=stack_27, Branch01=label_7, FlattenInputs=True)  # -> flatten(Result)
border_4 = CreateBorder(
    UIElement=stack_22,
    BorderThickness=Slider(1, range=0..10),
    BorderColor=ColourSwatch(SwatchColor=RGB(255, 0, 0)),
    CornerRadius=Slider(1, range=0..10))

# ----
# Document unit warning text
location_8 = Data(border_4)

# ----
# Test model
location_9 = Data(button_9)

presavegeometry_2 = RemoteReceiver(presavegeometry)
getclimatedata_2 = RemoteReceiver(getclimatedata)

# ---- group: Setup study case
# Get climate data
panel_36 = Panel("https://energyplus-weather.s3.amazonaws.com/europe_wmo_region_6/SWE/SWE_Goteborg.Landvetter.025260_IWEC/SWE_Goteborg.Landvetter.025260_IWEC.zip")
button_11 = Button()
epwmap = LBEPWmap(epw_map=getclimatedata_2)  # -> report; plug-in component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

# ----
panel_37 = Panel(getclimatedata_2)

# ----
# Program module
panel_38 = Panel("""LargeOffice
MediumOffice
SmallOffice
MidriseApartment
HighriseApartment
Retail
StripMall
PrimarySchool
SecondarySchool
SmallHotel
LargeHotel
Hospital
Outpatient
Laboratory
Warehouse
SuperMarket
FullServiceRestaurant
QuickServiceRestaurant
Courthouse
LargeDataCenterHighITE
LargeDataCenterLowITE
SmallDataCenterHighITE
SmallDataCenterLowITE""")
cooling_setpoint_ºc = Slider(27, range=10..40)
heating_setpoint_ºc = Slider(21, range=10..40)
empty_9 = EmptyObjectToEmptyBranch()
label_17 = CreateLabel(LabelText="Select program", LabelSize=18, Justification=0)
pulldown_9 = CreatePulldownMenu(Label="Room type", ListItems=empty_9, showLabel=True)
pulldown_10 = CreatePulldownMenu(Label="Building type", ListItems=panel_38, SelectedIndex="3", showLabel=True)
slider_8 = CreateSlider(Slider=cooling_setpoint_ºc, ShowBounds=False, ShowTicks=True, ShowTooltip=True, ShowValLabel=True, showLabel=False)
label_18 = CreateLabel(LabelText="Cooling setpoint [ºC]", LabelSize=12, Justification=0)
slider_9 = CreateSlider(Slider=heating_setpoint_ºc, ShowBounds=False, ShowTicks=True, ShowTooltip=False, ShowValLabel=True, showLabel=False)
label_19 = CreateLabel(LabelText="Heating setpoint [ºC]", LabelSize=12, Justification=0)
label_20 = CreateLabel(LabelText="Occupancy [person]", LabelSize=12, Justification=0)
slider_10 = CreateSlider(Slider=Slider(3, range=0..20), ShowBounds=False, ShowTicks=True, ShowTooltip=True, ShowValLabel=True, showLabel=False)
values_49 = ValueListener(Elements=pulldown_10, SomeProperty=True)  # -> Values, Indices
values_50 = ValueListener(Elements=pulldown_9, SomeProperty=True)  # -> Values, Indices
values_51 = ValueListener(Elements=slider_9, SomeProperty=True)  # -> Values, Indices
values_52 = ValueListener(Elements=slider_8, SomeProperty=True)  # -> Values, Indices
tooltip_4 = AttachTooltipToElement(ElementsToAttachTo=slider_9, TooltipContent="Doubleclick to input value", ShowDelay=500, Duration=2000)
values_53 = ValueListener(Elements=slider_10, SomeProperty=True)  # -> Values, Indices
tooltip_5 = AttachTooltipToElement(ElementsToAttachTo=slider_10, TooltipContent="Doubleclick to input value", ShowDelay=500, Duration=2000)
tooltip_6 = AttachTooltipToElement(ElementsToAttachTo=slider_8, TooltipContent="Doubleclick to input value", ShowDelay=500, Duration=2000)
selected_building = RemoteSender(values_49.Values)
selected_room = RemoteSender(values_50.Values)
cooling_setpoint = RemoteSender(values_52.Values)
cooling_setpoint_2 = RemoteReceiver(cooling_setpoint)
subtraction = Subtraction(A=cooling_setpoint_2, B="1")
dom = ConstructDomain(DomainStart=Slider(10, range=0..100), DomainEnd=subtraction)
setslider = SetSlider(UISlider=slider_9, Range=dom)
heating_setpoint = RemoteSender(values_51.Values)
heating_setpoint_2 = RemoteReceiver(heating_setpoint)
addition = Addition(A=heating_setpoint_2, B="1")
dom_2 = ConstructDomain(DomainStart=addition, DomainEnd=Slider(40, range=0..100))
setslider_2 = SetSlider(UISlider=slider_8, Range=dom_2)
occupancy = RemoteSender(values_53.Values)
adjustpos_30 = AdjustElementPositioning(ElementsToAdjust=slider_10, AbsolutePositioning=False, Width=Slider(200, range=0..300), HorizontalAlignment=0)
adjustpos_31 = AdjustElementPositioning(ElementsToAdjust=slider_9, AbsolutePositioning=False, Width=Slider(200, range=0..300), HorizontalAlignment=0)
entwine_38 = Entwine(Branch00=label_17, Branch01=pulldown_10, FlattenInputs=True)  # -> flatten(Result)
entwine_39 = Entwine(Branch01=pulldown_9, FlattenInputs=True)  # -> flatten(Result)
adjustpos_32 = AdjustElementPositioning(ElementsToAdjust=pulldown_9, AbsolutePositioning=False, Width=Slider(250, range=0..300), HorizontalAlignment=0)
entwine_40 = Entwine(Branch00=label_9, Branch01=label_18, Branch02=slider_8, FlattenInputs=True)  # -> flatten(Result)
adjustpos_33 = AdjustElementPositioning(ElementsToAdjust=pulldown_10, AbsolutePositioning=False, Width=Slider(250, range=0..300), HorizontalAlignment=0)
adjustpos_34 = AdjustElementPositioning(ElementsToAdjust=slider_8, AbsolutePositioning=False, Width=Slider(200, range=0..300), HorizontalAlignment=0)
entwine_41 = Entwine(Branch00=label_19, Branch01=slider_9, FlattenInputs=True)  # -> flatten(Result)
entwine_42 = Entwine(Branch00=label_20, Branch01=slider_10, FlattenInputs=True)  # -> flatten(Result)

# ----
# Select building program
location_10 = Data(entwine_38)

# ----
# Select room program
location_11 = Data(entwine_39)

# ----
# Occupancy
location_12 = Data(entwine_42)

# ----
# Heating setpoint
location_13 = Data(entwine_41)

# ----
# Cooling setpoint
location_14 = Data(entwine_40)

# ----
# Define program
# Simplified Boverket data
number_slider_14 = Slider(6, range=0..10)
selected_building_2 = RemoteReceiver(selected_building)
merge_5 = Merge(Data1=Slider(0.8, range=0..10), Data2=Slider(1.2, range=0..10), Data3=Slider(0.8, range=0..10))
merge_6 = Merge(Data1=number_slider_14, Data2=Slider(12, range=0..100), Data3=Slider(6, range=0..10))
python = GhPythonScript(sublist_lengths=merge_6, values=merge_5)  # -> out, out_list; inputs sublist_lengths: list of Int32, values: list
# ---------- python: Python ----------
"""Creates one list from a list of sublist lengths and the value to put in each sublist
    Inputs:
        sublist_lengths: sublist_lengths
        values: value in each sublist
    Output:
        a: The a output variable"""

__author__ = "sawen"
__version__ = "2024.05.24"

import rhinoscriptsyntax as rs

if not (len(sublist_lengths) == len(values)):
    raise Exception("sublist lengths and values must be the same size")

out_list = []

for i in range(len(sublist_lengths)):
    for j in range(int(sublist_lengths[i])):
        out_list.append(values[i])
# ---------- end python ----------
searchprog = HBSearchPrograms(bldg_prog=selected_building_2)  # -> room_prog; plug-in component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
constantschedule = HBConstantSchedule(values=python.out_list, name="household_electricity")  # -> report, schedule, idf_text; plug-in component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
room_programs = RemoteSender(searchprog)
selected_room_2 = RemoteReceiver(selected_room)
occupancy_2 = RemoteReceiver(occupancy)
constantschedule_2 = HBConstantSchedule(values=Slider(1, range=0..1))  # -> report, schedule, idf_text; plug-in component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
constantschedule_3 = HBConstantSchedule(values=Slider(1, range=0..1))  # -> report, schedule, idf_text; plug-in component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
applyloadvals = HBApplyLoadValues(room_or_program=flatten(selected_room_2), people_per_floor=occupancy_2)  # -> report, mod_obj; plug-in component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
cooling_setpoint_3 = RemoteReceiver(cooling_setpoint)
heating_setpoint_3 = RemoteReceiver(heating_setpoint)
python_2 = GhPythonScript(power_density=Slider(2.6, range=0..10), schedule=constantschedule_2.schedule)  # -> out, hot_water
# ---------- python_2: Python ----------
__author__ = "sawen"
__version__ = "2024.05.24"

import rhinoscriptsyntax as rs
from honeybee_energy.load.hotwater import ServiceHotWater as shw

if not name:
    name = "Domestic Hot Water"
    

hot_water = shw.from_watts_per_area(name, power_density, schedule)
# ---------- end python_2 ----------
equipment = HBEquipment(watts_per_area=Slider(3.4, range=0..10), schedule=constantschedule_3.schedule, lost_fract=Slider(0.3, range=0..1))  # -> equip; plug-in component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
applysetpointvals = HBApplySetpointValues(room_or_program=flatten(applyloadvals.mod_obj), cooling_setpt=cooling_setpoint_3, heating_setpt=heating_setpoint_3)  # -> report, mod_obj; plug-in component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
program = Data(applysetpointvals.mod_obj)
programtype = HBProgramType(name="My program", base_program=program, electric_equip=equipment, hot_water=python_2.hot_water)  # -> program; plug-in component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

room_programs_2 = RemoteReceiver(room_programs)
setlist = SetListContents(ListToModify=pulldown_9, NewListContents=room_programs_2, SelectedIndex="0")

document_units_2 = RemoteReceiver(document_units)
case = TextCase(Text=document_units_2, Culture=127)  # -> UpperCase, LowerCase
format = Format(Format=panel_32, Culture=127, Data0=case.LowerCase)
settextblock_7 = SetTextBlockContents(TextBlockToModify=tb_3, NewTextBlockContents=format)
document_units_3 = RemoteReceiver(document_units)
entwine_43 = Entwine(Branch00=label_14, Branch01=pulldown_6, Branch02=entwine_37, FlattenInputs=True)  # -> flatten(Result)
expression = Expression(x=document_units_3, y="Meters", Expression="x=y")
entwine_44 = Entwine(Branch00=preview, Branch01=stack_21, Branch02=entwine_34, FlattenInputs=True)  # -> flatten(Result)
hideshow_9 = HideShowElement(ElementToHideShow=border_4, Show=invert(expression), Collapse=True, Disable=False)

stack_28 = CreateStack(UIElements=entwine_43, Horizontal=invert(True))

# ----
# Assign type
assign_type = Data(stack_28)

# ----
# Preview
preview_2 = Data(entwine_44)

entwine_45 = Entwine(Branch00=assign_type, Branch01=location_8, FlattenInputs=True)  # -> flatten(Result)
stack_29 = CreateStack(UIElements=entwine_45, Horizontal=True)

# ----
# Analysis module
# Daylight simulation
# Glare probability
# LCA calculations
panel_39 = Panel("Simulations can take a few minutes...")
panel_40 = Panel("Spatial daylight autonomy: {0}%")
number_slider_15 = Slider(250, range=0..1000)
number_slider_16 = Slider(250, range=0..1000)
panel_41 = Panel("""Illuminance [Lux]
Daylight autonomy [%]
UDI [%]
UDI <50 [%]
UDI >3000 [%]
None""")
number_slider_17 = Slider(250, range=0..1000)
number_slider_18 = Slider(250, range=0..1000)
panel_42 = Panel("Daylight glare probability (DGP): {0}")
panel_43 = Panel("Operational GWP total: {0} kg CO2eq/year")
panel_44 = Panel("Total GWP: {0} kg CO2eq")
panel_45 = Panel("Create a model in the assembly module to get a LCA")
panel_46 = Panel("""Annual energy balance
Daily cooling profile
Daily heating profile
Cooling balance
Heating balance
None""")
lca_total_gwp_2 = RemoteReceiver(lca_total_gwp)
lca_total_gwp_3 = RemoteReceiver(lca_total_gwp)
panel_47 = Panel("""Annual energy balance
Daily cooling profile
Daily heating profile
Cooling balance
Heating balance
None""")
panel_48 = Panel("C:\Users\Isac\Desktop\Toivo_Chalmers\heath\Icons\butterfly_heath.png")
panel_49 = Panel("C:\Users\Isac\Desktop\Toivo_Chalmers\heath\Icons\butterfly_heath.png")
# Detailed energy simulation
number_slider_19 = Slider(2, range=0..10)
height = Slider(40, range=1..100)
width = Slider(5, range=1..100)
height_2 = Slider(40, range=1..100)
width_2 = Slider(5, range=1..100)
true_button_7 = CreateTrueOnlyButton(ButtonName="Visualize GWP by element", ButtonStyle=0)
tb_8 = CreateTextBlock(Text=panel_39, TextSize=16, Justification=0)
button_12 = CreateButton(ButtonName="Zoom", ButtonStyle=0)
expression_2 = Expression(x=lca_total_gwp_3, Expression="Round(x, 2)")
expression_3 = Expression(x=lca_total_gwp_2, Expression="Round(x, 2)")
button_13 = CreateButton(ButtonName="Run daylight simulation", ButtonStyle=0)
tb_9 = CreateTextBlock(Text="Simulations can take a few minutes...", TextSize=16, Justification=0)
button_14 = CreateButton(ButtonName="Zoom", ButtonStyle=0)
true_button_8 = CreateTrueOnlyButton(ButtonName="Pop-up window", ButtonStyle=0)
tb_10 = CreateTextBlock(Text="Simulations can take a few minutes...", TextSize=16, Justification=0)
button_15 = CreateButton(ButtonName="Run simple energy simulation", ButtonStyle=0)
button_16 = CreateButton(ButtonName="Calculate Glare probability", ButtonStyle=0)
tb_11 = CreateTextBlock(Text="Simulations can take a few minutes...", TextSize=16, Justification=0)
true_button_9 = CreateTrueOnlyButton(ButtonName="Pop-up window", ButtonStyle=0)
button_17 = CreateButton(ButtonName="Zoom", ButtonStyle=0)
button_18 = CreateButton(ButtonName="Run detailed energy simulation", ButtonStyle=0)
image = CreateImage(ImageSource=panel_48, ImageWidth=300)
pulldown_11 = CreatePulldownMenu(Label="Display", ListItems=panel_46, showLabel=True)
image_2 = CreateImage(ImageSource=panel_49, ImageWidth=300)
values_54 = ValueListener(Elements=true_button_7, SomeProperty=True)  # -> Values, Indices
label_21 = CreateLabel(LabelText="Display settings", LabelSize=12, Justification=0)
values_55 = ValueListener(Elements=button_12, SomeProperty=True)  # -> Values, Indices
slider_11 = CreateSlider(
    Slider=width,
    SnapValue=number_slider_19,
    ShowBounds=False,
    ShowTicks=True,
    ShowTooltip=False,
    ShowValLabel=False,
    showLabel=True)
slider_12 = CreateSlider(
    Slider=height,
    SnapValue=Slider(2, range=0..10),
    ShowBounds=False,
    ShowTicks=True,
    ShowTooltip=False,
    ShowValLabel=False,
    showLabel=True)
pulldown_12 = CreatePulldownMenu(Label="Display", ListItems=panel_47, showLabel=True)
label_22 = CreateLabel(LabelText="LCA", LabelSize=18, Justification=0)
pulldown_13 = CreatePulldownMenu(Label="Display", ListItems=panel_41, SelectedIndex="5", showLabel=True)
label_23 = CreateLabel(LabelText="Display settings", LabelSize=12, Justification=0)
slider_13 = CreateSlider(
    Slider=width_2,
    SnapValue=Slider(2, range=0..10),
    ShowBounds=False,
    ShowTicks=True,
    ShowTooltip=False,
    ShowValLabel=False,
    showLabel=True)
slider_14 = CreateSlider(
    Slider=height_2,
    SnapValue=Slider(2, range=0..10),
    ShowBounds=False,
    ShowTicks=True,
    ShowTooltip=False,
    ShowValLabel=False,
    showLabel=True)
label_24 = CreateLabel(LabelText=panel_40, LabelSize=12, Justification=0)
values_56 = ValueListener(Elements=button_13, SomeProperty=True)  # -> Values, Indices
values_57 = ValueListener(Elements=button_14, SomeProperty=True)  # -> Values, Indices
values_58 = ValueListener(Elements=true_button_8, SomeProperty=True)  # -> Values, Indices
label_25 = CreateLabel(LabelText=panel_45, LabelSize=12, Justification=0)
label_26 = CreateLabel(LabelText=panel_44, LabelSize=12, Justification=0)
label_27 = CreateLabel(LabelText=panel_43, LabelSize=12, Justification=0)
label_28 = CreateLabel(LabelText=panel_42, LabelSize=12, Justification=0)
values_59 = ValueListener(Elements=button_15, SomeProperty=True)  # -> Values, Indices
values_60 = ValueListener(Elements=button_17, SomeProperty=True)  # -> Values, Indices
values_61 = ValueListener(Elements=true_button_9, SomeProperty=True)  # -> Values, Indices
values_62 = ValueListener(Elements=button_16, SomeProperty=True)  # -> Values, Indices
values_63 = ValueListener(Elements=button_18, SomeProperty=True)  # -> Values, Indices
visualize_lca_gwp_by_element = RemoteSender(values_54.Values)
values_64 = ValueListener(Elements=pulldown_11, SomeProperty=True)  # -> Values, Indices
zoom_daylight_simulation = RemoteSender(values_55.Values)
zoom_simple_energy_simulation = RemoteSender(values_57.Values)
visualize_simple_energy_simulations = RemoteSender(values_58.Values)
freeze_gate_8 = StreamFreezeGate(Data=values_56.Values, PassingSwitch=invert(values_56.Values))
values_65 = ValueListener(Elements=pulldown_12, SomeProperty=True)  # -> Values, Indices
format_2 = Format(Format=panel_45, Culture=127, Data0=expression_2)
format_3 = Format(Format=panel_44, Culture=127, Data0=expression_3)
values_66 = ValueListener(Elements=pulldown_13, SomeProperty=True)  # -> Values, Indices
values_67 = ValueListener(Elements=slider_11, SomeProperty=True)  # -> Values, Indices
values_68 = ValueListener(Elements=slider_12, SomeProperty=True)  # -> Values, Indices
freeze_gate_9 = StreamFreezeGate(Data=values_59.Values, PassingSwitch=invert(values_59.Values))
entwine_46 = Entwine(Branch00=slider_12, Branch01=slider_11, FlattenInputs=True)  # -> flatten(Result)
zoom_detailed_energy_simulation = RemoteSender(values_60.Values)
visualize_detailed_energy_simulations = RemoteSender(values_61.Values)
values_69 = ValueListener(Elements=slider_13, SomeProperty=True)  # -> Values, Indices
values_70 = ValueListener(Elements=slider_14, SomeProperty=True)  # -> Values, Indices
pre_calculate_glare_probability = RemoteSender(values_62.Values)
pre_calculate_glare_probability_2 = RemoteReceiver(pre_calculate_glare_probability)
freeze_gate_10 = StreamFreezeGate(Data=pre_calculate_glare_probability_2, PassingSwitch=pre_calculate_glare_probability_2)
hasdata = DataExists(Data=freeze_gate_10)
filter_2 = StreamFilter(Gate=hasdata, Stream0="0", Stream1=freeze_gate_10)
entwine_47 = Entwine(Branch00=slider_14, Branch01=slider_13, FlattenInputs=True)  # -> flatten(Result)
pre_run_daylight_simulations = RemoteSender(values_56.Values)
pre_run_daylight_simulations_2 = RemoteReceiver(pre_run_daylight_simulations)
freeze_gate_11 = StreamFreezeGate(Data=pre_run_daylight_simulations_2, PassingSwitch=pre_run_daylight_simulations_2)
hasdata_2 = DataExists(Data=freeze_gate_11)
filter_3 = StreamFilter(Gate=hasdata_2, Stream0="0", Stream1=freeze_gate_11)
freeze_gate_12 = StreamFreezeGate(Data=values_62.Values, PassingSwitch=invert(values_62.Values))
pre_run_simple_energy_simulations = RemoteSender(values_59.Values)
pre_run_simple_energy_simulations_2 = RemoteReceiver(pre_run_simple_energy_simulations)
freeze_gate_13 = StreamFreezeGate(Data=pre_run_simple_energy_simulations_2, PassingSwitch=pre_run_simple_energy_simulations_2)
hasdata_3 = DataExists(Data=freeze_gate_13)
filter_4 = StreamFilter(Gate=hasdata_3, Stream0="0", Stream1=freeze_gate_13)
freeze_gate_14 = StreamFreezeGate(Data=values_63.Values, PassingSwitch=invert(values_63.Values))
pre_run_detailed_energy_simulations = RemoteSender(values_63.Values)
pre_run_detailed_energy_simulations_2 = RemoteReceiver(pre_run_detailed_energy_simulations)
freeze_gate_15 = StreamFreezeGate(Data=pre_run_detailed_energy_simulations_2, PassingSwitch=pre_run_detailed_energy_simulations_2)
hasdata_4 = DataExists(Data=freeze_gate_15)
filter_5 = StreamFilter(Gate=hasdata_4, Stream0="0", Stream1=freeze_gate_15)
simple_energy_simulation_type = RemoteSender(values_64.Indices)
setlabel = SetLabelContents(LabelToModify=label_25, NewLabelContents=format_2)
setlabel_2 = SetLabelContents(LabelToModify=label_26, NewLabelContents=format_3)
detailed_energy_simulation_type = RemoteSender(values_65.Indices)
simple_energy_simulation_height = RemoteSender(values_68.Values)
simple_energy_simulation_width = RemoteSender(values_67.Values)
bool_8 = Boolean(invert(freeze_gate_8))
daylight_simulation_type = RemoteSender(values_66.Indices)
detailed_energy_simulation_width = RemoteSender(values_69.Values)
detailed_energy_simulation_height = RemoteSender(values_70.Values)
bool_9 = Boolean(invert(freeze_gate_9))
bool_10 = Boolean(invert(freeze_gate_12))
stack_30 = CreateStack(UIElements=entwine_46, Horizontal=True)
bool_11 = Boolean(invert(freeze_gate_14))
stack_31 = CreateStack(UIElements=entwine_47, Horizontal=True)
entwine_48 = Entwine(Branch00=label_21, Branch01=stack_30, FlattenInputs=True)  # -> flatten(Result)
entwine_49 = Entwine(Branch00=label_23, Branch01=stack_31, FlattenInputs=True)  # -> flatten(Result)
entwine_50 = Entwine(Branch00=button_13, Branch01=button_12, FlattenInputs=True)  # -> flatten(Result)
entwine_51 = Entwine(Branch00=button_15, Branch01=button_14, Branch02=true_button_8, FlattenInputs=True)  # -> flatten(Result)
tap_7 = TapBuffer(Reset=False, Incremental=True, Valve=bool_8, Hold=True)
tap_8 = TapBuffer(Reset=False, Incremental=True, Valve=bool_9, Hold=True)
entwine_52 = Entwine(Branch00=button_18, Branch01=button_17, Branch02=true_button_9, FlattenInputs=True)  # -> flatten(Result)
tap_9 = TapBuffer(Reset=False, Incremental=True, Valve=bool_10, Hold=True)
tap_10 = TapBuffer(Reset=False, Incremental=True, Valve=bool_11, Hold=True)
dam_7 = DataDam(DataA=tap_7, BufferDelay=2500000, BufferMode=2)
stack_32 = CreateStack(UIElements=entwine_48, Horizontal=invert(True))
dam_8 = DataDam(DataA=tap_8, BufferDelay=2500000, BufferMode=2)
stack_33 = CreateStack(UIElements=entwine_49, Horizontal=invert(True))
dam_9 = DataDam(DataA=tap_9, BufferDelay=2500000, BufferMode=2)
dam_10 = DataDam(DataA=tap_10, BufferDelay=2500000, BufferMode=2)
equals_7 = Equality(FirstNumber=tap_7, SecondNumber=dam_7)  # -> Equality, Inequality
equals_8 = Equality(FirstNumber=tap_8, SecondNumber=dam_8)  # -> Equality, Inequality
entwine_53 = Entwine(Branch00=pulldown_11, Branch01=stack_32, FlattenInputs=True)  # -> flatten(Result)
equals_9 = Equality(FirstNumber=tap_9, SecondNumber=dam_9)  # -> Equality, Inequality
equals_10 = Equality(FirstNumber=tap_10, SecondNumber=dam_10)  # -> Equality, Inequality
entwine_54 = Entwine(Branch00=pulldown_12, Branch01=stack_33, FlattenInputs=True)  # -> flatten(Result)
stack_34 = CreateStack(UIElements=entwine_50, Horizontal=True)
adjustpos_35 = AdjustElementPositioning(
    ElementsToAdjust=button_12,
    Margin="15, 0, 0, 0",
    AbsolutePositioning=False,
    Width=Slider(60, range=0..1000),
    Height=Slider(30, range=0..1000),
    HorizontalAlignment=0)
stack_35 = CreateStack(UIElements=entwine_51, Horizontal=True)
stack_36 = CreateStack(UIElements=entwine_53, Horizontal=True)
stack_37 = CreateStack(UIElements=entwine_54, Horizontal=True)
entwine_55 = Entwine(Branch00=image_2, Branch01=image, FlattenInputs=True)  # -> flatten(Result)
adjustpos_36 = AdjustElementPositioning(
    ElementsToAdjust=pulldown_11,
    AbsolutePositioning=False,
    Width=Slider(215, range=0..1000),
    Height=Slider(40, range=0..1000),
    HorizontalAlignment=0)
adjustpos_37 = AdjustElementPositioning(
    ElementsToAdjust=pulldown_12,
    AbsolutePositioning=False,
    Width=Slider(215, range=0..1000),
    Height=Slider(40, range=0..1000),
    HorizontalAlignment=0)
adjustpos_38 = AdjustElementPositioning(
    ElementsToAdjust=pulldown_13,
    AbsolutePositioning=False,
    Width=Slider(235, range=0..1000),
    Height=Slider(40, range=0..1000),
    HorizontalAlignment=0)
adjustpos_39 = AdjustElementPositioning(ElementsToAdjust=button_16, AbsolutePositioning=False, HorizontalAlignment=0)
adjustpos_40 = AdjustElementPositioning(
    ElementsToAdjust=button_14,
    Margin="15, 0, 0, 0",
    AbsolutePositioning=False,
    Width=Slider(60, range=0..1000),
    Height=Slider(30, range=0..1000),
    HorizontalAlignment=0)
adjustpos_41 = AdjustElementPositioning(
    ElementsToAdjust=true_button_8,
    Margin="15, 0, 0, 0",
    AbsolutePositioning=False,
    Width=Slider(110, range=0..1000),
    Height=Slider(30, range=0..1000),
    HorizontalAlignment=0)
adjustpos_42 = AdjustElementPositioning(
    ElementsToAdjust=true_button_9,
    Margin="15, 0, 0, 0",
    AbsolutePositioning=False,
    Width=Slider(110, range=0..1000),
    Height=Slider(30, range=0..1000),
    HorizontalAlignment=0)
stack_38 = CreateStack(UIElements=entwine_52, Horizontal=True)
adjustpos_43 = AdjustElementPositioning(
    ElementsToAdjust=button_17,
    Margin="15, 0, 0, 0",
    AbsolutePositioning=False,
    Width=Slider(60, range=0..1000),
    Height=Slider(30, range=0..1000),
    HorizontalAlignment=0)
expander = CreateExpander(UIElements=entwine_55, Header="Images", Open=True)
adjustpos_44 = AdjustElementPositioning(ElementsToAdjust=true_button_7, AbsolutePositioning=False, HorizontalAlignment=0)

# ----
# Calculate LCA
entwine_56 = Entwine(Branch00=label_22, Branch01=label_25, Branch02=label_26, Branch03=label_27, Branch04=true_button_7, FlattenInputs=True)  # -> flatten(Result)
stack_39 = CreateStack(UIElements=entwine_56, Horizontal=invert(True))
number_slider_20 = Slider(650, range=0..1000)
border_5 = CreateBorder(
    UIElement=stack_39,
    BorderThickness=Slider(1, range=0..10),
    BorderColor=ColourSwatch(SwatchColor=RGB(217, 217, 217)),
    CornerRadius=Slider(2, range=0..10))
adjustpos_45 = AdjustElementPositioning(ElementsToAdjust=border_5, Margin="0, 10, 0, 0", AbsolutePositioning=False, HorizontalAlignment=0)
location_15 = Data(border_5)

# ----
# Run simple energy simulations
entwine_57 = Entwine(Branch00=stack_35, Branch01=tb_9, Branch02=stack_36, FlattenInputs=True)  # -> flatten(Result)
stack_40 = CreateStack(UIElements=entwine_57, Horizontal=invert(True))
number_slider_21 = Slider(650, range=0..1000)
border_6 = CreateBorder(
    UIElement=stack_40,
    BorderThickness=Slider(1, range=0..10),
    BorderColor=ColourSwatch(SwatchColor=RGB(217, 217, 217)),
    CornerRadius=Slider(2, range=0..10))
adjustpos_46 = AdjustElementPositioning(ElementsToAdjust=border_6, Margin="0, 0, 0, 0", AbsolutePositioning=False, HorizontalAlignment=0)
location_16 = Data(border_6)

# ----
# Run daylight simulations
entwine_58 = Entwine(Branch00=stack_34, Branch01=tb_8, Branch02=label_24, Branch03=pulldown_13, FlattenInputs=True)  # -> flatten(Result)
stack_41 = CreateStack(UIElements=entwine_58, Horizontal=invert(True))
number_slider_22 = Slider(650, range=0..1000)
border_7 = CreateBorder(
    UIElement=stack_41,
    BorderThickness=Slider(1, range=0..10),
    BorderColor=ColourSwatch(SwatchColor=RGB(217, 217, 217)),
    CornerRadius=Slider(2, range=0..10))
adjustpos_47 = AdjustElementPositioning(ElementsToAdjust=border_7, Margin="0, 10, 0, 0", AbsolutePositioning=False, HorizontalAlignment=0)
location_17 = Data(border_7)

# ----
# Run detailed energy simulations
entwine_59 = Entwine(Branch00=stack_38, Branch01=tb_10, Branch02=stack_37, FlattenInputs=True)  # -> flatten(Result)
stack_42 = CreateStack(UIElements=entwine_59, Horizontal=invert(True))
number_slider_23 = Slider(650, range=0..1000)
border_8 = CreateBorder(
    UIElement=stack_42,
    BorderThickness=Slider(1, range=0..10),
    BorderColor=ColourSwatch(SwatchColor=RGB(217, 217, 217)),
    CornerRadius=Slider(2, range=0..10))
adjustpos_48 = AdjustElementPositioning(ElementsToAdjust=border_8, Margin="0, 10, 0, 0", AbsolutePositioning=False, HorizontalAlignment=0)
location_18 = Data(border_8)

# ----
# Calculare glare probability
entwine_60 = Entwine(Branch00=button_16, Branch01=label_28, Branch02=expander, Branch03=tb_11, FlattenInputs=True)  # -> flatten(Result)
stack_43 = CreateStack(UIElements=entwine_60, Horizontal=invert(True))
number_slider_24 = Slider(650, range=0..1000)
border_9 = CreateBorder(
    UIElement=stack_43,
    BorderThickness=Slider(1, range=0..10),
    BorderColor=ColourSwatch(SwatchColor=RGB(217, 217, 217)),
    CornerRadius=Slider(2, range=0..10))
adjustpos_49 = AdjustElementPositioning(ElementsToAdjust=border_9, Margin="0, 10, 0, 0", AbsolutePositioning=False, HorizontalAlignment=0)
location_19 = Data(border_9)

daylight_simulation_type_2 = RemoteReceiver(daylight_simulation_type)
equals_11 = Equality(FirstNumber="5", SecondNumber=daylight_simulation_type_2)  # -> Equality, Inequality
data_4 = Data(location_15)
data_5 = Data(location_19)
data_6 = Data(location_16)
data_7 = Data(location_17)
simple_energy_simulation_height_2 = RemoteReceiver(simple_energy_simulation_height)
simple_energy_simulation_width_2 = RemoteReceiver(simple_energy_simulation_width)
simple_energy_simulation_height_3 = RemoteReceiver(simple_energy_simulation_height)
simple_energy_simulation_width_3 = RemoteReceiver(simple_energy_simulation_width)
simple_energy_simulation_height_4 = RemoteReceiver(simple_energy_simulation_height)
simple_energy_simulation_height_5 = RemoteReceiver(simple_energy_simulation_height)
simple_energy_simulation_width_4 = RemoteReceiver(simple_energy_simulation_width)
simple_energy_simulation_width_5 = RemoteReceiver(simple_energy_simulation_width)
simple_energy_simulation_height_6 = RemoteReceiver(simple_energy_simulation_height)
simple_energy_simulation_width_6 = RemoteReceiver(simple_energy_simulation_width)

# ----
# Construction module
number_slider_25 = Slider(5, range=0..7)
panel_50 = Panel("""Very Hot
Hot
Warm
Mixed
Cool
Cold
Very Cold
Subarctic""")
panel_51 = Panel("""SteelFramed
WoodFramed
Mass
Metal Building""")
pulldown_14 = CreatePulldownMenu(Label="By climate", ListItems=panel_50, SelectedIndex=number_slider_25, showLabel=True)
label_29 = CreateLabel(LabelText="Select base construction", LabelSize=18, Justification=0)
pulldown_15 = CreatePulldownMenu(Label="By type", ListItems=panel_51, SelectedIndex=Slider(1, range=0..3), showLabel=True)
pulldown_16 = CreatePulldownMenu(Label="Skylights", ListItems=empty_2, showLabel=True)
pulldown_17 = CreatePulldownMenu(Label="Windows", ListItems=empty, showLabel=True)
pulldown_18 = CreatePulldownMenu(Label="Exterior walls", ListItems=empty_4, showLabel=True)
pulldown_19 = CreatePulldownMenu(Label="Ground", ListItems=empty_3, showLabel=True)
pulldown_20 = CreatePulldownMenu(Label="Interior floors", ListItems=empty_7, showLabel=True)
pulldown_21 = CreatePulldownMenu(Label="Exterior floor", ListItems=empty_6, showLabel=True)
pulldown_22 = CreatePulldownMenu(Label="Exterior roof", ListItems=empty_5, showLabel=True)
pulldown_23 = CreatePulldownMenu(Label="Interior walls", ListItems=empty_8, showLabel=True)
values_71 = ValueListener(Elements=pulldown_15, SomeProperty=True)  # -> Values, Indices
values_72 = ValueListener(Elements=pulldown_16, SomeProperty=True)  # -> Values, Indices
values_73 = ValueListener(Elements=pulldown_17, SomeProperty=True)  # -> Values, Indices
values_74 = ValueListener(Elements=pulldown_23, SomeProperty=True)  # -> Values, Indices
values_75 = ValueListener(Elements=pulldown_20, SomeProperty=True)  # -> Values, Indices
values_76 = ValueListener(Elements=pulldown_21, SomeProperty=True)  # -> Values, Indices
values_77 = ValueListener(Elements=pulldown_19, SomeProperty=True)  # -> Values, Indices
values_78 = ValueListener(Elements=pulldown_14, SomeProperty=True)  # -> Values, Indices
values_79 = ValueListener(Elements=pulldown_22, SomeProperty=True)  # -> Values, Indices
values_80 = ValueListener(Elements=pulldown_18, SomeProperty=True)  # -> Values, Indices
base_type = RemoteSender(values_71.Values)
subset_subface_skylight = RemoteSender(values_72.Indices)
subset_interior_wall = RemoteSender(values_74.Indices)
subset_subface_window = RemoteSender(values_73.Indices)
subset_interior_floor = RemoteSender(values_75.Indices)
subset_exterior_floor = RemoteSender(values_76.Indices)
subset_ground_floor = RemoteSender(values_77.Indices)
addition_2 = Addition(A=values_78.Indices, B="1")
subset_exterior_roof = RemoteSender(values_79.Indices)
subset_exterior_wall = RemoteSender(values_80.Indices)
entwine_61 = Entwine(Branch00=pulldown_14, Branch01=pulldown_15, FlattenInputs=True)  # -> flatten(Result)
base_climate = RemoteSender(addition_2)
stack_44 = CreateStack(UIElements=entwine_61, Horizontal=True)
entwine_62 = Entwine(Branch00=label_29, Branch01=stack_44, FlattenInputs=True)  # -> flatten(Result)
adjustpos_50 = AdjustElementPositioning(ElementsToAdjust=pulldown_14, AbsolutePositioning=False, Width=Slider(160, range=0..300), HorizontalAlignment=0)
tooltip_7 = AttachTooltipToElement(ElementsToAttachTo=pulldown_14, TooltipContent="Select climate", ShowDelay=500, Duration=2000)
tooltip_8 = AttachTooltipToElement(ElementsToAttachTo=pulldown_15, TooltipContent="Select type of construction", ShowDelay=500, Duration=2000)
adjustpos_51 = AdjustElementPositioning(ElementsToAdjust=pulldown_15, AbsolutePositioning=False, Width=Slider(170, range=0..300), HorizontalAlignment=0)
adjustpos_52 = AdjustElementPositioning(
    ElementsToAdjust=[pulldown_20, pulldown_19, pulldown_21, pulldown_22, pulldown_23, pulldown_18],
    AbsolutePositioning=False,
    Width=Slider(300, range=0..300),
    HorizontalAlignment=0)

stack_45 = CreateStack(UIElements=entwine_62, Horizontal=invert(True))
adjustpos_53 = AdjustElementPositioning(
    ElementsToAdjust=[pulldown_17, pulldown_16],
    AbsolutePositioning=False,
    Width=Slider(300, range=0..300),
    HorizontalAlignment=0)

# ----
# Select subset construction
data_8 = Data(pulldown_16)
data_9 = Data(pulldown_18)
data_10 = Data(pulldown_23)
data_11 = Data(pulldown_17)
data_12 = Data(pulldown_20)
data_13 = Data(pulldown_21)
data_14 = Data(pulldown_22)
data_15 = Data(pulldown_19)
entwine_63 = Entwine(
    Branch00=data_11,
    Branch01=data_8,
    Branch02=data_9,
    Branch03=data_10,
    Branch04=data_14,
    Branch05=data_12,
    Branch06=data_13,
    Branch07=data_15,
    FlattenInputs=True)  # -> flatten(Result)
expander_2 = CreateExpander(UIElements=entwine_63, Header="Select subset construction", Open="False")
location_20 = Data(expander_2)

# ----
# Construction by climate and type
number_slider_26 = Slider(2, range=0..10)
border_10 = CreateBorder(
    UIElement=stack_45,
    BorderThickness=Slider(1, range=0..10),
    BorderColor=ColourSwatch(SwatchColor=RGB(217, 217, 217)),
    CornerRadius=number_slider_26)
location_21 = Data(border_10)

entwine_64 = Entwine(Branch00=location_21, Branch01=entwine_8, FlattenInputs=True)  # -> flatten(Result)

# ---- group: Building occupancy and systems / Select construction set
bldgvintages_2 = HBBuildingVintages({"ASHRAE 90.1 2019  |  IECC 2021": "2019", "ASHRAE 90.1 2016  |  IECC 2018": "2016", "ASHRAE 90.1 2013  |  IECC 2015": "2013", "ASHRAE 90.1 2010  |  IECC 2012": "2010", "ASHRAE 90.1 2007  |  IECC 2009": "2007", "ASHRAE 90.1 2004  |  IECC 2006": "2004", "1980-2004 (CBECS)": "1980_2004", "Pre-1980 (CBECS)": "pre_1980"}, selected="ASHRAE 90.1 2019  |  IECC 2021")
base_climate_2 = RemoteReceiver(base_climate)
base_type_2 = RemoteReceiver(base_type)
constrsetclimate_2 = HBConstructionSetByClimate(climate_zone=base_climate_2, vintage=bldgvintages_2, constr_type=base_type_2)  # -> constr_set; plug-in component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
panel_52 = Panel(constrsetclimate_2)

# ----
entwine_65 = Entwine(Branch00=stack_11, Branch01=stack_10, FlattenInputs=True)  # -> flatten(Result)

# ----
# Wall and roof thickness
location_22 = Data(entwine_65)

entwine_66 = Entwine(Branch00=model_name_2, Branch01=location_22, FlattenInputs=True)  # -> flatten(Result)
stack_46 = CreateStack(UIElements=entwine_66, Horizontal=invert(True))
entwine_67 = Entwine(Branch00=stack_46, Branch01=location_4, FlattenInputs=True)  # -> flatten(Result)
stack_47 = CreateStack(UIElements=entwine_67, Horizontal=True)
entwine_68 = Entwine(Branch00=stack_47, Branch01=location_2, Branch02=location, Branch03=create_model, FlattenInputs=True)  # -> flatten(Result)
stack_48 = CreateStack(UIElements=entwine_68, Horizontal=invert(True))

# ----
# Geometry module interface
document_units_4 = RemoteReceiver(document_units)
document_units_5 = RemoteReceiver(document_units)
document_units_6 = RemoteReceiver(document_units)
document_units_7 = RemoteReceiver(document_units)
previewtype_2 = RemoteReceiver(previewtype)
previewtype_3 = RemoteReceiver(previewtype)
previewtype_4 = RemoteReceiver(previewtype)
previewtype_5 = RemoteReceiver(previewtype)
constructiontype = RemoteReceiver()
geometrytype_2 = RemoteReceiver(geometrytype)
saveconstruction = RemoteReceiver()
expression_4 = Expression(x=document_units_4, y="Meters", Expression="x=y")
expression_5 = Expression(x=previewtype_3, y="All", Expression="x=y")
expression_6 = Expression(x="Room", y=previewtype_3, Expression="x=y")
expression_7 = Expression(x=document_units_5, y="Meters", Expression="x=y")
expression_8 = Expression(x=previewtype_2, y="All", Expression="x=y")
expression_9 = Expression(x="Context", y=previewtype_2, Expression="x=y")
expression_10 = Expression(x=document_units_6, y="Meters", Expression="x=y")
expression_11 = Expression(x=document_units_7, y="Meters", Expression="x=y")
expression_12 = Expression(x="Window", y=previewtype_5, Expression="x=y")
expression_13 = Expression(x=previewtype_5, y="All", Expression="x=y")
expression_14 = Expression(x="Adjacent", y=previewtype_4, Expression="x=y")
expression_15 = Expression(x=previewtype_4, y="All", Expression="x=y")
ef_att_2 = EleFrontAttributes(Keys="Heath geometry type", Values=geometrytype_2)
ef_att_3 = EleFrontAttributes(Keys="Construction", Values=constructiontype)
or = GateOr(A=expression_9, B=expression_8)
or_2 = GateOr(A=expression_6, B=expression_5)
or_3 = GateOr(A=expression_12, B=expression_13)
or_4 = GateOr(A=expression_14, B=expression_15)
gate_3 = StreamGate(Stream="Context", Gate=or)  # -> Target0, Target1
gate_4 = StreamGate(Stream="Adjacent", Gate=or_4)  # -> Target0, Target1
gate_5 = StreamGate(Stream="Room", Gate=or_2)  # -> Target0, Target1
gate_6 = StreamGate(Stream="Window", Gate=or_3)  # -> Target0, Target1
geometrytype_validate_2 = RemoteReceiver(geometrytype_validate)

# ----
# Duplicate construction warning
panel_53 = Panel("""Duplicate constructions have
been loaded.
The one previously
created have been selected.""")
tb_12 = CreateTextBlock(Text=panel_53, TextSize=12, Justification=0)
accent_colors_2 = ValueList({"Amber", "Blue", "Brown", "Cobalt", "Crimson", "Cyan", "Emerald", "Green", "Indigo", "Lime", "Magenta", "Mauve", "Olive", "Orange", "Pink", "Purple", "Red", "Sienna", "Steel", "Taupe", "Teal", "Violet", "Yellow"}, selected="Blue")
pt_9 = ConstructPoint(XCoordinate=Slider(400, range=0..1000), YCoordinate=Slider(250, range=0..1000), ZCoordinate=0)
adjustelem_8 = AdjustElementAppearance(ElementsToAdjust=tb_12, Foreground=ColourSwatch(SwatchColor=RGB(0, 0, 0)))

# ----
# Simple energy simulations visualizations
number_slider_27 = Slider(19, range=0..100)
colrange = LBColorRange(index=number_slider_27)  # -> colors; plug-in component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
split = SplitList(List=colrange, Index=Slider(7, range=0..10))  # -> ListA, ListB
entwine_69 = Entwine(Branch00=split.ListA, Branch01=ColourSwatch(SwatchColor=RGB(13, 207, 255)), Branch02=split.ListB, FlattenInputs=True)  # -> flatten(Result)

# ----
# LCA pop-up window
number_slider_28 = Slider(19, range=0..100)
lca_gwp_by_element_type_2 = RemoteReceiver(lca_gwp_by_element_type)
colrange_2 = LBColorRange(index=number_slider_28)  # -> colors; plug-in component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
txt = Text(colrange_2)
num_2 = Number(lca_gwp_by_element_type_2)
pt_10 = Point(txt)
expression_16 = Expression(x=num_2, Expression="Round(x, 2)")
lca_element_types_2 = RemoteReceiver(lca_element_types)
division_2 = Division(A=pt_10, B="255")
len = TextLength(Text=division_2)
subtraction_2 = Subtraction(A=len, B=Slider(2, range=0..10))
fragment = TextFragment(Text=division_2, Start="1", Count=subtraction_2)
visualize_lca_gwp_by_element_2 = RemoteReceiver(visualize_lca_gwp_by_element)
panel_54 = Panel("C:\Users\Isac\Desktop\Toivo_Chalmers\heath\Icons\butterfly_heath.png")
launchwin_2 = LaunchWindow(
    Show=visualize_lca_gwp_by_element_2,
    Name="LCA visualisations",
    Width=Slider(1150, range=0..1200),
    Height=Slider(575, range=0..1000),
    ChildStatus=2,
    EnableHorizScroll=False)
image_3 = CreateImage(ImageSource=panel_54, ImageWidth=Slider(1100, range=0..1200), ImageHeight=Slider(500, range=0..1000))
accent_colors_3 = ValueList({"Amber", "Blue", "Brown", "Cobalt", "Crimson", "Cyan", "Emerald", "Green", "Indigo", "Lime", "Magenta", "Mauve", "Olive", "Orange", "Pink", "Purple", "Red", "Sienna", "Steel", "Taupe", "Teal", "Violet", "Yellow"}, selected="Blue")
pt_11 = ConstructPoint(XCoordinate=Slider(183, range=0..1000), YCoordinate=Slider(137, range=0..1000), ZCoordinate=0)
addelems_3 = AddElements(Window=launchwin_2, Elements=flatten(image_3), DoVLChecking=True)  # -> AddedElements, ElementNames
winprops_2 = SetWindowProperties(
    Window=launchwin_2,
    StartingLocation=pt_11,
    Theme=0,
    AccentColor=accent_colors_3,
    ShowTitleBar=True,
    BackgroundColor=RGB(255, 255, 255),
    ScaleFactor=1)

# ----
# Zoom detailed energy simulation
zoom_detailed_energy_simulation_2 = RemoteReceiver(zoom_detailed_energy_simulation)
panel_55 = Panel("Top")

# ----
# Zoom daylight simulation
zoom_daylight_simulation_2 = RemoteReceiver(zoom_daylight_simulation)
panel_56 = Panel(zoom_daylight_simulation_2)

# ----
# Zoom simple energy
zoom_simple_energy_simulation_2 = RemoteReceiver(zoom_simple_energy_simulation)
panel_57 = Panel(zoom_simple_energy_simulation_2)

# ----
# Simple energy simulations pop-up window
panel_58 = Panel("C:/Users/Isac/Desktop/Toivo_Chalmers/UI/matplotlib")
panel_59 = Panel("total load EUI: {0} (kWh/m2)")
visualize_simple_energy_simulations_2 = RemoteReceiver(visualize_simple_energy_simulations)
format_4 = Format(Format=panel_59, Culture=127, Data0=Slider(0, range=0..100))
nextfile = NextAvailableFilename(Format="test_{000}.png", FolderPath=panel_58, Trigger=Toggle(True))
launchwin_3 = LaunchWindow(
    Show=visualize_simple_energy_simulations_2,
    Name="Simple energy simulations",
    Width=Slider(700, range=0..1000),
    Height=Slider(500, range=0..1000),
    ChildStatus=2,
    EnableHorizScroll=False)
py3_3 = Python3Script(x=nextfile)  # -> out, a
# ---------- py3_3: Python ----------
# requirements: matplotlib

import matplotlib.pyplot as plt
import random as rd

fig, ax = plt.subplots()

counts = [rd.randint(0, 100), rd.randint(0, 100),
          rd.randint(0, 100), rd.randint(0, 100)]
fruits = ['apple', 'blueberry', 'cherry', 'orange']
bar_labels = ['red', 'blue', '_red', 'orange']
bar_colors = ['tab:red', 'tab:blue', 'tab:red', 'tab:orange']

ax.bar(fruits, counts, label=bar_labels, color=bar_colors)

ax.set_ylabel('fruit supply')
ax.set_title('Fruit supply by kind and color')
ax.legend(title='Fruit color')

plt.savefig(x)
a = x

#plt.show()
# ---------- end py3_3 ----------
tb_13 = CreateTextBlock(Text=format_4, TextSize=16, Justification=0)
image_4 = CreateImage(ImageSource=py3_3.a, ImageWidth=Slider(700, range=0..1000), ImageHeight=Slider(350, range=0..1000))
accent_colors_4 = ValueList({"Amber", "Blue", "Brown", "Cobalt", "Crimson", "Cyan", "Emerald", "Green", "Indigo", "Lime", "Magenta", "Mauve", "Olive", "Orange", "Pink", "Purple", "Red", "Sienna", "Steel", "Taupe", "Teal", "Violet", "Yellow"}, selected="Blue")
pt_12 = ConstructPoint(XCoordinate=Slider(24, range=0..1000), YCoordinate=Slider(258, range=0..1000), ZCoordinate=0)
entwine_70 = Entwine(Branch00=tb_13, Branch01=image_4, FlattenInputs=True)  # -> flatten(Result)
addelems_4 = AddElements(Window=launchwin_3, Elements=flatten(entwine_70), DoVLChecking=True)  # -> AddedElements, ElementNames
winprops_3 = SetWindowProperties(
    Window=launchwin_3,
    StartingLocation=pt_12,
    Theme=0,
    AccentColor=accent_colors_4,
    ShowTitleBar=True,
    BackgroundColor=RGB(255, 255, 255),
    ScaleFactor=1)

# ---- group: Building occupancy and systems
# Select window construction
subset_subface_skylight_2 = RemoteReceiver(subset_subface_skylight)
subset_subface_window_2 = RemoteReceiver(subset_subface_window)
subset_subface_window_3 = RemoteReceiver(subset_subface_window)
entwine_71 = Entwine(Branch00="Generic", Branch01=subset_subface_skylight_2, FlattenInputs=True)  # -> flatten(Result)
item_5 = ListItem(List=entwine_71, Index=subset_subface_window_2, Wrap=True)
expression_17 = Expression(x="Generic", y=item_5, Expression="x=y")
null_2 = NullObject()
null_3 = NullObject()
filter_6 = StreamFilter(Gate=expression_17, Stream0=item_5, Stream1=null_2)
windowconstr = HBWindowConstruction(materials=filter_6)  # -> constr; plug-in component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
cluster_3 = Cluster_2(window_construction=windowconstr, gwp_a1_a3="2.5", gwp_a4="0.042", density_kg_m2="38.2")

# ----
# Select exterior construction
subset_exterior_floor_2 = RemoteReceiver(subset_exterior_floor)
subset_exterior_roof_2 = RemoteReceiver(subset_exterior_roof)
subset_exterior_wall_2 = RemoteReceiver(subset_exterior_wall)
null_4 = NullObject()
null_5 = NullObject()
null_6 = NullObject()

# ----
# Select interior construction
subset_interior_floor_2 = RemoteReceiver(subset_interior_floor)
subset_interior_wall_2 = RemoteReceiver(subset_interior_wall)
null_7 = NullObject()
null_8 = NullObject()

# ----
# Select ground construction
subset_ground_floor_2 = RemoteReceiver(subset_ground_floor)
null_9 = NullObject()

# ----
# Heath help
panel_60 = Panel("""1. Select geometry in Rhino.

2. Select geometry type under the import geometry heading.

3. Click "Save geometry".

4. Verify the assigned geometry by pressing the "Preview" checkbox.""")
panel_61 = Panel("""1. Select the program for the building and room.

2. Use the sliders to set the cooling and heating setpoints.

3. Estimate how many persons will be in the room with the occupancy slider.""")
panel_62 = Panel("""1. Select base construction by climate and type of construction.

2. If required, create your own material or window. Materials can later be selected when creating custom constructions.

3. Constructions and windows make up the subset construction, which is used to modify the base construction.

4. Constructions can be loaded from a file, which contains all previously created constructions.""")
panel_63 = Panel("""1. Verify that the honeybee model is correct by selecting attributes and clicking the checkboxes in the "Attributes visualization" segment.

2. Click the "Run weather visualization" button. If the model is set up correctly the "Direct sun hours" and "Incident radiation" should be displayed on the model.""")
panel_64 = Panel("""1. Pick which simulation you want to run.

2. If the simulation failed a red text will show up, go back and review the honeybee model and settings.

3. Otherwise, navigate through the expanded segment to select appropriate displays of the results.

4. It is possible to transfer the results to Rhino by clicking "Bake", or to an image file by clicking "Pop-up window".""")
panel_65 = Panel("""1. Make sure the geometry have been imported and that the program and constructions are in place, before creating a honeybee model.

2. If the model has been created, the "Bake model" button will be enabled along with boxes that lets you visualize the model.

3. Set the wall thickness and roof thickness.

4. Switch the WWR (window-to-wall-ratio) on, if you want to generate windows automatically.""")
label_30 = CreateLabel(LabelText="Geometry module", LabelSize=18, Justification=0)
tb_14 = CreateTextBlock(Text="Geometry module", TextSize=12, Justification=0)
pt_13 = ConstructPoint(XCoordinate=Slider(325, range=0..1000), YCoordinate=Slider(165, range=0..1000), ZCoordinate=0)
entwine_72 = Entwine(Branch00=label_30, Branch01=tb_14, FlattenInputs=True)  # -> flatten(Result)

# ----
# Save/restore states
geometry_module_state_preview_type_2 = RemoteReceiver(geometry_module_state_preview_type)
save_location_2 = RemoteReceiver(save_location)

# ----
# Heath window
number_slider_29 = Slider(500, range=0..1000)
number_slider_30 = Slider(460, range=0..1000)
launch_heath_3 = RemoteReceiver(launch_heath)
data_16 = Data(location_18)
panel_66 = Panel("C:\Users\Isac\Desktop\Toivo_Chalmers\heath\Icons\butterfly_heath.png")
panel_67 = Panel("C:\Users\Isac\Desktop\Toivo_Chalmers\heath\Icons\butterfly_smol.png")
entwine_73 = Entwine(Branch00=stack_48, FlattenInputs=True)
entwine_74 = Entwine(Branch00=entwine_64, Branch01=location_20, FlattenInputs=True)
entwine_75 = Entwine(Branch00=stack_29, Branch01=preview_2, Branch02=location_3, Branch03=location_9, FlattenInputs=True)
entwine_76 = Entwine(
    Branch00=location_10,
    Branch01=location_11,
    Branch02=location_14,
    Branch03=location_13,
    Branch04=location_12,
    FlattenInputs=True)
entwine_77 = Entwine(Branch00=stack_20, FlattenInputs=True)
entwine_78 = Entwine(Branch00=data_6, Branch01=data_16, Branch02=data_7, Branch03=data_5, Branch04=data_4, FlattenInputs=True)
launchwin_4 = LaunchWindow(
    Show=launch_heath_3,
    Name="Heath",
    Width=number_slider_29,
    Height=number_slider_30,
    ChildStatus=1,
    EnableHorizScroll=False)
heath_window = RemoteSender(launchwin_4)
accent_colors_5 = ValueList({"Amber", "Blue", "Brown", "Cobalt", "Crimson", "Cyan", "Emerald", "Green", "Indigo", "Lime", "Magenta", "Mauve", "Olive", "Orange", "Pink", "Purple", "Red", "Sienna", "Steel", "Taupe", "Teal", "Violet", "Yellow"}, selected="Blue")
panel_68 = Panel("""Geometry module
Program module
Construction module
Assembly module
Visualize module
Analysis module""")
adjustpos_54 = AdjustElementPositioning(
    ElementsToAdjust=[entwine_75, entwine_76, entwine_74, entwine_73, entwine_77, entwine_78],
    Margin="0, 5, 0, 0",
    AbsolutePositioning=False,
    HorizontalAlignment=0,
    VerticalAlignment=2)
tabs = TabbedView(
    TabNames=panel_68,
    TabTextSize=Slider(12, range=0..100),
    Tab0=flatten(entwine_75),
    Tab1=flatten(entwine_76),
    Tab2=flatten(entwine_74),
    Tab3=flatten(entwine_73),
    Tab4=flatten(entwine_77),
    Tab5=flatten(entwine_78))
winprops_4 = SetWindowProperties(
    Window=launchwin_4,
    StartingLocation=heath_window_location_2,
    Theme=0,
    AccentColor=accent_colors_5,
    ShowTitleBar=True,
    BackgroundColor=RGB(255, 255, 255),
    ScaleFactor=1)
values_81 = ValueListener(Elements=tabs, SomeProperty=True)  # -> Values, Indices
current_tab = RemoteSender(values_81.Values)
current_tab_index = RemoteSender(values_81.Indices)
heath_flying_3 = RemoteReceiver(heath_flying)
py3_4 = Python3Script(get=heath_flying_3)  # -> mpl_folder; same code as py3_2
button_19 = CreateButton(ButtonName="Load state", ButtonStyle=0)
filepicker_2 = CreateFilePicker(ButtonLabelText="Pick state", DialogType=0, MustExist=True, Filter="Textdokument|*.txt", StartingPath=py3_4)
true_button_10 = CreateTrueOnlyButton(ButtonName="Help!", ButtonStyle=0)
values_82 = ValueListener(Elements=true_button_10, SomeProperty=True)  # -> Values, Indices
values_83 = ValueListener(Elements=filepicker_2, SomeProperty=True)  # -> Values, Indices
values_84 = ValueListener(Elements=button_19, SomeProperty=True)  # -> Values, Indices
help_button = RemoteSender(values_82.Values)
load_state_file = RemoteSender(values_83.Values)
load_state = RemoteSender(values_84.Values)
adjustpos_55 = AdjustElementPositioning(ElementsToAdjust=tabs, AbsolutePositioning=False, Width=Slider(365, range=100..1500))
bool_12 = Boolean(values_83.Values)
null_10 = NullItem(Item=bool_12)  # -> NullFlags, InvalidFlags, Description
hideshow_10 = HideShowElement(ElementToHideShow=button_19, Show=null_10.NullFlags, Collapse=True, Disable=False)
number_slider_31 = Slider(30, range=0..100)
number_slider_32 = Slider(50, range=0..100)
adjustpos_56 = AdjustElementPositioning(ElementsToAdjust=true_button_10, AbsolutePositioning=invert(False), HorizontalAlignment=1, VerticalAlignment=2)
adjustpos_57 = AdjustElementPositioning(
    ElementsToAdjust=filepicker_2,
    AbsolutePositioning=invert(False),
    Width=Slider(90, range=0..100),
    Height=Slider(32, range=0..100),
    HorizontalAlignment=1,
    VerticalAlignment=2)

current_tab_2 = RemoteReceiver(current_tab)
expression_18 = Expression(x="Geometry module", y=current_tab_2, Expression="x=y")
and = GateAnd(A=equals_6.Inequality, B=expression_18)
event = EventGate(Data=and)  # -> Data, IsNew
savegeometry = RemoteSender(event.Data)
savegeometry_2 = RemoteReceiver(savegeometry)
savegeometry_3 = RemoteReceiver(savegeometry)
current_tab_3 = RemoteReceiver(current_tab)
expression_19 = Expression(x="Analysis module", y=current_tab_3, Expression="x=y")

current_tab_index_2 = RemoteReceiver(current_tab_index)
help_button_2 = RemoteReceiver(help_button)
heath_window_2 = RemoteReceiver(heath_window)
filter_7 = StreamFilter(
    Gate=current_tab_index_2,
    Stream0="Geometry module",
    Stream1="Program module",
    Stream2="Construction module",
    Stream3="Assembly module",
    Stream4="Visualize module",
    Stream5="Analysis module")
filter_8 = StreamFilter(
    Gate=current_tab_index_2,
    Stream0=panel_60,
    Stream1=panel_61,
    Stream2=panel_62,
    Stream3=panel_65,
    Stream4=panel_63,
    Stream5=panel_64)
launchwin_5 = LaunchWindow(
    Show=help_button_2,
    Name="Help!",
    Width=Slider(350, range=0..500),
    Height=Slider(280, range=0..500),
    ChildStatus=0,
    EnableHorizScroll=False)
settextblock_8 = SetTextBlockContents(TextBlockToModify=tb_14, NewTextBlockContents=filter_8)
setlabel_3 = SetLabelContents(LabelToModify=label_30, NewLabelContents=filter_7)
childwin = MakeChildWindow(ParentWindow=heath_window_2, ChildWindow=launchwin_5)
winprops_5 = SetWindowProperties(
    Window=launchwin_5,
    StartingLocation=pt_13,
    Theme=0,
    ShowTitleBar=True,
    BackgroundColor=RGB(255, 255, 255),
    ScaleFactor=1)
addelems_5 = AddElements(Window=launchwin_5, Elements=flatten(entwine_72), DoVLChecking=True)  # -> AddedElements, ElementNames

# ----
# Heath info
number_slider_33 = Slider(148, range=0..500)
panel_69 = Panel("""Import geometry which is 
used to create the 
honeybee model""")
info_save_geometry_2 = RemoteReceiver(info_save_geometry)
heath_window_3 = RemoteReceiver(heath_window)
label_31 = CreateLabel(LabelText=panel_69, LabelSize=12, Justification=0)
launchwin_6 = LaunchWindow(
    Show=info_save_geometry_2,
    Name="Info",
    Width=Slider(180, range=0..500),
    Height=number_slider_33,
    ChildStatus=0,
    EnableHorizScroll=False)
pt_14 = ConstructPoint(XCoordinate=Slider(183, range=0..1000), YCoordinate=Slider(183, range=0..1000), ZCoordinate=0)
addelems_6 = AddElements(Window=launchwin_6, Elements=flatten(label_31), DoVLChecking=True)  # -> AddedElements, ElementNames
childwin_2 = MakeChildWindow(ParentWindow=heath_window_3, ChildWindow=launchwin_6)
winprops_6 = SetWindowProperties(
    Window=launchwin_6,
    StartingLocation=pt_14,
    Theme=0,
    ShowTitleBar=True,
    BackgroundColor=RGB(255, 255, 255),
    ScaleFactor=1)

launchxpwin_2 = LaunchTransparentWindow(
    Show=Toggle(False),
    Name="Heath",
    Width=number_slider_29,
    Height=number_slider_30,
    ChildStatus=0,
    EnableHorizScroll=False)
subtraction_3 = Subtraction(A=number_slider_30, B=Slider(52, range=0..100))
separator = CreateSeparator(Thickness=0.5, Horizontal=invert(True), Color=RGB(0, 0, 0), Height=subtraction_3)
winstat_2 = WindowStatus(Window=launchwin_4)
button_20 = CreateButton(ButtonName="Save state", ButtonStyle=0)
heath_status = RemoteSender(winstat_2)

values_85 = ValueListener(Elements=button_20, SomeProperty=True)  # -> Values, Indices
save_state = RemoteSender(values_85.Values)
entwine_79 = Entwine(
    Branch00=true_button_10,
    Branch01=filepicker,
    Branch02=button_20,
    Branch03=filepicker_2,
    Branch04=button_19,
    FlattenInputs=True)  # -> flatten(Result)
stack_49 = CreateStack(UIElements=entwine_79, Horizontal=invert(True))
entwine_80 = Entwine(Branch00=tabs, Branch01=separator, Branch02=stack_49, FlattenInputs=True)  # -> flatten(Result)
stack_50 = CreateStack(UIElements=entwine_80, Horizontal=True)
addelems_7 = AddElements(Window=launchwin_4, Elements=flatten(stack_50), DoVLChecking=True)  # -> AddedElements, ElementNames
heath_elements = RemoteSender(addelems_7.AddedElements)

load_state_file_2 = RemoteReceiver(load_state_file)
load_state_2 = RemoteReceiver(load_state)
save_state_2 = RemoteReceiver(save_state)
gate_7 = StreamGate(Stream=load_state_file_2, Gate=load_state_2)  # -> Target0, Target1
file = ReadFile(File=gate_7.Target0, PerLineParse=True)
writetxt = WriteToTextFile(
    Run=save_state_2,
    TextToWrite=geometry_module_state_preview_type_2,
    FilePath=save_location_2,
    Append=False,
    NewOnly=False)
geometry_module_loaded_state_preview_typ = RemoteSender(file)  # "geometry_module_loaded_state_preview_type"

geometry_module_loaded_state_preview_typ_2 = RemoteReceiver(geometry_module_loaded_state_preview_typ)  # "geometry_module_loaded_state_preview_type"
setlist_2 = SetListContents(ListToModify=pulldown_7, NewListContents=panel_34, SelectedIndex=geometry_module_loaded_state_preview_typ_2)
hideshow_11 = HideShowElement(ElementToHideShow=button_20, Show=null.NullFlags, Collapse=True, Disable=False)
current_tab_4 = RemoteReceiver(current_tab)
expression_20 = Expression(x="Analysis module", y=current_tab_4, Expression="x=y")

current_tab_5 = RemoteReceiver(current_tab)
current_tab_6 = RemoteReceiver(current_tab)
current_tab_7 = RemoteReceiver(current_tab)
current_tab_8 = RemoteReceiver(current_tab)
current_tab_9 = RemoteReceiver(current_tab)
current_tab_10 = RemoteReceiver(current_tab)
expression_21 = Expression(x=panel_21, y=current_tab_5, Expression="x=y")
expression_22 = Expression(x="Assembly module", y=current_tab_6, Expression="x=y")
expression_23 = Expression(x="Assembly module", y=current_tab_7, Expression="x=y")
expression_24 = Expression(x="Assembly module", y=current_tab_8, Expression="x=y")
current_tab_11 = RemoteReceiver(current_tab)
expression_25 = Expression(x="Assembly module", y=current_tab_9, Expression="x=y")
expression_26 = Expression(x="Assembly module", y=current_tab_10, Expression="x=y")
current_tab_12 = RemoteReceiver(current_tab)
expression_27 = Expression(x="Assembly module", y=current_tab_11, Expression="x=y")
expression_28 = Expression(x="Assembly module", y=current_tab_12, Expression="x=y")
and_2 = GateAnd(A=values_20.Values, B=expression_27)
current_tab_13 = RemoteReceiver(current_tab)
show_honeybee_all = RemoteSender(and_2)
show_honeybee_all_2 = RemoteReceiver(show_honeybee_all)
show_honeybee_all_3 = RemoteReceiver(show_honeybee_all)
show_honeybee_all_4 = RemoteReceiver(show_honeybee_all)
show_honeybee_all_5 = RemoteReceiver(show_honeybee_all)
show_honeybee_all_6 = RemoteReceiver(show_honeybee_all)
show_honeybee_all_7 = RemoteReceiver(show_honeybee_all)
show_honeybee_all_8 = RemoteReceiver(show_honeybee_all)
or_5 = GateOr(A=values_16.Values, B=show_honeybee_all_2)
or_6 = GateOr(A=values_17.Values, B=show_honeybee_all_3)
or_7 = GateOr(A=values_18.Values, B=show_honeybee_all_4)
or_8 = GateOr(A=values_21.Values, B=show_honeybee_all_5)
or_9 = GateOr(A=values_22.Values, B=show_honeybee_all_6)
or_10 = GateOr(A=values_23.Values, B=show_honeybee_all_7)
or_11 = GateOr(A=values_24.Values, B=show_honeybee_all_8)
and_3 = GateAnd(A=or_5, B=expression_21)
and_4 = GateAnd(A=or_6, B=expression_28)
and_5 = GateAnd(A=or_7, B=expression_22)
and_6 = GateAnd(A=or_8, B=expression_23)
and_7 = GateAnd(A=or_9, B=expression_24)
and_8 = GateAnd(A=or_10, B=expression_25)
and_9 = GateAnd(A=or_11, B=expression_26)
current_tab_14 = RemoteReceiver(current_tab)
show_honeybee_context = RemoteSender(and_4)
show_honeybee_ground = RemoteSender(and_6)
show_honeybee_floors = RemoteSender(and_7)
show_honeybee_walls = RemoteSender(and_9)
expression_29 = Expression(x="Assembly module", y=current_tab_13, Expression="x=y")
show_honeybee_windows = RemoteSender(and_5)
show_honeybee_roof = RemoteSender(and_8)
show_honeybee_doors = RemoteSender(and_3)
expression_30 = Expression(x="Assembly module", y=current_tab_14, Expression="x=y")
and_10 = GateAnd(A=equals.Inequality, B=expression_29)
and_11 = GateAnd(A=equals_2.Inequality, B=expression_30)
event_2 = EventGate(Data=and_10)  # -> Data, IsNew
event_3 = EventGate(Data=and_11)  # -> Data, IsNew
panel_70 = Panel(event_2.Data)
create_model_2 = RemoteSender(event_2.Data)
bake_model = RemoteSender(event_3.Data)

create_model_3 = RemoteReceiver(create_model_2)
freeze_gate_16 = StreamFreezeGate(Data=create_model_3, PassingSwitch=create_model_3)
py3_5 = Python3Script(get=freeze_gate_16)  # -> mpl_folder; same code as py3_2
nextfile_2 = NextAvailableFilename(Format="LCA{000}.png", FolderPath=py3_5, Trigger=create_model_3)
py3_6 = Python3Script(
    file_location=nextfile_2,
    y_label="GWP (kg CO2eq)",
    title="GWP by element type (kg CO2eq)",
    labels=lca_element_types_2,
    values=expression_16,
    colors=fragment)  # -> out, file_location_out; inputs labels: list, values: list, colors: list
# ---------- py3_6: Python ----------
# requirements: matplotlib
# requirements: numpy

import matplotlib.pyplot as plt
import numpy as np

fig, ax = plt.subplots()

for i in range(len(colors)):
    colors[i] = colors[i].split(',')
    colors[i] = tuple([float(j) for j in colors[i]])

fig, ax = plt.subplots(figsize=(14, 6))
ax.bar(labels, values, label=labels, color=colors, align="center")
bottom = 0
for i in range(len(labels)):
    ax.bar('total GWP', values[i], color=colors[i], bottom=bottom, align='center')
    bottom += values[i]

ax.set_ylim(0, sum(values)*1.1)
ax.set_ylabel(y_label)
ax.set_title(title)

plt.subplots_adjust(right=0.8)

ax.legend(title=title, bbox_to_anchor=(1.0, 1), loc='upper left', reverse=True)

plt.savefig(file_location)
file_location_out = file_location

#plt.show()
# ---------- end py3_6 ----------
setimg = SetImage(ImageToModify=image_3, NewImagePath=py3_6.file_location_out)

current_tab_15 = RemoteReceiver(current_tab)
expression_31 = Expression(x="Geometry module", y=current_tab_15, Expression="x=y")
and_12 = GateAnd(A=values_43.Values, B=expression_31)
preview_3 = RemoteSender(and_12)
heath_status_2 = RemoteReceiver(heath_status)
current_tab_16 = RemoteReceiver(current_tab)
expression_32 = Expression(x="Geometry module", y=current_tab_16, Expression="x=y")
expression_33 = Expression(x="Hidden", y=heath_status_2, Expression="x=y")
and_13 = GateAnd(A=equals_5.Inequality, B=expression_32, C=invert(expression_33))
event_4 = EventGate(Data=and_13)  # -> Data, IsNew
create_test_model = RemoteSender(event_4.Data)

create_test_model_2 = RemoteReceiver(create_test_model)
bake = BakeObjects(Geometry=entwine_11, Attributes=repeat_2, Bake=create_test_model_2, createGroups=False)  # -> Message, Ghosts

current_tab_17 = RemoteReceiver(current_tab)
expression_34 = Expression(x="Visualize module", y=current_tab_17, Expression="x=y")
and_14 = GateAnd(A=values_31.Values, B=expression_34)
current_tab_18 = RemoteReceiver(current_tab)
weather_visualization_show = RemoteSender(and_14)
current_tab_19 = RemoteReceiver(current_tab)
current_tab_20 = RemoteReceiver(current_tab)
current_tab_21 = RemoteReceiver(current_tab)
current_tab_22 = RemoteReceiver(current_tab)
current_tab_23 = RemoteReceiver(current_tab)
expression_35 = Expression(x="Visualize module", y=current_tab_18, Expression="x=y")
expression_36 = Expression(x="Visualize module", y=current_tab_20, Expression="x=y")
expression_37 = Expression(x="Visualize module", y=current_tab_19, Expression="x=y")
expression_38 = Expression(x="Visualize module", y=current_tab_21, Expression="x=y")
expression_39 = Expression(x="Visualize module", y=current_tab_22, Expression="x=y")
expression_40 = Expression(x="Visualize module", y=current_tab_23, Expression="x=y")
and_15 = GateAnd(A=equals_4.Inequality, B=expression_35)
and_16 = GateAnd(A=equals_3.Inequality, B=expression_36)
and_17 = GateAnd(A=values_33.Values, B=expression_37)
and_18 = GateAnd(A=values_38.Values, B=expression_38)
and_19 = GateAnd(A=values_37.Values, B=expression_39)
and_20 = GateAnd(A=values_40.Values, B=expression_40)
event_5 = EventGate(Data=and_15)  # -> Data, IsNew
event_6 = EventGate(Data=and_16)  # -> Data, IsNew
room_energy_attribute_visualize = RemoteSender(and_17)
face_attribute_visualize = RemoteSender(and_18)
room_attribute_visualize = RemoteSender(and_19)
face_energy_attribute_visualize = RemoteSender(and_20)
weather_visualisation_bake = RemoteSender(event_5.Data)
run_weather_visualisation = RemoteSender(event_6.Data)

run_weather_visualisation_2 = RemoteReceiver(run_weather_visualisation)

current_tab_24 = RemoteReceiver(current_tab)
current_tab_25 = RemoteReceiver(current_tab)
current_tab_26 = RemoteReceiver(current_tab)
current_tab_27 = RemoteReceiver(current_tab)
expression_41 = Expression(x="Analysis module", y=current_tab_24, Expression="x=y")
expression_42 = Expression(x="Analysis module", y=current_tab_25, Expression="x=y")
expression_43 = Expression(x="Analysis module", y=current_tab_26, Expression="x=y")
expression_44 = Expression(x="Analysis module", y=current_tab_27, Expression="x=y")
and_21 = GateAnd(A=equals_7.Inequality, B=expression_41)
and_22 = GateAnd(A=equals_8.Inequality, B=expression_42)
and_23 = GateAnd(A=equals_9.Inequality, B=expression_43)
and_24 = GateAnd(A=equals_10.Inequality, B=expression_44)
event_7 = EventGate(Data=and_21)  # -> Data, IsNew
event_8 = EventGate(Data=and_22)  # -> Data, IsNew
event_9 = EventGate(Data=and_23)  # -> Data, IsNew
event_10 = EventGate(Data=and_24)  # -> Data, IsNew
run_daylight_simulations = RemoteSender(event_7.Data)
run_simple_energy_simulations = RemoteSender(event_8.Data)
calculate_glare_probability = RemoteSender(event_9.Data)
run_detailed_energy_simulations = RemoteSender(event_10.Data)

run_simple_energy_simulations_2 = RemoteReceiver(run_simple_energy_simulations)
py3_7 = Python3Script(get=run_simple_energy_simulations_2)  # -> mpl_folder; same code as py3_2
run_detailed_energy_simulations_2 = RemoteReceiver(run_detailed_energy_simulations)
calculate_glare_probability_2 = RemoteReceiver(calculate_glare_probability)
run_glare_analysis = Boolean(calculate_glare_probability_2)
run_simple_energy_simulations_3 = RemoteReceiver(run_simple_energy_simulations)
panel_71 = Panel(run_simple_energy_simulations_3)

savegeometry_4 = RemoteReceiver(savegeometry)
savegeometry_5 = RemoteReceiver(savegeometry)
savegeometry_6 = RemoteReceiver(savegeometry)
savegeometry_7 = RemoteReceiver(savegeometry)
savegeometry_8 = RemoteReceiver(savegeometry)
py3_8 = Python3Script(x=savegeometry_4)  # -> a
# ---------- py3_8: Python ----------
"""Grasshopper Script"""

import rhinoscriptsyntax as rs

if x:
    rs.Command("SelNone")
    a = True
# ---------- end py3_8 ----------
preview_4 = RemoteReceiver(preview_3)
preview_5 = RemoteReceiver(preview_3)
preview_6 = RemoteReceiver(preview_3)
preview_7 = RemoteReceiver(preview_3)
or_12 = GateOr(A=Toggle(True), B=py3_8)
or_13 = GateOr(A=savegeometry_6, B=preview_5, C=expression_7)
or_14 = GateOr(A=savegeometry_5, B=preview_4, C=expression_4)
or_15 = GateOr(A=savegeometry_8, B=preview_7, C=expression_11)
or_16 = GateOr(A=savegeometry_7, B=preview_6, C=expression_10)
selobj_2 = ObjectsBySelection(Reset=or_12, LiveMode=True)
gate_8 = StreamGate(Stream="Heath geometry type", Gate=or_15)  # -> Target0, Target1
gate_9 = StreamGate(Stream="Heath geometry type", Gate=or_13)  # -> Target0, Target1
gate_10 = StreamGate(Stream="Heath geometry type", Gate=or_14)  # -> Target0, Target1
gate_11 = StreamGate(Stream="Heath geometry type", Gate=or_16)  # -> Target0, Target1
refkv = ReferenceByKeyValue(Key=gate_9.Target1, Val=gate_3.Target1, lightweight=False)
refkv_2 = ReferenceByKeyValue(Key=gate_10.Target1, Val=gate_5.Target1, lightweight=False)
refkv_3 = ReferenceByKeyValue(Key=gate_8.Target1, Val=gate_4.Target1, lightweight=False)
seletedgeometry = RemoteSender(selobj_2)
seletedgeometry_2 = RemoteReceiver(seletedgeometry)
seletedgeometry_3 = RemoteReceiver(seletedgeometry)
modratt = ModifyRhinoObjectAttributes(ReferencedObject=seletedgeometry_3, Attributes=ef_att_3, Activate=saveconstruction)
panel_72 = Panel(modratt)
refkv_4 = ReferenceByKeyValue(Key=gate_11.Target1, Val=gate_6.Target1, lightweight=False)
preview_8 = RemoteReceiver(preview_3)
preview_9 = RemoteReceiver(preview_3)
preview_10 = RemoteReceiver(preview_3)
preview_11 = RemoteReceiver(preview_3)
gate_12 = StreamGate(Stream=refkv, Gate=preview_8)  # -> Target0, Target1
gate_13 = StreamGate(Stream=refkv_3, Gate=preview_9)  # -> Target0, Target1
gate_14 = StreamGate(Stream=refkv_4, Gate=preview_10)  # -> Target0, Target1
gate_15 = StreamGate(Stream=refkv_2, Gate=preview_11)  # -> Target0, Target1
preview_12 = CustomPreview(Geometry=gate_12.Target1, Material=ColourSwatch(SwatchColor=RGBA(128, 125, 0, 75)))
preview_13 = CustomPreview(Geometry=gate_13.Target1, Material=ColourSwatch(SwatchColor=RGBA(0, 17, 128, 75)))
preview_14 = CustomPreview(Geometry=gate_14.Target1, Material=ColourSwatch(SwatchColor=RGBA(128, 0, 102, 75)))
preview_15 = CustomPreview(Geometry=gate_15.Target1, Material=ColourSwatch(SwatchColor=RGBA(4, 128, 0, 75)))
room_energy_attribute_visualize_2 = RemoteReceiver(room_energy_attribute_visualize)
face_energy_attribute_visualize_2 = RemoteReceiver(face_energy_attribute_visualize)
show_honeybee_windows_2 = RemoteReceiver(show_honeybee_windows)
room_attribute_visualize_2 = RemoteReceiver(room_attribute_visualize)
show_honeybee_ground_2 = RemoteReceiver(show_honeybee_ground)
show_honeybee_context_2 = RemoteReceiver(show_honeybee_context)
face_attribute_visualize_2 = RemoteReceiver(face_attribute_visualize)
show_honeybee_floors_2 = RemoteReceiver(show_honeybee_floors)
show_honeybee_doors_2 = RemoteReceiver(show_honeybee_doors)
show_honeybee_walls_2 = RemoteReceiver(show_honeybee_walls)
show_honeybee_roof_2 = RemoteReceiver(show_honeybee_roof)
preview_16 = RemoteReceiver(preview_3)

seletedgeometry_4 = RemoteReceiver(seletedgeometry)
lng_3 = ListLength(List=seletedgeometry_4)
bool_13 = Boolean(lng_3)
seletedgeometry_5 = RemoteReceiver(seletedgeometry)
filter_9 = StreamFilter(Gate=bool_13, Stream0=Slider(500, range=0..1000), Stream1=Slider(1000000, range=0..1000000))
filter_10 = StreamFilter(Gate=bool_13, Stream0="Select Rhino geometry to import", Stream1=" ")
lng_4 = ListLength(List=seletedgeometry_5)
hideshow_12 = HideShowElement(ElementToHideShow=button_8, Show=True, Collapse=True, Disable=invert(lng_4))
tooltip_9 = AttachTooltipToElement(ElementsToAttachTo=button_8, TooltipContent=filter_10, ShowDelay=filter_9, Duration=2000)

seletedgeometry_6 = RemoteReceiver(seletedgeometry)
lng_5 = ListLength(List=seletedgeometry_6)
freeze_gate_17 = StreamFreezeGate(Data=seletedgeometry_2, PassingSwitch=presavegeometry_2, Hold=False)
filtertype = FilterByType(ObjectType="Extrusion", Geometry=freeze_gate_17, invertFilter=False, returnNulls=False)  # -> ExcludedGeometry, IncludedGeometry
filtertype_2 = FilterByType(ObjectType="Brep", Geometry=freeze_gate_17, invertFilter=False, returnNulls=False)  # -> ExcludedGeometry, IncludedGeometry
filtertype_3 = FilterByType(ObjectType="Surface", Geometry=freeze_gate_17, invertFilter=False, returnNulls=False)  # -> ExcludedGeometry, IncludedGeometry
filtertype_4 = FilterByType(ObjectType="Mesh", Geometry=freeze_gate_17, invertFilter=False, returnNulls=False)  # -> ExcludedGeometry, IncludedGeometry
filtertype_5 = FilterByType(ObjectType="Polysurface", Geometry=freeze_gate_17, invertFilter=False, returnNulls=False)  # -> ExcludedGeometry, IncludedGeometry
py3_9 = Python3Script(Ps=[filtertype.IncludedGeometry, filtertype_2.IncludedGeometry, filtertype_5.IncludedGeometry])  # -> C; inputs Ps: Brep
# ---------- py3_9: Python ----------
if Ps:
    C = Ps.IsSolid
# ---------- end py3_9 ----------
lng_6 = ListLength(List=freeze_gate_17)

planar = IsPlanar(Surface=filtertype_3.IncludedGeometry, Interior=True)  # -> Planar, Plane
cull = CullPattern(List=[filtertype.IncludedGeometry, filtertype_2.IncludedGeometry, filtertype_5.IncludedGeometry], CullPattern=py3_9)
cull_2 = CullPattern(List=filtertype_3.IncludedGeometry, CullPattern=planar.Planar)
filter_11 = StreamFilter(
    Gate=geometrytype_validate_2,
    Stream0=cull,
    Stream1=cull_2,
    Stream2=[filtertype_5.IncludedGeometry, filtertype_3.IncludedGeometry],
    Stream3=[filtertype_4.IncludedGeometry, filtertype_3.IncludedGeometry, filtertype_5.IncludedGeometry, filtertype.IncludedGeometry, filtertype_2.IncludedGeometry],
    Stream4=freeze_gate_17)  # -> flatten(Stream)

id = Guid(filter_11)
txt_2 = Text(id)
cset = CreateSet(List=txt_2)  # -> Set, Map
geo_3 = Geometry(cset.Set)
lng_7 = ListLength(List=geo_3)
equals_12 = Equality(FirstNumber=lng_6, SecondNumber=lng_7)  # -> Equality, Inequality
freeze_gate_18 = StreamFreezeGate(Data=equals_12.Equality, PassingSwitch=savegeometry_3)
hasdata_5 = DataExists(Data=freeze_gate_18)
filter_12 = StreamFilter(Gate=hasdata_5, Stream0="1", Stream1=freeze_gate_18)

modratt_2 = ModifyRhinoObjectAttributes(ReferencedObject=geo_3, Attributes=ef_att_2, Activate=savegeometry_2)
geometry_saved = RemoteSender(filter_12)

geometry_saved_2 = RemoteReceiver(geometry_saved)
nor = GateNor(A=geometry_saved_2, B=lng_5)
hideshow_13 = HideShowElement(ElementToHideShow=label_7, Show=nor, Collapse=True, Disable=False)
panel_73 = Panel(modratt_2)

heath_window_4 = RemoteReceiver(heath_window)

nextfile_3 = NextAvailableFilename(Format="Annual energy balance{000}.png", FolderPath=py3_7, Trigger=run_simple_energy_simulations_2)
panel_74 = Panel(nextfile_3)

# ----
# Recursion
panel_75 = Panel("Material database")
objbynn = GetObjectByNickname(NickName=panel_75)
material_database = Python3Script()  # -> status
# ---------- material_database: Python ----------
status = False
# ---------- end material_database ----------

# ----
# Recursion
panel_76 = Panel("Construction database")
objbynn_2 = GetObjectByNickname(NickName=panel_76)
construction_database = Python3Script()  # -> status; same code as material_database

# ----
# Recursion
panel_77 = Panel("Window database")
objbynn_3 = GetObjectByNickname(NickName=panel_77)
window_database = Python3Script()  # -> status; same code as material_database

# ----
# Material database launch
open_material_database_2 = RemoteReceiver(open_material_database)
rec = DataRecorder(open_material_database_2, DataLimit=-2, RecordData=True)
ma_2 = MassAddition(Input=rec)  # -> Result, PartialResults
entwine_81 = Entwine(Branch00=ma_2.Result, Branch01=material_database, FlattenInputs=True)
rec_2 = DataRecorder(entwine_81, DataLimit=2, RecordData=True)
item_6 = ListItem(List=rec_2, Index=0, Wrap=True)  # -> Item2, Item1, Item
equals_13 = Equality(FirstNumber=item_6.Item2, SecondNumber=item_6.Item1)  # -> Equality, Inequality
bang = ExplodeTree(Data=equals_13.Inequality)  # -> Branch0, Branch1
py3_10 = Python3Script(x=bang.Branch0, y=bang.Branch1)  # -> a
# ---------- py3_10: Python ----------
if x:
    a = True
elif y:
    a = False
else:
    a = False
# ---------- end py3_10 ----------
event_11 = EventGate(Data=py3_10)  # -> Data, IsNew
freeze_gate_19 = StreamFreezeGate(Data=py3_10, PassingSwitch=event_11.IsNew)
event_12 = EventGate(Data=freeze_gate_19)  # -> Data, IsNew
panel_78 = Panel(event_12.Data)
accent_colors_6 = ValueList({"Amber", "Blue", "Brown", "Cobalt", "Crimson", "Cyan", "Emerald", "Green", "Indigo", "Lime", "Magenta", "Mauve", "Olive", "Orange", "Pink", "Purple", "Red", "Sienna", "Steel", "Taupe", "Teal", "Violet", "Yellow"}, selected="Blue")
database_modal_location_2 = RemoteReceiver(database_modal_location)
launchwin_7 = LaunchWindow(
    Show=event_12.Data,
    Name="Material database",
    Width=Slider(360, range=0..1000),
    Height=Slider(540, range=0..1000),
    ChildStatus=2,
    EnableHorizScroll=False)
winstat_3 = WindowStatus(Window=launchwin_7)
winprops_7 = SetWindowProperties(
    Window=launchwin_7,
    StartingLocation=database_modal_location_2,
    Theme=0,
    AccentColor=accent_colors_6,
    ShowTitleBar=True,
    BackgroundColor=RGB(255, 255, 255),
    ScaleFactor=1)
material_database_status = RemoteSender(winstat_3)

material_database_status_2 = RemoteReceiver(material_database_status)
expression_45 = Expression(x="Hidden", y=material_database_status_2, Expression="x=y")
expire = ExpireObject(ObjectToExpire=objbynn, Expire=expression_45)

material_database_status_3 = RemoteReceiver(material_database_status)

# ----
# Material database
heath_flying_4 = RemoteReceiver(heath_flying)
py3_11 = Python3Script(get=heath_flying_4)  # -> mpl_folder; same code as py3_2
true_button_11 = CreateTrueOnlyButton(ButtonName="Create material", ButtonStyle=0)
filepicker_3 = CreateFilePicker(ButtonLabelText="Load materials from file", DialogType=0, MustExist=True, Filter="JSON File|*.json", StartingPath=py3_11)
button_21 = CreateButton(ButtonName="Load materials", ButtonStyle=0)
values_86 = ValueListener(Elements=button_21, SomeProperty=True)  # -> Values, Indices
values_87 = ValueListener(Elements=filepicker_3, SomeProperty=True)  # -> Values, Indices
values_88 = ValueListener(Elements=true_button_11, SomeProperty=True)  # -> Values, Indices
freeze_gate_20 = StreamFreezeGate(Data=values_86.Values, PassingSwitch=invert(values_86.Values))
bool_14 = Boolean(values_87.Values)
panel_79 = Panel(values_88.Values)
create_material_modal = RemoteSender(values_88.Values)
loaded_materials_file = RemoteSender(values_87.Values)
null_11 = NullItem(Item=bool_14)  # -> NullFlags, InvalidFlags, Description
bool_15 = Boolean(invert(freeze_gate_20))
tap_11 = TapBuffer(Reset=False, Incremental=True, Valve=bool_15, Hold=True)
dam_11 = DataDam(DataA=tap_11, BufferDelay=2500000, BufferMode=2)
hideshow_14 = HideShowElement(ElementToHideShow=button_21, Show=null_11.NullFlags, Collapse=True, Disable=False)
expression_46 = Expression(x="Normal", y=material_database_status_3, Expression="x=y")
equals_14 = Equality(FirstNumber=tap_11, SecondNumber=dam_11)  # -> Equality, Inequality
and_25 = GateAnd(A=equals_14.Inequality, B=expression_46)
entwine_82 = Entwine(Branch00=filepicker_3, Branch01=button_21, FlattenInputs=True)  # -> flatten(Result)
event_13 = EventGate(Data=and_25)  # -> Data, IsNew
stack_51 = CreateStack(UIElements=entwine_82, Horizontal=True)
panel_80 = Panel(event_13.Data)
load_materials = RemoteSender(event_13.Data)
adjustpos_58 = AdjustElementPositioning(ElementsToAdjust=true_button_11, AbsolutePositioning=False, HorizontalAlignment=1)
adjustpos_59 = AdjustElementPositioning(
    ElementsToAdjust=filepicker_3,
    AbsolutePositioning=False,
    Width=Slider(180, range=0..300),
    Height=Slider(32, range=0..300),
    HorizontalAlignment=0)
adjustpos_60 = AdjustElementPositioning(ElementsToAdjust=button_21, AbsolutePositioning=False, Height=Slider(32, range=0..300), HorizontalAlignment=0)
entwine_83 = Entwine(Branch00=true_button_11, Branch01=stack_51, FlattenInputs=True)  # -> flatten(Result)

addelems_8 = AddElements(Window=launchwin_7, Elements=flatten(entwine_83), DoVLChecking=True)  # -> AddedElements, ElementNames
material_database_elements = RemoteSender(addelems_8.AddedElements)

# ----
# Construction database launch
open_construction_database_2 = RemoteReceiver(open_construction_database)
rec_3 = DataRecorder(open_construction_database_2, DataLimit=-2, RecordData=True)
ma_3 = MassAddition(Input=rec_3)  # -> Result, PartialResults
entwine_84 = Entwine(Branch00=ma_3.Result, Branch01=construction_database, FlattenInputs=True)
rec_4 = DataRecorder(entwine_84, DataLimit=2, RecordData=True)
item_7 = ListItem(List=rec_4, Index=0, Wrap=True)  # -> Item2, Item1, Item
equals_15 = Equality(FirstNumber=item_7.Item2, SecondNumber=item_7.Item1)  # -> Equality, Inequality
bang_2 = ExplodeTree(Data=equals_15.Inequality)  # -> Branch0, Branch1
py3_12 = Python3Script(x=bang_2.Branch0, y=bang_2.Branch1)  # -> a; same code as py3_10
event_14 = EventGate(Data=py3_12)  # -> Data, IsNew
freeze_gate_21 = StreamFreezeGate(Data=py3_12, PassingSwitch=event_14.IsNew)
event_15 = EventGate(Data=freeze_gate_21)  # -> Data, IsNew
database_modal_location_3 = RemoteReceiver(database_modal_location)
panel_81 = Panel(event_15.Data)
accent_colors_7 = ValueList({"Amber", "Blue", "Brown", "Cobalt", "Crimson", "Cyan", "Emerald", "Green", "Indigo", "Lime", "Magenta", "Mauve", "Olive", "Orange", "Pink", "Purple", "Red", "Sienna", "Steel", "Taupe", "Teal", "Violet", "Yellow"}, selected="Blue")
launchwin_8 = LaunchWindow(
    Show=event_15.Data,
    Name="Construction database",
    Width=Slider(360, range=0..1000),
    Height=Slider(540, range=0..1000),
    ChildStatus=2,
    EnableHorizScroll=False)
winstat_4 = WindowStatus(Window=launchwin_8)
winprops_8 = SetWindowProperties(
    Window=launchwin_8,
    StartingLocation=database_modal_location_3,
    Theme=0,
    AccentColor=accent_colors_7,
    ShowTitleBar=True,
    BackgroundColor=RGB(255, 255, 255),
    ScaleFactor=1)
construction_database_status = RemoteSender(winstat_4)

construction_database_status_2 = RemoteReceiver(construction_database_status)
expression_47 = Expression(x="Hidden", y=construction_database_status_2, Expression="x=y")
expire_2 = ExpireObject(ObjectToExpire=objbynn_2, Expire=expression_47)

construction_database_status_3 = RemoteReceiver(construction_database_status)

# ----
# Construction database
heath_flying_5 = RemoteReceiver(heath_flying)
py3_13 = Python3Script(get=heath_flying_5)  # -> mpl_folder; same code as py3_2
true_button_12 = CreateTrueOnlyButton(ButtonName="Create construction", ButtonStyle=0)
filepicker_4 = CreateFilePicker(
    ButtonLabelText="Load constructions from file",
    DialogType=0,
    MustExist=True,
    Filter="JSON File|*.json",
    StartingPath=py3_13)
button_22 = CreateButton(ButtonName="Load constructions", ButtonStyle=0)
values_89 = ValueListener(Elements=button_22, SomeProperty=True)  # -> Values, Indices
values_90 = ValueListener(Elements=filepicker_4, SomeProperty=True)  # -> Values, Indices
values_91 = ValueListener(Elements=true_button_12, SomeProperty=True)  # -> Values, Indices
freeze_gate_22 = StreamFreezeGate(Data=values_89.Values, PassingSwitch=invert(values_89.Values))
bool_16 = Boolean(values_90.Values)
create_construction_modal = RemoteSender(values_91.Values)
panel_82 = Panel(values_91.Values)
loaded_constructions_file = RemoteSender(values_90.Values)
null_12 = NullItem(Item=bool_16)  # -> NullFlags, InvalidFlags, Description
bool_17 = Boolean(invert(freeze_gate_22))
tap_12 = TapBuffer(Reset=False, Incremental=True, Valve=bool_17, Hold=True)
dam_12 = DataDam(DataA=tap_12, BufferDelay=2500000, BufferMode=2)
hideshow_15 = HideShowElement(ElementToHideShow=button_22, Show=null_12.NullFlags, Collapse=True, Disable=False)
expression_48 = Expression(x="Normal", y=construction_database_status_3, Expression="x=y")
equals_16 = Equality(FirstNumber=tap_12, SecondNumber=dam_12)  # -> Equality, Inequality
and_26 = GateAnd(A=equals_16.Inequality, B=expression_48)
entwine_85 = Entwine(Branch00=filepicker_4, Branch01=button_22, FlattenInputs=True)  # -> flatten(Result)
event_16 = EventGate(Data=and_26)  # -> Data, IsNew
stack_52 = CreateStack(UIElements=entwine_85, Horizontal=True)
load_constructions = RemoteSender(event_16.Data)
panel_83 = Panel(event_16.Data)
adjustpos_61 = AdjustElementPositioning(ElementsToAdjust=button_22, AbsolutePositioning=False, Height=Slider(32, range=0..300), HorizontalAlignment=0)
adjustpos_62 = AdjustElementPositioning(
    ElementsToAdjust=filepicker_4,
    AbsolutePositioning=False,
    Width=Slider(180, range=0..300),
    Height=Slider(32, range=0..300),
    HorizontalAlignment=0)
adjustpos_63 = AdjustElementPositioning(ElementsToAdjust=true_button_12, AbsolutePositioning=False, HorizontalAlignment=1)
entwine_86 = Entwine(Branch00=true_button_12, Branch01=stack_52, FlattenInputs=True)  # -> flatten(Result)

addelems_9 = AddElements(Window=launchwin_8, Elements=flatten(entwine_86), DoVLChecking=True)  # -> AddedElements, ElementNames
construction_database_elements = RemoteSender(addelems_9.AddedElements)

# ----
# Load constructions, (not sorted)
loaded_constructions_file_2 = RemoteReceiver(loaded_constructions_file)
load_constructions_2 = RemoteReceiver(load_constructions)
loadobjects = HBLoadObjects(hb_file=loaded_constructions_file_2, load=load_constructions_2)  # -> report, hb_objs; plug-in component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
hold = HoldingGate(Data=loadobjects.hb_objs)
panel_84 = Panel(hold)
loaded_constructions = RemoteSender(hold)

panel_85 = Panel(load_constructions_2)

load_constructions_3 = RemoteReceiver(load_constructions)
freeze_gate_23 = StreamFreezeGate(Data=load_constructions_3, PassingSwitch=load_constructions_3)

# ----
# Window database
heath_flying_6 = RemoteReceiver(heath_flying)
py3_14 = Python3Script(get=heath_flying_6)  # -> mpl_folder; same code as py3_2
true_button_13 = CreateTrueOnlyButton(ButtonName="Create window", ButtonStyle=0)
label_32 = CreateLabel(LabelText="Windows", LabelSize=18, Justification=0)
filepicker_5 = CreateFilePicker(ButtonLabelText="Load windows from file", DialogType=0, MustExist=True, Filter="JSON File|*.json", StartingPath=py3_14)
button_23 = CreateButton(ButtonName="Load windows", ButtonStyle=0)
values_92 = ValueListener(Elements=button_23, SomeProperty=True)  # -> Values, Indices
values_93 = ValueListener(Elements=true_button_13, SomeProperty=True)  # -> Values, Indices
values_94 = ValueListener(Elements=filepicker_5, SomeProperty=True)  # -> Values, Indices
freeze_gate_24 = StreamFreezeGate(Data=values_92.Values, PassingSwitch=invert(values_92.Values))
bool_18 = Boolean(values_94.Values)
create_window_modal = RemoteSender(values_93.Values)
panel_87 = Panel(values_93.Values)
loaded_windows_file = RemoteSender(values_94.Values)
bool_19 = Boolean(invert(freeze_gate_24))
null_13 = NullItem(Item=bool_18)  # -> NullFlags, InvalidFlags, Description
tap_13 = TapBuffer(Reset=False, Incremental=True, Valve=bool_19, Hold=True)
dam_13 = DataDam(DataA=tap_13, BufferDelay=2500000, BufferMode=2)
hideshow_16 = HideShowElement(ElementToHideShow=button_23, Show=null_13.NullFlags, Collapse=True, Disable=False)
equals_17 = Equality(FirstNumber=tap_13, SecondNumber=dam_13)  # -> Equality, Inequality
entwine_87 = Entwine(Branch00=filepicker_5, Branch01=button_23, FlattenInputs=True)  # -> flatten(Result)
stack_53 = CreateStack(UIElements=entwine_87, Horizontal=True)
adjustpos_64 = AdjustElementPositioning(
    ElementsToAdjust=filepicker_5,
    AbsolutePositioning=False,
    Width=Slider(180, range=0..300),
    Height=Slider(32, range=0..300),
    HorizontalAlignment=0)
adjustpos_65 = AdjustElementPositioning(ElementsToAdjust=button_23, AbsolutePositioning=False, Height=Slider(32, range=0..300), HorizontalAlignment=0)
adjustpos_66 = AdjustElementPositioning(ElementsToAdjust=true_button_13, AbsolutePositioning=False, HorizontalAlignment=0)

# ----
# Window database launch
open_window_database_2 = RemoteReceiver(open_window_database)
rec_5 = DataRecorder(open_window_database_2, DataLimit=-2, RecordData=True)
ma_4 = MassAddition(Input=rec_5)  # -> Result, PartialResults
entwine_88 = Entwine(Branch00=ma_4.Result, Branch01=window_database, FlattenInputs=True)
rec_6 = DataRecorder(entwine_88, DataLimit=2, RecordData=True)
item_8 = ListItem(List=rec_6, Index=0, Wrap=True)  # -> Item2, Item1, Item
equals_18 = Equality(FirstNumber=item_8.Item2, SecondNumber=item_8.Item1)  # -> Equality, Inequality
bang_3 = ExplodeTree(Data=equals_18.Inequality)  # -> Branch0, Branch1
py3_15 = Python3Script(x=bang_3.Branch0, y=bang_3.Branch1)  # -> a; same code as py3_10
event_17 = EventGate(Data=py3_15)  # -> Data, IsNew
freeze_gate_25 = StreamFreezeGate(Data=py3_15, PassingSwitch=event_17.IsNew)
event_18 = EventGate(Data=freeze_gate_25)  # -> Data, IsNew
panel_88 = Panel(event_18.Data)
database_modal_location_4 = RemoteReceiver(database_modal_location)
accent_colors_8 = ValueList({"Amber", "Blue", "Brown", "Cobalt", "Crimson", "Cyan", "Emerald", "Green", "Indigo", "Lime", "Magenta", "Mauve", "Olive", "Orange", "Pink", "Purple", "Red", "Sienna", "Steel", "Taupe", "Teal", "Violet", "Yellow"}, selected="Blue")
launchwin_9 = LaunchWindow(
    Show=event_18.Data,
    Name="Window database",
    Width=Slider(360, range=0..1000),
    Height=Slider(540, range=0..1000),
    ChildStatus=2,
    EnableHorizScroll=False)
winstat_5 = WindowStatus(Window=launchwin_9)
winprops_9 = SetWindowProperties(
    Window=launchwin_9,
    StartingLocation=database_modal_location_4,
    Theme=0,
    AccentColor=accent_colors_8,
    ShowTitleBar=True,
    BackgroundColor=RGB(255, 255, 255),
    ScaleFactor=1)
window_database_status = RemoteSender(winstat_5)

window_database_status_2 = RemoteReceiver(window_database_status)
expression_49 = Expression(x="Hidden", y=window_database_status_2, Expression="x=y")
expire_3 = ExpireObject(ObjectToExpire=objbynn_3, Expire=expression_49)

# ---- group: Building occupancy and systems
# Define construction
# # Define program and construction
# To be added...
# 
# ## Instructions
# To be added...
# 
# ## Inputs
# - ...
# 
# ## Outputs
# - ...
# 
# ## Interpretation
# To be added...
number_slider_34 = Slider(100, range=0..200)

# ----
window_database_status_3 = RemoteReceiver(window_database_status)
expression_50 = Expression(x="Normal", y=window_database_status_3, Expression="x=y")
and_27 = GateAnd(A=equals_17.Inequality, B=expression_50)
event_19 = EventGate(Data=and_27)  # -> Data, IsNew
panel_89 = Panel(event_19.Data)
load_windows = RemoteSender(event_19.Data)

# ---- group: Prepare for analysis
# Assemble Honeybee model
# # Assemble Honeybee model
# This cluster takes input geometry and geometric information and generates a valid Honeybee model which can be used in the following analysis steps.
# 
# ## Instructions
# Enter the relevant inputs to generate the Honeybee model. Windows can either be created using an input geometry or through auto-generation using a window-to-wall ratio.
# 
# ### Room geometry
# Each 3D Brep entered represents one room or thermal zone in the building with no air exchange between them. The Breps should be closed and 3D to generate valid rooms. The room geometries should represent the inner boundary of the external walls
# 
# ### Adjacent geometry
# Geometry of adjacent buildings represented by a surface where they contact the room geometry. Adiabatic boundary condition will be assumed at the contact surface.
# 
# ### Windows/apertures
# Windows can either be defined through a list of 2D surfaces which intersect with the room 3D geometries, or be auto-generated through the list of numeric outputs.
# 
# ### Wall/roof thicknesses
# Wall and roof thicknesses are supplied to generate a shading geometry representing the external surface thickness
# 
# ### Louvers
# If all related inputs are entered, shading louvers will be generated on each window according to the entered parameters.
# 
# ### Different directions
# All the above inputs will be the same for all rooms, however they can be optionally entered as a list which represents different values for different cardinal directions, in the order (N, E, S, W).
# 
# ## Inputs
# - `Model name` - text string representing the name of the analysis model
# - `Room geometry` - list of 3D closed Brep geometries representing each room/zone in the model
# - `Construction set` - text string representing the construction to be used for the rooms, can be retrieved using the HB Construction Set by Climate component
# - `Program` - Honeybee Program or list of which are applied to the rooms in the model. Can be defined using the HB Search Programs component
# - `Context geometry` - list of surrounding Brep geometries which shades the analysed Rooms
# - `Windows` - list of 2D Brep geometries which represent the openings in the building envelope. If not supplied, windows are instead generated through definition of window-to-wall ratios as defined below
# - `Skylights` - list of 2D Brep geometries which represent the openings in the building roof
# - `Window-to-wall ratio` - number representing the window-to-wall ratio on each exterior surface Used if no window geometries are supplied.
# - `Subdivide generated windows` - set to True if the window surface area should be divided into multiple windows on each exterior surface
# - `Window height` - number representing the target height of the auto-generated windows
# - `Sill height` - number representing how high the lower edge of the auto-generated windows should be from the room floor
# - `Horizontal separation` - number representing how far separated the auto-generated windows should be horizontally
# - `Vertical separation` - number representing if auto-generated windows should be split vertically and if so, what distance
# - `Wall thickness` - number representing the thickness of the exterior walls, used to generate shading geometry for windows
# - `Roof thickness` - number representing the thickness of the roof, used to generate shading geometry for skylights
# - `Louver depth` - number optionally representing the depth of louvers
# - `Number of louvers` - number optionally representing the amount of louvers on each window
# - `Distance between louvers ` - number optionally representing the distance between louvers on each window
# - `Louver angle` - number optionally representing if louvers should be tilted
# - `Vertical/horizontal louvers` - boolean, set to True if louvers should be vertical
# 
# ## Outputs
# - `Honeybee model` - valid Honeybee model for further analysis
# 
# ## Interpretation
# To be added...
savegeometry_9 = RemoteReceiver(savegeometry)
create_model_4 = RemoteReceiver(create_model_2)
savegeometry_10 = RemoteReceiver(savegeometry)
savegeometry_11 = RemoteReceiver(savegeometry)
create_model_5 = RemoteReceiver(create_model_2)
savegeometry_12 = RemoteReceiver(savegeometry)
create_model_6 = RemoteReceiver(create_model_2)
create_model_7 = RemoteReceiver(create_model_2)
distance_between_louvers_2 = RemoteReceiver(distance_between_louvers)
number_of_louvers_5 = RemoteReceiver(number_of_louvers)
louver_angle_2 = RemoteReceiver(louver_angle)
louver_depth_2 = RemoteReceiver(louver_depth)
or_17 = GateOr(A=savegeometry_9, B=create_model_4, C=Toggle(True))
or_18 = GateOr(A=savegeometry_10, B=create_model_5, C=Toggle(True))
or_19 = GateOr(A=savegeometry_11, B=create_model_6, C=Toggle(True))
or_20 = GateOr(A=savegeometry_12, B=create_model_7, C=Toggle(True))
bool_20 = Boolean(number_of_louvers_5)
gate_16 = StreamGate(Stream="Heath geometry type", Gate=or_17)  # -> Target0, Target1
gate_17 = StreamGate(Stream="Heath geometry type", Gate=or_18)  # -> Target0, Target1
gate_18 = StreamGate(Stream="Heath geometry type", Gate=or_19)  # -> Target0, Target1
gate_19 = StreamGate(Stream="Heath geometry type", Gate=or_20)  # -> Target0, Target1
filter_13 = StreamFilter(Gate=bool_20, Stream0="0", Stream1=louver_angle_2)
filter_14 = StreamFilter(Gate=bool_20, Stream0="0", Stream1=distance_between_louvers_2)
filter_15 = StreamFilter(Gate=bool_20, Stream0="0", Stream1=louver_depth_2)
refkv_5 = ReferenceByKeyValue(Key=gate_16.Target1, Val="Room", lightweight=False)
refkv_6 = ReferenceByKeyValue(Key=gate_17.Target1, Val="Adjacent", lightweight=False)
refkv_7 = ReferenceByKeyValue(Key=gate_18.Target1, Val="Context", lightweight=False, DisableAutoUpdate=True)
refkv_8 = ReferenceByKeyValue(Key=gate_19.Target1, Val="Window", lightweight=False)
generate_wwr_2 = RemoteReceiver(generate_wwr)
wall_thickness_2 = RemoteReceiver(wall_thickness)
roof_thickness_2 = RemoteReceiver(roof_thickness)
model_name_3 = RemoteReceiver(model_name)
create_model_8 = RemoteReceiver(create_model_2)
data_17 = Data(programtype)
adjacent = Geometry(refkv_6)
room = Geometry(refkv_5)
windows = Geometry(refkv_8)
context = Geometry(refkv_7)
number_slider_35 = Slider(0.3, range=0..1)
toggle_5 = BooleanToggle(True)
energy_system_name = Text()
show_honeybee_windows_3 = RemoteReceiver(show_honeybee_windows)
show_honeybee_context_3 = RemoteReceiver(show_honeybee_context)
show_honeybee_ground_3 = RemoteReceiver(show_honeybee_ground)
show_honeybee_doors_3 = RemoteReceiver(show_honeybee_doors)
show_honeybee_floors_3 = RemoteReceiver(show_honeybee_floors)
show_honeybee_walls_3 = RemoteReceiver(show_honeybee_walls)
show_honeybee_roof_3 = RemoteReceiver(show_honeybee_roof)

# ----
panel_90 = Panel(create_model_8)
multiplication = Multiplication(A=filter_15, B="0.01")

# ----
# Create material tooltip
panel_91 = Panel(":")

# ---- group: Prepare for analysis
vertical_separation = Number()
horizontal_separation = Number()
sill_height = Number(number_slider_35)
window_height = Number()
subdivide_generated_windows = Boolean(toggle_5)
louver_depth_3 = Number(multiplication)
number_of_louvers_6 = Number(number_of_louvers_5)
distance_between_louvers_3 = Number(filter_14)
vertical_horizontal_louvers = Boolean()
louver_angle_3 = Number(filter_13)

# ----
# Create construction tooltip
panel_92 = Panel(":")

# ----
# Create window tooltip
number_slider_36 = Slider(0, range=0..100)
dom_3 = ConstructDomain(DomainStart=number_slider_36, DomainEnd=Slider(12, range=0..100))
dom_4 = ConstructDomain(DomainStart=Slider(0, range=0..100), DomainEnd=Slider(1, range=0..100))

# ----
# Backend data inside layers
panel_93 = Panel("0, 0, 0")
path = DataPath(panel_93)
path_2 = DataPath("0, 0, 0")

# ---- group: Prepare for analysis (continued)
py3_16 = Python3Script(
    depth=louver_depth_3,
    count=number_of_louvers_6,
    dist=distance_between_louvers_3,
    angle=louver_angle_3,
    direction=vertical_horizontal_louvers)  # -> out, louver_settings
# ---------- py3_16: Python ----------
"""Create louver Settings"""
from heath import LouverSettings

louver_settings = LouverSettings(depth, int(count), dist, angle, direction)
# ---------- end py3_16 ----------

# ----
# Backend visible layers
panel_94 = Panel("1")
neg = Negative(Value=panel_94)
starting_layers = Slider(1, range=0..6)

# ----
# Database materials
# 1IN Stucco
# 5/8 in. Gypsum Board
# 5/8 in. Plywood
# 8IN Concrete HW
# Acoustic Ceiling
# Adiabatic Material
# Asphalt Pavement
# HW CONCRETE
# Metal Surface
# Adiabatic Roof
# Adiabatic Wall
# Asphalt Pavement
# Concrete Pavement
# Dry Dust
# Dry Sand
panel_95 = Panel("{0} (conductivity: {1}, density: {2}, specific heat: {3})")

# ----
# Create window
number_slider_37 = Slider(0.5, range=0..12)
textbox_2 = CreateTextBox(Label="Name", DefaultText="New window", UpdateButton=invert(True), showLabel=True)
button_24 = CreateButton(ButtonName="Create window", ButtonStyle=0)
textbox_3 = CreateTextBox(DefaultText=number_slider_37, UpdateButton=invert(True), showLabel=False)
label_33 = CreateLabel(LabelText="U-factor [W/m2-K]", LabelSize=12, Justification=0)
textbox_4 = CreateTextBox(DefaultText=Slider(0.3, range=0..1), UpdateButton=invert(True), showLabel=False)
label_34 = CreateLabel(LabelText="SHGC", LabelSize=12, Justification=0)
values_95 = ValueListener(Elements=textbox_2, SomeProperty=True)  # -> Values, Indices
values_96 = ValueListener(Elements=button_24, SomeProperty=True)  # -> Values, Indices
values_97 = ValueListener(Elements=textbox_3, SomeProperty=True)  # -> Values, Indices
values_98 = ValueListener(Elements=textbox_4, SomeProperty=True)  # -> Values, Indices
create_window_name = RemoteSender(values_95.Values)
panel_96 = Panel(values_95.Values)
create_window_u_factor = RemoteSender(values_97.Values)
freeze_gate_26 = StreamFreezeGate(Data=values_96.Values, PassingSwitch=invert(values_96.Values))
create_window_shgc = RemoteSender(values_98.Values)
entwine_89 = Entwine(Branch00=label_33, Branch01=textbox_3, FlattenInputs=True)  # -> flatten(Result)
entwine_90 = Entwine(Branch00=label_34, Branch01=textbox_4, FlattenInputs=True)  # -> flatten(Result)
bool_21 = Boolean(invert(freeze_gate_26))
stack_54 = CreateStack(UIElements=entwine_89, Horizontal=True)
tap_14 = TapBuffer(Reset=False, Incremental=True, Valve=bool_21, Hold=True)
stack_55 = CreateStack(UIElements=entwine_90, Horizontal=True)
create_window_modal_2 = RemoteReceiver(create_window_modal)
dam_14 = DataDam(DataA=tap_14, BufferDelay=2500000, BufferMode=2)
equals_19 = Equality(FirstNumber=tap_14, SecondNumber=dam_14)  # -> Equality, Inequality
and_28 = GateAnd(A=equals_19.Inequality, B=create_window_modal_2)
event_20 = EventGate(Data=and_28)  # -> Data, IsNew
create_window = RemoteSender(event_20.Data)
adjustpos_67 = AdjustElementPositioning(ElementsToAdjust=textbox_2, AbsolutePositioning=False, Width=Slider(200, range=0..300), HorizontalAlignment=0)
adjustpos_68 = AdjustElementPositioning(
    ElementsToAdjust=[label_34, label_33],
    AbsolutePositioning=False,
    Width=Slider(150, range=0..300),
    HorizontalAlignment=0,
    VerticalAlignment=2)
adjustpos_69 = AdjustElementPositioning(
    ElementsToAdjust=[textbox_4, textbox_3],
    AbsolutePositioning=False,
    Width=Slider(50, range=0..300),
    HorizontalAlignment=0,
    VerticalAlignment=2)
adjustpos_70 = AdjustElementPositioning(ElementsToAdjust=button_24, Margin="0, 10, 0, 0", AbsolutePositioning=False, HorizontalAlignment=1, VerticalAlignment=2)

pre_create_window = RemoteSender(values_96.Values)
create_window_2 = RemoteReceiver(create_window)

# ----
# Create window
create_window_u_factor_2 = RemoteReceiver(create_window_u_factor)
create_window_name_2 = RemoteReceiver(create_window_name)
create_window_shgc_2 = RemoteReceiver(create_window_shgc)
windowmat = HBWindowMaterial(name=create_window_name_2, u_factor=create_window_u_factor_2, shgc=create_window_shgc_2)  # -> out, mat; plug-in component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
create_window_error = RemoteSender(windowmat.out)

panel_97 = Panel(windowmat.mat)
gate_20 = StreamGate(Stream=windowmat.mat, Gate=create_window_2)  # -> Target0, Target1
getdocumentusertext = Python3Script(run=create_window_2, key="windows")  # -> json_string
# ---------- getdocumentusertext: Python ----------
import Rhino
import rhinoscriptsyntax as rs
import scriptcontext as sc

if run:
    sc.doc = Rhino.RhinoDoc.ActiveDoc

    json_string = rs.GetDocumentUserText(key)

    sc.doc = ghdoc
# ---------- end getdocumentusertext ----------
objtostr = HBObjectToString(hb_obj=gate_20.Target1)  # -> hb_str; plug-in component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
entwine_91 = Entwine(Branch00=getdocumentusertext, Branch01=objtostr, FlattenInputs=True)  # -> flatten(Result)
freeze_gate_27 = StreamFreezeGate(Data=entwine_91, PassingSwitch=create_window_2, Freeze=False, Hold=False)
join = TextJoin(Text=freeze_gate_27, Join="|")
setdocumentusertext = Python3Script(key="windows", value=join)  # -> out, done
# ---------- setdocumentusertext: Python ----------
import Rhino
import rhinoscriptsyntax as rs
import scriptcontext as sc

if value:
    sc.doc = Rhino.RhinoDoc.ActiveDoc

    done = rs.SetDocumentUserText(key, value)

    sc.doc = ghdoc
# ---------- end setdocumentusertext ----------
getdocumentusertext_2 = Python3Script(run=setdocumentusertext.done, key="windows")  # -> json_string; same code as getdocumentusertext
split_2 = TextSplit(Text=getdocumentusertext_2, Separators="|")
strtoobj = HBStringToObject(hb_str=split_2)  # -> hb_obj; plug-in component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
hold_2 = HoldingGate(Data=strtoobj)

# ----
# Created windows database
ipy2 = IronPython2Script(windows=hold_2)  # -> unique_windows; inputs windows: list
# ---------- ipy2: IronPython ----------
"""Grasshopper Script"""

unique_windows = []

for i in range(len(windows)):
    if windows[i] not in unique_windows:
        unique_windows.append(windows[i])
# ---------- end ipy2 ----------
clean = CleanTree(RemoveNulls=True, RemoveInvalid=True, RemoveEmpty=False, Tree=ipy2)
created_windows_database = RemoteSender(clean)

created_windows_database_2 = RemoteReceiver(created_windows_database)
decnstrmat = HBDeconstructMaterial(mat=created_windows_database_2)  # -> values, attr_names, r_val_si, r_val_ip; plug-in component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
item_9 = ListItem(List=decnstrmat.values, Index=Slider(1, range=1..2), Wrap=True)
item_10 = ListItem(List=decnstrmat.values, Index=number_slider_5, Wrap=True)
entwine_92 = Entwine(Branch00=generic_u_value, Branch01=item_9, FlattenInputs=True)  # -> flatten(Result)
entwine_93 = Entwine(Branch00=generic_shgc, Branch01=item_10, FlattenInputs=True)  # -> flatten(Result)
item_11 = ListItem(List=decnstrmat.values, Index=0, Wrap=True)  # -> flatten(Item)
clean_2 = CleanTree(RemoveNulls=True, RemoveInvalid=True, RemoveEmpty=False, Tree=item_11)
clean_3 = CleanTree(RemoveNulls=True, RemoveInvalid=True, RemoveEmpty=False, Tree=entwine_93)
clean_4 = CleanTree(RemoveNulls=True, RemoveInvalid=True, RemoveEmpty=False, Tree=entwine_92)
num_3 = Number(clean_3)
num_4 = Number(clean_4)
entwine_94 = Entwine(Branch00="Generic", Branch01=clean_2, FlattenInputs=True)  # -> flatten(Result)
expression_51 = Expression(x=num_3, Expression="Round(x, 2)")
expression_52 = Expression(x=num_4, Expression="Round(x, 2)")
create_window_names = RemoteSender(entwine_94)
format_5 = Format(Format="{0} (U-value: {1}, SHGC: {2})", Culture=127, Data0=entwine_94, Data1=expression_52, Data2=expression_51)
panel_98 = Panel(format_5)

create_window_full_names = RemoteSender(format_5)

# ---- group: Building occupancy and systems (continued)
created_windows_database_3 = RemoteReceiver(created_windows_database)
entwine_95 = Entwine(Branch00="Generic", Branch01=created_windows_database_3, FlattenInputs=True)  # -> flatten(Result)
item_12 = ListItem(List=entwine_95, Index=subset_subface_window_3, Wrap=True)
expression_53 = Expression(x="Generic", y=item_12, Expression="x=y")
filter_16 = StreamFilter(Gate=expression_53, Stream0=item_12, Stream1=null_3)
windowconstr_2 = HBWindowConstruction(materials=filter_16)  # -> constr; plug-in component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
cluster_4 = Cluster_2(window_construction=windowconstr_2, gwp_a1_a3="2.5", gwp_a4="0.042", density_kg_m2="38.2")
subfacesubset_2 = HBSubfaceSubset(window=cluster_4, skylight=cluster_3)  # -> subface_set; plug-in component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

# ----
create_window_names_2 = RemoteReceiver(create_window_names)
create_window_name_3 = RemoteReceiver(create_window_name)
create_window_error_2 = RemoteReceiver(create_window_error)
create_window_u_factor_3 = RemoteReceiver(create_window_u_factor)
create_window_shgc_3 = RemoteReceiver(create_window_shgc)
expression_54 = Expression(x=create_window_names_2, y=create_window_name_3, Expression="x=y")
len_2 = TextLength(Text=create_window_error_2)
inc = Includes(Value=create_window_shgc_3, Domain=dom_4)  # -> Includes, Deviation
inc_2 = Includes(Value=create_window_u_factor_3, Domain=dom_3)  # -> Includes, Deviation
cull_3 = CullPattern(List=expression_54, CullPattern=expression_54)
bool_22 = Boolean(len_2)
gate_21 = StreamGate(Stream="U-factor has to to between 0 and 12", Gate=inc_2.Includes)  # -> Target0, Target1
gate_22 = StreamGate(Stream="Window name contains no valid characters", Gate=bool_22)  # -> Target0, Target1
gate_23 = StreamGate(Stream="Window already exists", Gate=cull_3)  # -> Target0, Target1
gate_24 = StreamGate(Stream="SHGC has to to between 0 and 1", Gate=inc.Includes)  # -> Target0, Target1
entwine_96 = Entwine(
    Branch00=gate_21.Target0,
    Branch01=gate_24.Target0,
    Branch02=gate_22.Target1,
    Branch03=gate_23.Target1,
    FlattenInputs=True)  # -> flatten(Result)
item_13 = ListItem(List=entwine_96, Index=0, Wrap=True)
create_window_error_message = RemoteSender(item_13)

create_window_error_message_2 = RemoteReceiver(create_window_error_message)
null_14 = NullItem(Item=create_window_error_message_2)  # -> NullFlags, InvalidFlags, Description
filter_17 = StreamFilter(Gate=null_14.NullFlags, Stream0=create_window_error_message_2, Stream1=" ")
filter_18 = StreamFilter(Gate=null_14.NullFlags, Stream0=Slider(500, range=0..1000), Stream1=Slider(1000000, range=0..1000000))
hideshow_17 = HideShowElement(ElementToHideShow=button_24, Show=True, Collapse=True, Disable=invert(null_14.NullFlags))
tooltip_10 = AttachTooltipToElement(ElementsToAttachTo=button_24, TooltipContent=filter_17, ShowDelay=filter_18, Duration=2000)

panel_99 = Panel(clean)

setlist_3 = SetListContents(ListToModify=pulldown_17, NewListContents=format_5, SelectedIndex="0")
setlist_4 = SetListContents(ListToModify=pulldown_16, NewListContents=format_5, SelectedIndex="0")

create_window_full_names_2 = RemoteReceiver(create_window_full_names)
cull_i = CullIndex(List=create_window_full_names_2, Indices="0", Wrap=invert(True))
lng_8 = ListLength(List=cull_i)
concat = Concatenate(FragmentA="- ", FragmentB=cull_i)
repeat_3 = RepeatData(Data="X", Length=lng_8)
tb_15 = CreateTextBlock(Text=concat, TextSize=12, Justification=0)
button_25 = CreateButton(ButtonName=repeat_3, ButtonStyle=3)
adjustpos_71 = AdjustElementPositioning(
    ElementsToAdjust=tb_15,
    Margin="0, 10, 0, 0",
    AbsolutePositioning=False,
    Width=Slider(275, range=0..300),
    Height=Slider(29, range=0..300),
    HorizontalAlignment=0,
    VerticalAlignment=1)
adjustpos_72 = AdjustElementPositioning(
    ElementsToAdjust=button_25,
    AbsolutePositioning=False,
    Width=Slider(26, range=0..300),
    Height=Slider(26, range=0..300),
    HorizontalAlignment=1,
    VerticalAlignment=1)
adjustelem_9 = AdjustElementAppearance(ElementsToAdjust=button_25, Foreground=ColourSwatch(SwatchColor=RGB(255, 0, 0)), FontSize=Slider(12, range=0..50))

values_99 = ValueListener(Elements=button_25, SomeProperty=True)  # -> flatten(Values), Indices
cull_4 = CullPattern(List=values_99.Values, CullPattern=values_99.Values)
lng_9 = ListLength(List=cull_4)
filter_19 = StreamFilter(Gate=lng_9, Stream0="False", Stream1=cull_4)
freeze_gate_28 = StreamFreezeGate(Data=filter_19, PassingSwitch=invert(filter_19))
bool_23 = Boolean(invert(freeze_gate_28))
tap_15 = TapBuffer(Reset=False, Incremental=True, Valve=bool_23, Hold=True)
pre_window_database_remove_window = RemoteSender(values_99.Values)
dam_15 = DataDam(DataA=tap_15, BufferDelay=2500000, BufferMode=2)
equals_20 = Equality(FirstNumber=tap_15, SecondNumber=dam_15)  # -> Equality, Inequality
event_21 = EventGate(Data=equals_20.Inequality)  # -> Data, IsNew
suirify = Suirify(tb_15)
suirify_2 = Suirify(button_25)

merge_7 = Merge(Data1=graft(suirify), Data2=graft(suirify_2))
stack_56 = CreateStack(UIElements=merge_7, Horizontal=True)  # -> flatten(Stack)

window_database_remove_window = RemoteSender(event_21.Data)
adjustpos_73 = AdjustElementPositioning(ElementsToAdjust=stack_56, Margin="5, 0, 0, 0", AbsolutePositioning=False, HorizontalAlignment=0)

entwine_97 = Entwine(Branch00=true_button_13, Branch01=label_32, Branch02=stack_56, Branch03=stack_53, FlattenInputs=True)  # -> flatten(Result)
addelems_10 = AddElements(Window=launchwin_9, Elements=flatten(entwine_97), DoVLChecking=True)  # -> AddedElements, ElementNames
window_database_elements = RemoteSender(addelems_10.AddedElements)

window_database_remove_window_2 = RemoteReceiver(window_database_remove_window)
cset_2 = CreateSet(List=window_database_remove_window_2)  # -> Set, Map
getdocumentusertext_3 = Python3Script(run=window_database_remove_window_2, key="windows")  # -> json_string; same code as getdocumentusertext
cull_5 = CullPattern(List=cset_2.Set, CullPattern=cset_2.Set)
mindex = MemberIndex(Set=window_database_remove_window_2, Member=cull_5)  # -> Index, Count
split_3 = TextSplit(Text=getdocumentusertext_3, Separators="|")
cull_i_2 = CullIndex(List=split_3, Indices=mindex.Index, Wrap=True)
setdocumentusertext_2 = Python3Script(key="windows", value=cull_i_2)  # -> out, done; same code as setdocumentusertext

# ----
# Create material
number_slider_38 = Slider(0.036, range=0..2)
panel_100 = Panel("""Rough
Smooth""")
textbox_5 = CreateTextBox(Label="Name", DefaultText="New material", UpdateButton=invert(True), showLabel=True)
textbox_6 = CreateTextBox(DefaultText=number_slider_38, UpdateButton=invert(True), showLabel=False)
label_35 = CreateLabel(LabelText="Conductivity [W/m-K]", LabelSize=12, Justification=0)
textbox_7 = CreateTextBox(DefaultText=Slider(200, range=0..1000), UpdateButton=invert(True), showLabel=False)
textbox_8 = CreateTextBox(DefaultText=Slider(28, range=0..1000), UpdateButton=invert(True), showLabel=False)
button_26 = CreateButton(ButtonName="Create material", ButtonStyle=0)
textbox_9 = CreateTextBox(DefaultText=Slider(1500, range=0..10000), UpdateButton=invert(True), showLabel=False)
label_36 = CreateLabel(LabelText="Roughness", LabelSize=12, Justification=0)
label_37 = CreateLabel(LabelText="Specific heat [J/kg-K]", LabelSize=12, Justification=0)
label_38 = CreateLabel(LabelText="Absorption", LabelSize=12, Justification=0)
pulldown_24 = CreatePulldownMenu(ListItems=panel_100, showLabel=False)
label_39 = CreateLabel(LabelText="Density [kg/m3]", LabelSize=12, Justification=0)
values_100 = ValueListener(Elements=textbox_5, SomeProperty=True)  # -> Values, Indices
values_101 = ValueListener(Elements=textbox_6, SomeProperty=True)  # -> Values, Indices
values_102 = ValueListener(Elements=button_26, SomeProperty=True)  # -> Values, Indices
values_103 = ValueListener(Elements=pulldown_24, SomeProperty=True)  # -> Values, Indices
values_104 = ValueListener(Elements=textbox_7, SomeProperty=True)  # -> Values, Indices
values_105 = ValueListener(Elements=textbox_8, SomeProperty=True)  # -> Values, Indices
values_106 = ValueListener(Elements=textbox_9, SomeProperty=True)  # -> Values, Indices
panel_101 = Panel(values_100.Values)
create_material_name = RemoteSender(values_100.Values)
create_material_conductivity = RemoteSender(values_101.Values)
freeze_gate_29 = StreamFreezeGate(Data=values_102.Values, PassingSwitch=invert(values_102.Values))
create_material_density = RemoteSender(values_105.Values)
create_material_sprecific_heat = RemoteSender(values_106.Values)
entwine_98 = Entwine(Branch00=label_35, Branch01=textbox_6, FlattenInputs=True)  # -> flatten(Result)
entwine_99 = Entwine(Branch00=label_38, Branch01=textbox_7, FlattenInputs=True)  # -> flatten(Result)
entwine_100 = Entwine(Branch00=label_36, Branch01=pulldown_24, FlattenInputs=True)  # -> flatten(Result)
entwine_101 = Entwine(Branch00=label_37, Branch01=textbox_9, FlattenInputs=True)  # -> flatten(Result)
entwine_102 = Entwine(Branch00=label_39, Branch01=textbox_8, FlattenInputs=True)  # -> flatten(Result)
bool_24 = Boolean(invert(freeze_gate_29))
stack_57 = CreateStack(UIElements=entwine_98, Horizontal=True)
stack_58 = CreateStack(UIElements=entwine_101, Horizontal=True)
stack_59 = CreateStack(UIElements=entwine_102, Horizontal=True)
tap_16 = TapBuffer(Reset=False, Incremental=True, Valve=bool_24, Hold=True)
create_material_modal_2 = RemoteReceiver(create_material_modal)
dam_16 = DataDam(DataA=tap_16, BufferDelay=2500000, BufferMode=2)
equals_21 = Equality(FirstNumber=tap_16, SecondNumber=dam_16)  # -> Equality, Inequality
and_29 = GateAnd(A=equals_21.Inequality, B=create_material_modal_2)
event_22 = EventGate(Data=and_29)  # -> Data, IsNew
create_material = RemoteSender(event_22.Data)
adjustpos_74 = AdjustElementPositioning(ElementsToAdjust=textbox_5, AbsolutePositioning=False, Width=Slider(200, range=0..300), HorizontalAlignment=0)
adjustpos_75 = AdjustElementPositioning(
    ElementsToAdjust=[label_38, label_36, label_37, label_39, label_35],
    AbsolutePositioning=False,
    Width=Slider(150, range=0..300),
    HorizontalAlignment=0,
    VerticalAlignment=2)
adjustpos_76 = AdjustElementPositioning(
    ElementsToAdjust=[textbox_7, pulldown_24, textbox_9, textbox_8, textbox_6],
    AbsolutePositioning=False,
    Width=Slider(50, range=0..300),
    HorizontalAlignment=0,
    VerticalAlignment=2)
adjustpos_77 = AdjustElementPositioning(ElementsToAdjust=button_26, Margin="0, 10, 0, 0", AbsolutePositioning=False, HorizontalAlignment=1, VerticalAlignment=2)

# ----
# Create material
create_material_sprecific_heat_2 = RemoteReceiver(create_material_sprecific_heat)
create_material_conductivity_2 = RemoteReceiver(create_material_conductivity)
create_material_density_2 = RemoteReceiver(create_material_density)
create_material_name_2 = RemoteReceiver(create_material_name)
opaquemat_2 = HBOpaqueMaterial(
    name=create_material_name_2,
    thickness="inf",
    conductivity=create_material_conductivity_2,
    density=create_material_density_2,
    spec_heat=create_material_sprecific_heat_2)  # -> out, mat; plug-in component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
create_material_2 = RemoteReceiver(create_material)
panel_102 = Panel(create_material_2)
create_material_error = RemoteSender(opaquemat_2.out)
freeze_gate_30 = StreamFreezeGate(Data=opaquemat_2.mat, PassingSwitch=create_material_2, Freeze=True)

# ----
# Roughness
stack_60 = CreateStack(UIElements=entwine_100, Horizontal=True)
data_18 = Data()

# ----
# Absorption
stack_61 = CreateStack(UIElements=entwine_99, Horizontal=True)
data_19 = Data()

# ----
# Created materials database
rec_7 = DataRecorder(freeze_gate_30, DataLimit=-10, RecordData=True)
ipy2_2 = IronPython2Script(materials=rec_7)  # -> unique_materials; inputs materials: list
# ---------- ipy2_2: IronPython ----------
"""Grasshopper Script"""

unique_materials = []

for i in range(len(materials)):
    if materials[i] not in unique_materials:
        unique_materials.append(materials[i])
# ---------- end ipy2_2 ----------
clean_5 = CleanTree(RemoveNulls=True, RemoveInvalid=True, RemoveEmpty=False, Tree=ipy2_2)
created_materials_database = RemoteSender(clean_5)

created_materials_database_2 = RemoteReceiver(created_materials_database)
panel_103 = Panel(created_materials_database_2)
decnstrmat_2 = HBDeconstructMaterial(mat=created_materials_database_2)  # -> values, attr_names, r_val_si, r_val_ip; plug-in component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
item_14 = ListItem(List=decnstrmat_2.values, Index=0, Wrap=True)  # -> flatten(Item), flatten(Item1), flatten(Item2), flatten(Item3), flatten(Item4)
clean_6 = CleanTree(RemoveNulls=True, RemoveInvalid=True, RemoveEmpty=False, Tree=item_14.Item)
clean_7 = CleanTree(RemoveNulls=True, RemoveInvalid=True, RemoveEmpty=False, Tree=item_14.Item2)
clean_8 = CleanTree(RemoveNulls=True, RemoveInvalid=True, RemoveEmpty=False, Tree=item_14.Item3)
clean_9 = CleanTree(RemoveNulls=True, RemoveInvalid=True, RemoveEmpty=False, Tree=item_14.Item4)
lng_10 = ListLength(List=clean_6)
num_5 = Number(clean_7)
num_6 = Number(clean_8)
num_7 = Number(clean_9)
create_material_names = RemoteSender(clean_6)
expression_55 = Expression(x=num_5, Expression="Round(x, 3)")
expression_56 = Expression(x=num_7, Expression="Round(x, 3)")
expression_57 = Expression(x=num_6, Expression="Round(x, 3)")
bool_25 = Boolean(lng_10)
gate_25 = StreamGate(Stream=panel_95, Gate=bool_25)  # -> Target0, Target1
format_6 = Format(Format=gate_25.Target1, Culture=127, Data0=clean_6, Data1=expression_55, Data2=expression_57, Data3=expression_56)
database_materials = RemoteSender(format_6)

create_material_error_2 = RemoteReceiver(create_material_error)
split_4 = TextSplit(Text=create_material_error_2, Separators=panel_91)
trim = TextTrim(Text=split_4, Start=True, End=True)
item_15 = ListItem(List=trim, Index=0, Wrap=True)  # -> Item, Item1
create_material_names_2 = RemoteReceiver(create_material_names)
create_material_name_3 = RemoteReceiver(create_material_name)
lng_11 = ListLength(List=split_4)
len_3 = TextLength(Text=item_15.Item1)
larger = LargerThan(FirstNumber=lng_11, SecondNumber="1")  # -> LargerThan, OrEqualTo
subtraction_4 = Subtraction(A=len_3, B=Slider(11, range=0..20))
expression_58 = Expression(x=create_material_names_2, y=create_material_name_3, Expression="x=y")
fragment_2 = TextFragment(Text=item_15.Item1, Start="0", Count=subtraction_4)
cull_6 = CullPattern(List=expression_58, CullPattern=expression_58)
filter_20 = StreamFilter(Gate=larger.LargerThan, Stream0=create_material_error_2, Stream1=fragment_2)
gate_26 = StreamGate(Stream="Material already exists", Gate=cull_6)  # -> Target0, Target1
entwine_103 = Entwine(Branch00=filter_20, Branch01=gate_26.Target1, FlattenInputs=True)  # -> flatten(Result)
item_16 = ListItem(List=entwine_103, Index=0, Wrap=True)
create_material_error_message = RemoteSender(item_16)

panel_104 = Panel(create_material_error_2)

create_material_error_message_2 = RemoteReceiver(create_material_error_message)
null_15 = NullItem(Item=create_material_error_message_2)  # -> NullFlags, InvalidFlags, Description
filter_21 = StreamFilter(Gate=null_15.NullFlags, Stream0=create_material_error_message_2, Stream1=" ")
filter_22 = StreamFilter(Gate=null_15.NullFlags, Stream0=Slider(500, range=0..1000), Stream1=Slider(1000000, range=0..1000000))
hideshow_18 = HideShowElement(ElementToHideShow=button_26, Show=True, Collapse=True, Disable=invert(null_15.NullFlags))
tooltip_11 = AttachTooltipToElement(ElementsToAttachTo=button_26, TooltipContent=filter_21, ShowDelay=filter_22, Duration=Slider(5000, range=0..10000))

created_materials_database_3 = RemoteReceiver(created_materials_database)
panel_105 = Panel(clean_5)

# ----
# Create construction
panel_106 = Panel("""Layer 1
Layer 2
Layer 3
Layer 4
Layer 5
Layer 6""")
lng_12 = ListLength(List=panel_106)
subtraction_5 = Subtraction(A=lng_12, B="1")
database_materials_2 = RemoteReceiver(database_materials)
repeat_4 = RepeatData(Data="Material", Length=lng_12)
empty_10 = EmptyObjectToEmptyBranch()
repeat_5 = RepeatData(Data="Thickness [m]", Length=lng_12)
repeat_6 = RepeatData(Data="X", Length=lng_12)
repeat_7 = RepeatData(Data="⇕", Length=subtraction_5)
textbox_10 = CreateTextBox(Label="Name", DefaultText="New construction", UpdateButton=invert(True), showLabel=True)
button_27 = CreateButton(ButtonName=repeat_6, ButtonStyle=3)
textbox_11 = CreateTextBox(Label=repeat_5, DefaultText=Slider(0.25, range=0.01..1), UpdateButton=invert(True), showLabel=True)
label_40 = CreateLabel(LabelText=panel_106, LabelSize=18, Justification=0)
pulldown_25 = CreatePulldownMenu(Label=repeat_4, ListItems=empty_10, showLabel=True)
button_28 = CreateButton(ButtonName="+", ButtonStyle=3)
button_29 = CreateButton(ButtonName="Create construction", ButtonStyle=0)
button_30 = CreateButton(ButtonName=repeat_7, ButtonStyle=3)
values_107 = ValueListener(Elements=textbox_10, SomeProperty=True)  # -> Values, Indices
values_108 = ValueListener(Elements=button_27, SomeProperty=True)  # -> flatten(Values), Indices
cull_7 = CullPattern(List=values_108.Values, CullPattern=values_108.Values)
lng_13 = ListLength(List=cull_7)
filter_23 = StreamFilter(Gate=lng_13, Stream0="False", Stream1=cull_7)
values_109 = ValueListener(Elements=pulldown_25, SomeProperty=True)  # -> Values, Indices
values_110 = ValueListener(Elements=button_28, SomeProperty=True)  # -> Values, Indices
values_111 = ValueListener(Elements=button_30, SomeProperty=True)  # -> flatten(Values), Indices
cull_8 = CullPattern(List=values_111.Values, CullPattern=values_111.Values)
lng_14 = ListLength(List=cull_8)
filter_24 = StreamFilter(Gate=lng_14, Stream0="False", Stream1=cull_8)
values_112 = ValueListener(Elements=textbox_11, SomeProperty=True)  # -> Values, Indices
values_113 = ValueListener(Elements=button_29, SomeProperty=True)  # -> Values, Indices
freeze_gate_31 = StreamFreezeGate(Data=filter_24, PassingSwitch=invert(filter_24))
merge_8 = Merge(Data1=simplify(graft(label_40)), Data2=simplify(graft(button_27)))
merge_9 = Merge(Data1=simplify(graft(pulldown_25)), Data2=simplify(graft(textbox_11)))
create_construction_materials = RemoteSender(values_109.Indices)
create_construction_name = RemoteSender(values_107.Values)
panel_107 = Panel(values_107.Values)
freeze_gate_32 = StreamFreezeGate(Data=filter_23, PassingSwitch=invert(filter_23))
create_construction_thickness = RemoteSender(values_112.Values)
add_layer = RemoteSender(values_110.Values)
create_construction = RemoteSender(values_113.Values)
pre_switch_layer = RemoteSender(values_111.Values)
pre_remove_layer = RemoteSender(values_108.Values)
bool_26 = Boolean(invert(freeze_gate_31))
bool_27 = Boolean(invert(freeze_gate_32))
stack_62 = CreateStack(UIElements=merge_9, Horizontal=True)
stack_63 = CreateStack(UIElements=merge_8, Horizontal=True)
tap_17 = TapBuffer(Reset=False, Incremental=True, Valve=bool_26, Hold=True)
tap_18 = TapBuffer(Reset=False, Incremental=True, Valve=bool_27, Hold=True)
dam_17 = DataDam(DataA=tap_17, BufferDelay=2500000, BufferMode=2)
dam_18 = DataDam(DataA=tap_18, BufferDelay=2500000, BufferMode=2)
equals_22 = Equality(FirstNumber=tap_17, SecondNumber=dam_17)  # -> Equality, Inequality
equals_23 = Equality(FirstNumber=tap_18, SecondNumber=dam_18)  # -> Equality, Inequality
event_23 = EventGate(Data=equals_22.Inequality)  # -> Data, IsNew
event_24 = EventGate(Data=equals_23.Inequality)  # -> Data, IsNew
merge_10 = Merge(Data1=simplify(stack_63), Data2=simplify(stack_62), Data3=simplify(graft(button_30)))
entwine_104 = Entwine(Branch00=textbox_10, FlattenInputs=True)  # -> flatten(Result)
switch_layer = RemoteSender(event_23.Data)
remove_layer = RemoteSender(event_24.Data)
adjustpos_78 = AdjustElementPositioning(
    ElementsToAdjust=pulldown_25,
    AbsolutePositioning=False,
    Width=Slider(190, range=0..300),
    HorizontalAlignment=0,
    VerticalAlignment=2)
adjustpos_79 = AdjustElementPositioning(
    ElementsToAdjust=textbox_10,
    Margin="0, 0, 0, 5",
    AbsolutePositioning=False,
    Width=Slider(190, range=0..300),
    HorizontalAlignment=0)
adjustpos_80 = AdjustElementPositioning(
    ElementsToAdjust=textbox_11,
    Margin="0, 5, 0, 0",
    AbsolutePositioning=False,
    Width=Slider(120, range=0..300),
    HorizontalAlignment=0,
    VerticalAlignment=2)
adjustpos_81 = AdjustElementPositioning(
    ElementsToAdjust=button_30,
    Margin="5, 0, 0, 0",
    AbsolutePositioning=False,
    Width=Slider(26, range=0..300),
    Height=Slider(26, range=0..300),
    HorizontalAlignment=0,
    VerticalAlignment=2)
adjustelem_10 = AdjustElementAppearance(ElementsToAdjust=button_30, Foreground=ColourSwatch(SwatchColor=RGBA(38, 38, 38, 193)), FontSize=Slider(19, range=0..50))
adjustpos_82 = AdjustElementPositioning(
    ElementsToAdjust=button_27,
    AbsolutePositioning=False,
    Width=Slider(26, range=0..300),
    Height=Slider(26, range=0..300),
    HorizontalAlignment=0)
adjustpos_83 = AdjustElementPositioning(
    ElementsToAdjust=button_28,
    Margin="10, 5, 0, 0",
    AbsolutePositioning=False,
    Width=Slider(32, range=0..300),
    Height=Slider(32, range=0..300),
    HorizontalAlignment=0)
adjustelem_11 = AdjustElementAppearance(ElementsToAdjust=button_27, Foreground=ColourSwatch(SwatchColor=RGB(255, 0, 0)), FontSize=Slider(14, range=0..50))
adjustelem_12 = AdjustElementAppearance(ElementsToAdjust=button_28, Foreground=ColourSwatch(SwatchColor=RGB(15, 178, 0)), FontSize=Slider(21, range=0..50))
adjustpos_84 = AdjustElementPositioning(ElementsToAdjust=button_29, Margin="0, 10, 0, 0", AbsolutePositioning=False, HorizontalAlignment=1, VerticalAlignment=2)

pre_remove_layer_2 = RemoteReceiver(pre_remove_layer)
pre_switch_layer_2 = RemoteReceiver(pre_switch_layer)
create_construction_materials_2 = RemoteReceiver(flatten(create_construction_materials))
create_construction_thickness_2 = RemoteReceiver(flatten(create_construction_thickness))
cull_9 = CullPattern(List=pre_remove_layer_2, CullPattern=pre_remove_layer_2)
cull_10 = CullPattern(List=pre_switch_layer_2, CullPattern=pre_switch_layer_2)
add_layer_2 = RemoteReceiver(add_layer)
mindex_2 = MemberIndex(Set=pre_remove_layer_2, Member=cull_9)  # -> Index, Count
mindex_3 = MemberIndex(Set=pre_switch_layer_2, Member=cull_10)  # -> Index, Count
py3_17 = Python3Script(
    add_layer=add_layer_2,
    remove_layer=mindex_2.Index,
    switch_layer=mindex_3.Index,
    materials=create_construction_materials_2,
    thickness=create_construction_thickness_2)  # -> out_materials, out_thickness; inputs materials: list, thickness: list
# ---------- py3_17: Python ----------
def add_layers():
    thickness.append(0.25)
    out_thickness = thickness
    
def remove_layers():
    materials.pop(remove_layer)
    thickness.pop(remove_layer)

def switch_layers():
    temp_materials = materials[switch_layer]
    materials[switch_layer] = materials[switch_layer+1]
    materials[switch_layer+1] = temp_materials

    temp_thickness = thickness[switch_layer]
    thickness[switch_layer] = thickness[switch_layer+1]
    thickness[switch_layer+1] = temp_thickness
    

if add_layer:
    add_layers()

elif remove_layer is not None:
    remove_layers()
    out_materials = materials
    out_thickness = thickness

elif switch_layer is not None:
    switch_layers()
    out_materials = materials
    out_thickness = thickness
else:
    out_materials = None
    out_thickness = None
# ---------- end py3_17 ----------
branch = TreeBranch(Tree=py3_17.out_thickness, Path=path, MaintainPaths=True)
branch_2 = TreeBranch(Tree=py3_17.out_materials, Path=path_2, MaintainPaths=True)
lng_15 = ListLength(List=branch_2)
lng_16 = ListLength(List=branch)
bool_28 = Boolean(lng_16)
bool_29 = Boolean(lng_15)
gate_27 = StreamGate(Stream=branch, Gate=bool_28)  # -> Target0, Target1
gate_28 = StreamGate(Stream=branch_2, Gate=bool_29)  # -> Target0, Target1
hold_3 = HoldingGate(Data=gate_27.Target1)
hold_4 = HoldingGate(Data=gate_28.Target1)
hasdata_6 = DataExists(Data=hold_3)
hasdata_7 = DataExists(Data=hold_4)
timeshift = TimeShifter(Data=hold_3, Capacity="1")
timeshift_2 = TimeShifter(Data=hold_4, Capacity="1")
bool_30 = Boolean(hasdata_6)
bool_31 = Boolean(hasdata_7)
remove_layer_2 = RemoteReceiver(remove_layer)
switch_layer_2 = RemoteReceiver(switch_layer)
filter_25 = StreamFilter(Gate=bool_30, Stream0=timeshift, Stream1=hold_3)
filter_26 = StreamFilter(Gate=bool_31, Stream0=timeshift_2, Stream1=hold_4)
entwine_105 = Entwine(Branch00=filter_26, Branch01=filter_25, FlattenInputs=True)
or_21 = GateOr(A=switch_layer_2, B=remove_layer_2)
gate_29 = StreamGate(Stream=entwine_105, Gate=or_21)  # -> Target0, Target1
bang_4 = ExplodeTree(Data=gate_29.Target1)  # -> Branch0, Branch1

remove_layer_3 = RemoteReceiver(flatten(remove_layer))
add_layer_3 = RemoteReceiver(add_layer)
gate_30 = StreamGate(Stream=panel_94, Gate=add_layer_3)  # -> Target0, Target1
gate_31 = StreamGate(Stream=neg, Gate=remove_layer_3)  # -> Target0, Target1
rec_8 = DataRecorder([gate_30.Target1, gate_31.Target1], DataLimit=-10, RecordData=True)
py3_18 = Python3Script(numbers=[starting_layers, rec_8], maximum_layers=Slider(6, range=0..10))  # -> visible_layers_arrows, visible_layers; inputs numbers: list of Int32, maximum_layers: Int32
# ---------- py3_18: Python ----------
current_sum = 0

for number in numbers:
    if (number == 1) and (current_sum >= maximum_layers):
        continue
    if (number == -1) and (current_sum <= 1):
        continue
    else:
        current_sum += number

visible_layers = [True]*current_sum
visible_layers.extend([False]*(maximum_layers-current_sum))
visible_layers_arrows = visible_layers[1:]
# ---------- end py3_18 ----------
visible_layers_arrows = RemoteSender(py3_18.visible_layers_arrows)
visible_layers = RemoteSender(simplify(graft(py3_18.visible_layers)))

create_construction_thickness_3 = RemoteReceiver(create_construction_thickness)
create_construction_materials_3 = RemoteReceiver(create_construction_materials)
visible_layers_2 = RemoteReceiver(visible_layers)
item_17 = ListItem(List=created_materials_database_3, Index=create_construction_materials_3, Wrap=invert(True))

# ----
# Create construction
create_construction_name_2 = RemoteReceiver(create_construction_name)
repeat_8 = RepeatData(Data=create_construction_thickness_3, Length=visible_layers_2)  # -> flatten(Data)
repeat_9 = RepeatData(Data=item_17, Length=visible_layers_2)  # -> flatten(Data)
cluster_5 = Cluster(materials=repeat_9, construction_name=create_construction_name_2, thicknesses=repeat_8)  # -> error_2, construction_2
create_construction_2 = RemoteReceiver(create_construction)
panel_108 = Panel(create_construction_2)
create_construction_error = RemoteSender(cluster_5.error_2)
freeze_gate_33 = StreamFreezeGate(Data=cluster_5.construction_2, PassingSwitch=create_construction_2, Freeze=True)

create_construction_error_2 = RemoteReceiver(create_construction_error)
panel_109 = Panel(create_construction_error_2)
split_5 = TextSplit(Text=create_construction_error_2, Separators=panel_92)
trim_2 = TextTrim(Text=split_5, Start=True, End=True)
item_18 = ListItem(List=trim_2, Index=0, Wrap=True)  # -> Item, Item1
create_construction_name_3 = RemoteReceiver(create_construction_name)
lng_17 = ListLength(List=split_5)
len_4 = TextLength(Text=item_18.Item1)
larger_2 = LargerThan(FirstNumber=lng_17, SecondNumber="1")  # -> LargerThan, OrEqualTo
subtraction_6 = Subtraction(A=len_4, B=Slider(11, range=0..20))
fragment_3 = TextFragment(Text=item_18.Item1, Start="0", Count=subtraction_6)
filter_27 = StreamFilter(Gate=larger_2.LargerThan, Stream0=create_construction_error_2, Stream1=fragment_3)
panel_110 = Panel(filter_27)

setlist_5 = SetListContents(ListToModify=pulldown_25, NewListContents=database_materials_2, SelectedIndex=bang_4.Branch0)
settextbox = SetTextBoxContents(TextBoxToModify=textbox_11, NewTextBoxContents=bang_4.Branch1)
visible_layers_3 = RemoteReceiver(flatten(visible_layers))
visible_layers_arrows_2 = RemoteReceiver(visible_layers_arrows)
int = Integer(visible_layers_3)
ma_5 = MassAddition(Input=int)  # -> Result, PartialResults
hideshow_19 = HideShowElement(ElementToHideShow=button_30, Show=visible_layers_arrows_2, Collapse=True, Disable=False)
larger_3 = LargerThan(FirstNumber=ma_5.Result, SecondNumber="1")  # -> LargerThan, OrEqualTo
visible_layers_4 = RemoteReceiver(visible_layers)
filter_28 = StreamFilter(Gate=larger_3.LargerThan, Stream0=larger_3.LargerThan, Stream1=visible_layers_3)
hideshow_20 = HideShowElement(ElementToHideShow=stack_62, Show=visible_layers_4, Collapse=True, Disable=False)
hideshow_21 = HideShowElement(ElementToHideShow=label_40, Show=visible_layers_3, Collapse=True, Disable=False)
hideshow_22 = HideShowElement(ElementToHideShow=button_27, Show=filter_28, Collapse=True, Disable=False)

# ----
# Recursion
panel_111 = Panel("Window modal")
objbynn_4 = GetObjectByNickname(NickName=panel_111)
window_modal = Python3Script()  # -> status; same code as material_database

# ----
# Create window launch
create_window_modal_3 = RemoteReceiver(create_window_modal)
rec_9 = DataRecorder(create_window_modal_3, DataLimit=-2, RecordData=True)
ma_6 = MassAddition(Input=rec_9)  # -> Result, PartialResults
entwine_106 = Entwine(Branch00=ma_6.Result, Branch01=window_modal, FlattenInputs=True)
rec_10 = DataRecorder(entwine_106, DataLimit=2, RecordData=True)
item_19 = ListItem(List=rec_10, Index=0, Wrap=True)  # -> Item2, Item1, Item
equals_24 = Equality(FirstNumber=item_19.Item2, SecondNumber=item_19.Item1)  # -> Equality, Inequality
bang_5 = ExplodeTree(Data=equals_24.Inequality)  # -> Branch0, Branch1
py3_19 = Python3Script(x=bang_5.Branch0, y=bang_5.Branch1)  # -> a; same code as py3_10
event_25 = EventGate(Data=py3_19)  # -> Data, IsNew
freeze_gate_34 = StreamFreezeGate(Data=py3_19, PassingSwitch=event_25.IsNew)
event_26 = EventGate(Data=freeze_gate_34)  # -> Data, IsNew
panel_112 = Panel(event_26.Data)
entwine_107 = Entwine(Branch00=textbox_2, Branch01=stack_54, Branch02=stack_55, Branch03=button_24, FlattenInputs=True)  # -> flatten(Result)
launchwin_10 = LaunchWindow(
    Show=event_26.Data,
    Name="Create window",
    Width=Slider(235, range=0..1000),
    Height=Slider(200, range=0..1000),
    ChildStatus=2,
    EnableHorizScroll=False)
accent_colors_9 = ValueList({"Amber", "Blue", "Brown", "Cobalt", "Crimson", "Cyan", "Emerald", "Green", "Indigo", "Lime", "Magenta", "Mauve", "Olive", "Orange", "Pink", "Purple", "Red", "Sienna", "Steel", "Taupe", "Teal", "Violet", "Yellow"}, selected="Blue")
create_modal_location_2 = RemoteReceiver(create_modal_location)
winstat_6 = WindowStatus(Window=launchwin_10)
addelems_11 = AddElements(Window=launchwin_10, Elements=flatten(entwine_107), DoVLChecking=True)  # -> AddedElements, ElementNames
winprops_10 = SetWindowProperties(
    Window=launchwin_10,
    StartingLocation=create_modal_location_2,
    Theme=0,
    AccentColor=accent_colors_9,
    ShowTitleBar=True,
    BackgroundColor=RGB(255, 255, 255),
    ScaleFactor=1)
create_window_modal_status = RemoteSender(winstat_6)
window_elements = RemoteSender(addelems_11.AddedElements)

create_window_modal_status_2 = RemoteReceiver(create_window_modal_status)
expression_59 = Expression(x="Hidden", y=create_window_modal_status_2, Expression="x=y")
expire_4 = ExpireObject(ObjectToExpire=objbynn_4, Expire=expression_59)

# ----
# Recursion
panel_113 = Panel("Construction modal")
objbynn_5 = GetObjectByNickname(NickName=panel_113)
construction_modal = Python3Script()  # -> status; same code as material_database

# ----
# Create construction launch
create_construction_modal_2 = RemoteReceiver(create_construction_modal)
rec_11 = DataRecorder(create_construction_modal_2, DataLimit=-2, RecordData=True)
ma_7 = MassAddition(Input=rec_11)  # -> Result, PartialResults
entwine_108 = Entwine(Branch00=ma_7.Result, Branch01=construction_modal, FlattenInputs=True)
rec_12 = DataRecorder(entwine_108, DataLimit=2, RecordData=True)
item_20 = ListItem(List=rec_12, Index=0, Wrap=True)  # -> Item2, Item1, Item
equals_25 = Equality(FirstNumber=item_20.Item2, SecondNumber=item_20.Item1)  # -> Equality, Inequality
bang_6 = ExplodeTree(Data=equals_25.Inequality)  # -> Branch0, Branch1
py3_20 = Python3Script(x=bang_6.Branch0, y=bang_6.Branch1)  # -> a; same code as py3_10
event_27 = EventGate(Data=py3_20)  # -> Data, IsNew
freeze_gate_35 = StreamFreezeGate(Data=py3_20, PassingSwitch=event_27.IsNew)
event_28 = EventGate(Data=freeze_gate_35)  # -> Data, IsNew
entwine_109 = Entwine(Branch00=entwine_104, Branch01=merge_10, Branch02=button_28, Branch03=button_29, FlattenInputs=True)  # -> flatten(Result)
launchwin_11 = LaunchWindow(
    Show=event_28.Data,
    Name="Create construction",
    Width=Slider(360, range=0..1000),
    Height=Slider(540, range=0..1000),
    ChildStatus=2,
    EnableHorizScroll=False)
panel_114 = Panel(event_28.Data)
accent_colors_10 = ValueList({"Amber", "Blue", "Brown", "Cobalt", "Crimson", "Cyan", "Emerald", "Green", "Indigo", "Lime", "Magenta", "Mauve", "Olive", "Orange", "Pink", "Purple", "Red", "Sienna", "Steel", "Taupe", "Teal", "Violet", "Yellow"}, selected="Blue")
create_modal_location_3 = RemoteReceiver(create_modal_location)
heath_window_5 = RemoteReceiver(heath_window)
addelems_12 = AddElements(Window=launchwin_11, Elements=flatten(entwine_109), DoVLChecking=True)  # -> AddedElements, ElementNames
winstat_7 = WindowStatus(Window=launchwin_11)
winprops_11 = SetWindowProperties(
    Window=launchwin_11,
    StartingLocation=create_modal_location_3,
    Theme=0,
    AccentColor=accent_colors_10,
    ShowTitleBar=True,
    BackgroundColor=RGB(255, 255, 255),
    ScaleFactor=1)
childwin_3 = MakeChildWindow(ParentWindow=heath_window_5, ChildWindow=launchwin_11)
create_construction_modal_status = RemoteSender(winstat_7)
construction_elements = RemoteSender(addelems_12.AddedElements)

create_construction_modal_status_2 = RemoteReceiver(create_construction_modal_status)
expression_60 = Expression(x="Hidden", y=create_construction_modal_status_2, Expression="x=y")
expire_5 = ExpireObject(ObjectToExpire=objbynn_5, Expire=expression_60)

# ----
# Recursion
panel_115 = Panel("Material modal")
objbynn_6 = GetObjectByNickname(NickName=panel_115)
material_modal = Python3Script()  # -> status; same code as material_database

# ----
# Create material launch
create_material_modal_3 = RemoteReceiver(create_material_modal)
rec_13 = DataRecorder(create_material_modal_3, DataLimit=-2, RecordData=True)
ma_8 = MassAddition(Input=rec_13)  # -> Result, PartialResults
entwine_110 = Entwine(Branch00=ma_8.Result, Branch01=material_modal, FlattenInputs=True)
rec_14 = DataRecorder(entwine_110, DataLimit=2, RecordData=True)
item_21 = ListItem(List=rec_14, Index=0, Wrap=True)  # -> Item2, Item1, Item
equals_26 = Equality(FirstNumber=item_21.Item2, SecondNumber=item_21.Item1)  # -> Equality, Inequality
bang_7 = ExplodeTree(Data=equals_26.Inequality)  # -> Branch0, Branch1
py3_21 = Python3Script(x=bang_7.Branch0, y=bang_7.Branch1)  # -> a; same code as py3_10
event_29 = EventGate(Data=py3_21)  # -> Data, IsNew
freeze_gate_36 = StreamFreezeGate(Data=py3_21, PassingSwitch=event_29.IsNew)
event_30 = EventGate(Data=freeze_gate_36)  # -> Data, IsNew
entwine_111 = Entwine(Branch00=textbox_5, Branch01=stack_57, Branch02=stack_59, Branch03=stack_58, Branch04=button_26, FlattenInputs=True)  # -> flatten(Result)
launchwin_12 = LaunchWindow(
    Show=event_30.Data,
    Name="Create material",
    Width=Slider(235, range=0..1000),
    Height=Slider(235, range=0..1000),
    ChildStatus=2,
    EnableHorizScroll=False)
panel_116 = Panel(event_30.Data)
accent_colors_11 = ValueList({"Amber", "Blue", "Brown", "Cobalt", "Crimson", "Cyan", "Emerald", "Green", "Indigo", "Lime", "Magenta", "Mauve", "Olive", "Orange", "Pink", "Purple", "Red", "Sienna", "Steel", "Taupe", "Teal", "Violet", "Yellow"}, selected="Blue")
create_modal_location_4 = RemoteReceiver(create_modal_location)
addelems_13 = AddElements(Window=launchwin_12, Elements=flatten(entwine_111), DoVLChecking=True)  # -> AddedElements, ElementNames
winprops_12 = SetWindowProperties(
    Window=launchwin_12,
    StartingLocation=create_modal_location_4,
    Theme=0,
    AccentColor=accent_colors_11,
    ShowTitleBar=True,
    BackgroundColor=RGB(255, 255, 255),
    ScaleFactor=1)
winstat_8 = WindowStatus(Window=launchwin_12)
create_material_modal_status = RemoteSender(winstat_8)
material_elements = RemoteSender(addelems_13.AddedElements)

create_material_modal_status_2 = RemoteReceiver(create_material_modal_status)
expression_61 = Expression(x="Hidden", y=create_material_modal_status_2, Expression="x=y")
expire_6 = ExpireObject(ObjectToExpire=objbynn_6, Expire=expression_61)

# ----
# Bake model
panel_117 = Panel("""Heath::honeybee model::walls
Heath::honeybee model::roof
Heath::honeybee model::floors
Heath::honeybee model::ground
Heath::honeybee model::windows
Heath::honeybee model::doors
Heath::honeybee model::context""")
ef_layer_2 = EleFrontLayer(FullPath=panel_117)  # -> Layer, FullPath, Hidden, Locked, DisplayColour, MaterialName, Linetype, PrintColour, PrintWidth
ef_att_4 = EleFrontAttributes(Layer=ef_layer_2.Layer)  # -> graft(Attributes), Keys, Values, Name, Layer, ColourSource, DisplayColour, MaterialSource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
bake_model_2 = RemoteReceiver(bake_model)

# ----
# Created constructions database
rec_15 = DataRecorder(freeze_gate_33, DataLimit=-10, RecordData=True)
ipy2_3 = IronPython2Script(constructions=rec_15)  # -> unique_constructions; inputs constructions: list
# ---------- ipy2_3: IronPython ----------
"""Grasshopper Script"""

unique_constructions = []

for i in range(len(constructions)):
    if constructions[i] not in unique_constructions:
        unique_constructions.append(constructions[i])
# ---------- end ipy2_3 ----------
loaded_constructions_2 = RemoteReceiver(loaded_constructions)
clean_10 = CleanTree(RemoveNulls=True, RemoveInvalid=True, RemoveEmpty=False, Tree=ipy2_3)
created_constructions_database = RemoteSender(clean_10)

clean_11 = CleanTree(RemoveNulls=True, RemoveInvalid=True, RemoveEmpty=False, Tree=loaded_constructions_2)

entwine_112 = Entwine(Branch00=clean_10, Branch01=clean_11, FlattenInputs=True)  # -> flatten(Result)

ipy2_4 = IronPython2Script(constructions=entwine_112)  # -> unique_constructions, overlap; inputs constructions: list
# ---------- ipy2_4: IronPython ----------
"""Grasshopper Script"""

unique_constructions = []
overlap = False

for i in range(len(constructions)):
    if constructions[i] not in unique_constructions:
        unique_constructions.append(constructions[i])
    else:
        overlap = True
# ---------- end ipy2_4 ----------
panel_118 = Panel(entwine_112)

all_constructions_database = RemoteSender(ipy2_4.unique_constructions)

overlap_constructions = RemoteSender(ipy2_4.overlap)

overlap_constructions_2 = RemoteReceiver(overlap_constructions)
event_31 = EventGate(Data=overlap_constructions_2)  # -> Data, IsNew
and_30 = GateAnd(A=event_31.Data, B=freeze_gate_23)
launchwin_13 = LaunchWindow(
    Show=and_30,
    Name="Warning",
    Width=Slider(210, range=0..1000),
    Height=Slider(140, range=0..1000),
    ChildStatus=2,
    EnableHorizScroll=False)
winprops_13 = SetWindowProperties(
    Window=launchwin_13,
    StartingLocation=pt_9,
    Theme=0,
    AccentColor=accent_colors_2,
    ShowTitleBar=True,
    BackgroundColor=RGB(255, 255, 255),
    ScaleFactor=1)
addelems_14 = AddElements(Window=launchwin_13, Elements=flatten(tb_12), DoVLChecking=True)  # -> AddedElements, ElementNames
childwin_4 = MakeChildWindow(ParentWindow=heath_window_4, ChildWindow=launchwin_13)

# ----
# Save constructions, (triggered after creating)
heath_flying_7 = RemoteReceiver(heath_flying)
py3_22 = Python3Script(get=heath_flying_7)  # -> mpl_folder; same code as py3_2
all_constructions_database_2 = RemoteReceiver(all_constructions_database)
create_construction_3 = RemoteReceiver(create_construction)
py3_23 = Python3Script(name="constructions", folder=py3_22)  # -> file_name
# ---------- py3_23: Python ----------
import os

indentation = 0
while indentation < 100:
    path = folder + '\\' + name + ' ' + str(indentation) + '.json'
    if not os.path.exists(path):
        break
    indentation += 1
file_name = name + ' ' + str(indentation)
# ---------- end py3_23 ----------
dumpobjects = HBDumpObjects(hb_objs=flatten(all_constructions_database_2), name=py3_23, folder=py3_22, dump=create_construction_3)  # -> report, hb_file; plug-in component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
panel_119 = Panel(py3_23)
panel_120 = Panel(dumpobjects.hb_file)

all_constructions_database_3 = RemoteReceiver(all_constructions_database)
decnstrmat_3 = HBDeconstructMaterial(mat=all_constructions_database_3)  # -> values, attr_names, r_val_si, r_val_ip; plug-in component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
entwine_113 = Entwine(Branch00=panel_20, Branch01=all_constructions_database_3, FlattenInputs=True)  # -> flatten(Result)
panel_122 = Panel(decnstrmat_3.values)
all_constructions = RemoteSender(entwine_113)
item_22 = ListItem(List=decnstrmat_3.values, Index=0, Wrap=True)  # -> flatten(Item), flatten(Item1), flatten(Item2), flatten(Item3), flatten(Item4)
clean_12 = CleanTree(RemoveNulls=True, RemoveInvalid=True, RemoveEmpty=False, Tree=item_22.Item4)
clean_13 = CleanTree(RemoveNulls=True, RemoveInvalid=True, RemoveEmpty=False, Tree=item_22.Item3)
clean_14 = CleanTree(RemoveNulls=True, RemoveInvalid=True, RemoveEmpty=False, Tree=item_22.Item2)
clean_15 = CleanTree(RemoveNulls=True, RemoveInvalid=True, RemoveEmpty=False, Tree=item_22.Item)
lng_18 = ListLength(List=clean_15)
entwine_114 = Entwine(Branch00="Generic", Branch01=clean_15, FlattenInputs=True)  # -> flatten(Result)
bool_32 = Boolean(lng_18)
all_construction_names = RemoteSender(entwine_114)
gate_32 = StreamGate(Stream="{0} (conductivity: {1}, density: {2}, specific heat: {3})", Gate=bool_32)  # -> Target0, Target1

py3_24 = Python3Script(x=clean_14)  # -> rounded
# ---------- py3_24: Python ----------
if x:
    rounded = round(x, 1)
# ---------- end py3_24 ----------
py3_25 = Python3Script(x=clean_13)  # -> rounded; same code as py3_24
py3_26 = Python3Script(x=clean_12)  # -> rounded; same code as py3_24

format_7 = Format(Culture=127, Data0=clean_15, Data1=py3_24, Data2=py3_25, Data3=py3_26)

setlist_6 = SetListContents(ListToModify=pulldown_22, NewListContents=entwine_114, SelectedIndex="0")
setlist_7 = SetListContents(ListToModify=pulldown_20, NewListContents=entwine_114, SelectedIndex="0")
setlist_8 = SetListContents(ListToModify=pulldown_19, NewListContents=entwine_114, SelectedIndex="0")
setlist_9 = SetListContents(ListToModify=pulldown_21, NewListContents=entwine_114, SelectedIndex="0")

setlist_10 = SetListContents(ListToModify=pulldown_18, NewListContents=entwine_114, SelectedIndex="0")

setlist_11 = SetListContents(ListToModify=pulldown_23, NewListContents=entwine_114, SelectedIndex="0")

all_constructions_2 = RemoteReceiver(all_constructions)
all_constructions_3 = RemoteReceiver(all_constructions)
all_constructions_4 = RemoteReceiver(all_constructions)
item_23 = ListItem(List=all_constructions_2, Index=subset_exterior_floor_2, Wrap=True)
item_24 = ListItem(List=all_constructions_3, Index=subset_exterior_wall_2, Wrap=True)
item_25 = ListItem(List=all_constructions_4, Index=subset_exterior_roof_2, Wrap=True)
expression_62 = Expression(x="Generic", y=item_23, Expression="x=y")
expression_63 = Expression(x="Generic", y=item_24, Expression="x=y")
expression_64 = Expression(x="Generic", y=item_25, Expression="x=y")
filter_29 = StreamFilter(Gate=expression_62, Stream0=item_23, Stream1=null_4)
filter_30 = StreamFilter(Gate=expression_63, Stream0=item_24, Stream1=null_5)
filter_31 = StreamFilter(Gate=expression_64, Stream0=item_25, Stream1=null_6)
exteriorsubset_2 = HBExteriorConstructionSubset(exterior_wall=filter_30, exterior_roof=filter_31, exposed_floor=filter_29)  # -> exterior_set; plug-in component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

all_constructions_5 = RemoteReceiver(all_constructions)
all_constructions_6 = RemoteReceiver(all_constructions)
item_26 = ListItem(List=all_constructions_5, Index=subset_interior_wall_2, Wrap=True)
item_27 = ListItem(List=all_constructions_6, Index=subset_interior_floor_2, Wrap=True)
expression_65 = Expression(x="Generic", y=item_26, Expression="x=y")
expression_66 = Expression(x="Generic", y=item_27, Expression="x=y")
filter_32 = StreamFilter(Gate=expression_65, Stream0=item_26, Stream1=null_7)
filter_33 = StreamFilter(Gate=expression_66, Stream0=item_27, Stream1=null_8)
interiorsubset_2 = HBInteriorConstructionSubset(interior_wall=filter_32, interior_floor=filter_33)  # -> interior_set; plug-in component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

all_constructions_7 = RemoteReceiver(all_constructions)
item_28 = ListItem(List=all_constructions_7, Index=subset_ground_floor_2, Wrap=True)
expression_67 = Expression(x="Generic", y=item_28, Expression="x=y")
filter_34 = StreamFilter(Gate=expression_67, Stream0=item_28, Stream1=null_9)
groundsubset_2 = HBGroundConstructionSubset(ground_floor=filter_34)  # -> ground_set; plug-in component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

constructionset_2 = HBConstructionSet(
    name="My construction",
    base_constr_set=panel_52,
    exterior_subset=exteriorsubset_2,
    ground_subset=groundsubset_2,
    interior_subset=interiorsubset_2,
    subface_subset=subfacesubset_2)  # -> constr_set; plug-in component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

# ---- group: Building occupancy and systems (continued)
add_dynamic_shades = AddDynamicShades(base_construction_set=constructionset_2, setpoint=number_slider_34)

# ----
decnstrconstrset_2 = HBDeconstructConstructionSet(constr_set=constructionset_2)  # -> exterior_wall, exterior_roof, exposed_floor, ground_wall, ground_roof, ground_floor, window, skylight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; plug-in component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
panel_123 = Panel(decnstrconstrset_2.exterior_wall)

all_construction_names_2 = RemoteReceiver(all_construction_names)
expression_68 = Expression(x=all_construction_names_2, y=create_construction_name_3, Expression="x=y")
cull_11 = CullPattern(List=expression_68, CullPattern=expression_68)
gate_33 = StreamGate(Stream="Material already exists", Gate=cull_11)  # -> Target0, Target1
entwine_115 = Entwine(Branch00=filter_27, Branch01=gate_33.Target1, FlattenInputs=True)  # -> flatten(Result)
item_29 = ListItem(List=entwine_115, Index=0, Wrap=True)
create_construction_error_message = RemoteSender(item_29)

create_construction_error_message_2 = RemoteReceiver(create_construction_error_message)
null_16 = NullItem(Item=create_construction_error_message_2)  # -> NullFlags, InvalidFlags, Description
filter_35 = StreamFilter(Gate=null_16.NullFlags, Stream0=create_construction_error_message_2, Stream1=" ")
filter_36 = StreamFilter(Gate=null_16.NullFlags, Stream0=Slider(500, range=0..1000), Stream1=Slider(1000000, range=0..1000000))
hideshow_23 = HideShowElement(ElementToHideShow=button_29, Show=True, Collapse=True, Disable=invert(null_16.NullFlags))
tooltip_12 = AttachTooltipToElement(ElementsToAttachTo=button_29, TooltipContent=filter_35, ShowDelay=filter_36, Duration=Slider(5000, range=0..10000))

# ---- group: Prepare for analysis (continued)
data_20 = Data(add_dynamic_shades)
entwine_116 = Entwine(
    Branch00=room,
    Branch01=adjacent,
    Branch02=context,
    Branch03=windows,
    Branch04=data_17,
    Branch05=data_20,
    Branch06=model_name_3,
    Branch07=generate_wwr_2,
    Branch08=wall_thickness_2,
    Branch09=roof_thickness_2,
    FlattenInputs=True)
freeze_gate_37 = StreamFreezeGate(Data=entwine_116, PassingSwitch=create_model_8, Hold=True)
bang_8 = ExplodeTree(Data=freeze_gate_37)  # -> Branch0, Branch1, Branch2, Branch3, Branch4, Branch5, Branch6, Branch7, Branch8, Branch9
hasdata_8 = DataExists(Data=bang_8.Branch0)
model_rooms_exists = RemoteSender(hasdata_8)

# ----
construction = Data(bang_8.Branch5)
program_2 = Data(bang_8.Branch4)
model_name_4 = Data(bang_8.Branch6)
roof_thickness_3 = Data(bang_8.Branch9)
wall_thickness_3 = Data(bang_8.Branch8)
wwr = Data(bang_8.Branch7)

# ---- group: Prepare for analysis (continued)
window_to_wall_ratio = Number(wwr)
wall_thickness_4 = Number(wall_thickness_3)
context_geometry = Geometry(bang_8.Branch2)
windows_2 = Geometry(bang_8.Branch3)
adjacent_geometry = Geometry(bang_8.Branch1)
room_geometry = Geometry(bang_8.Branch0)
model_name_5 = Text(model_name_4)

python_3 = GhPythonScript(in_list=program_2)  # -> out_list; inputs in_list: list
# ---------- python_3: Python ----------
"""Converts lists of HB objects to dicts for use with Py3.
    Inputs:
        in_list: List of HB objects
    Output:
        out_list: List of Python dictionaries representing HB objects"""

__author__ = "sawen"
__version__ = "2024.07.09"

out_list = list([x.to_dict() for x in in_list])
# ---------- end python_3 ----------
python_4 = GhPythonScript(in_list=construction)  # -> out_list; inputs in_list: list; same code as python_3
py3_27 = Python3Script(
    window_wall_ratio=window_to_wall_ratio,
    window_height=window_height,
    sill_height=sill_height,
    horizontal_separation=horizontal_separation,
    wall_thickness=wall_thickness_4)  # -> out, window_settings
# ---------- py3_27: Python ----------
from heath import WindowSettings

"""Create Window Settings"""
window_settings = WindowSettings(window_wall_ratio, window_height, sill_height, horizontal_separation, wall_thickness)
# ---------- end py3_27 ----------
py3_28 = Python3Script(
    model_name=model_name_5,
    room_geo=room_geometry,
    construction_sets=python_4,
    programs=python_3,
    energy_systems=energy_system_name,
    adjacent_surfaces=adjacent_geometry,
    window_geo=windows_2,
    window_settings=py3_27.window_settings,
    louver_settings=py3_16.louver_settings,
    context_geo=context_geometry)  # -> out, rooms, apertures, context, hb_model; inputs room_geo: list of Brep, construction_sets: list, programs: list, energy_systems: list, adjacent_surfaces: list of Brep, window_geo: list of Surface, context_geo: list of Brep
# ---------- py3_28: Python ----------
# Copyright (c) 2024, Heath.
# You should have received a copy of the GNU Affero General Public License
# along with Heath; If not, see <http://www.gnu.org/licenses/>.
# 
# @license AGPL-3.0-or-later <https://spdx.org/licenses/AGPL-3.0-or-later>

"""Grasshopper Script"""
        
from heath import create_hb_model, heath_globals, create_hb_rooms, create_hb_apertures, auto_hb_apertures, add_border_shades, add_louver_shades, add_subfaces, add_shades
import heath

import Rhino.Geometry as rg
import IronPython
import importlib
import honeybee_energy

from honeybee.room import Room
cs = honeybee_energy.constructionset.ConstructionSet
pt = honeybee_energy.programtype.ProgramType 

import scriptcontext


def dictify(d):
    for key in d:
        if type(d[key]) == IronPython.Runtime.PythonDictionary:
            d[key] = dict(d[key])
            dictify(d[key])

if __name__ == "__main__":
    if not scriptcontext.sticky["heath_flying"]:
        raise Exception("Heath - fly component must exist on the canvas")
    ghenv.Component.Message = heath_globals.version

    # SUPER HACK because Py3 does not retain the Honeybee types
    # https://discourse.ladybug.tools/t/ladybug-honeybee-datatypes-are-converted-when-input-to-py3-component/28216
    construction_sets = [cs.from_dict(c) for c in construction_sets]
    p = programs[0]
    programs_patched = []
    for p in programs:
        # hack to fix py2-py3 conversion of dicts
        dictify(p)
        p = pt.from_dict(p)
        programs_patched.append(p)

    rooms = create_hb_rooms(list(room_geo), construction_sets, programs_patched, adjacent_surfaces, energy_systems)
    if window_geo:
        apertures = create_hb_apertures(window_geo)
    elif window_settings:
        ws = window_settings
        apertures = auto_hb_apertures(rooms, ws.window_wall_ratio, ws.window_height, ws.sill_height, ws.horizontal_separation)
    else:
        raise Exception("Either window geo or window settings are required inputs")

    apertures = add_border_shades(apertures, window_settings.wall_thickness)
    if louver_settings:
        ls = louver_settings
        apertures = add_louver_shades(apertures, ls.depth, ls.count, ls.dist, ls.angle, ls.direction)

    rooms = add_subfaces(rooms, apertures)
    context = add_shades(context_geo) if (context_geo) else []
    hb_model = create_hb_model(model_name, rooms, None, context)
# ---------- end py3_28 ----------
entwine_117 = Entwine(Branch00=py3_28.rooms, Branch01=py3_28.apertures, Branch02=py3_28.context, Branch03=py3_28.hb_model, FlattenInputs=True)
python_5 = GhPythonScript(in_list=entwine_117)  # -> out_list; inputs in_list: list
# ---------- python_5: Python ----------
"""Converts lists of HB objects to str representations of dicts for use with Py2.
    Inputs:
        in_list: List of HB objects
    Output:
        out_list: List of strings representing Python dictionaries representing HB objects"""

__author__ = "sawen"
__version__ = "2024.07.09"

out_list = list([str(x.to_dict()) for x in in_list])
# ---------- end python_5 ----------
bang_9 = ExplodeTree(Data=python_5)  # -> Branch0, Branch1, Branch2, Branch3
python_6 = GhPythonScript(
    room_dict_as_str=bang_9.Branch0,
    apt_dict_as_str=bang_9.Branch1,
    shd_dict_as_str=bang_9.Branch2,
    mdl_dict_as_str=bang_9.Branch3)  # -> out, rooms, apertures, shades, models; inputs room_dict_as_str: list, apt_dict_as_str: list, shd_dict_as_str: list, mdl_dict_as_str: list
# ---------- python_6: Python ----------
__author__ = "sawen"
__version__ = "2024.07.09"

from honeybee.room import Room
from honeybee.aperture import Aperture
from honeybee.shade import Shade
from honeybee.model import Model
import ast

rooms = []

for r in room_dict_as_str:
    # holy hackeroni! Py2 can't read the dict directly unless
    # it is converted to a string first!
    rooms.append(Room.from_dict(ast.literal_eval(r)))

apertures = []
for a in apt_dict_as_str:
    # holy hackeroni! Py2 can't read the dict directly unless
    # it is converted to a string first!
    apertures.append(Aperture.from_dict(ast.literal_eval(a)))
   
shades = []
for s in shd_dict_as_str:
    # holy hackeroni! Py2 can't read the dict directly unless
    # it is converted to a string first!
    shades.append(Shade.from_dict(ast.literal_eval(s)))
    
models = []
for m in mdl_dict_as_str:
    # holy hackeroni! Py2 can't read the dict directly unless
    # it is converted to a string first!
    models.append(Model.from_dict(ast.literal_eval(m)))
# ---------- end python_6 ----------
filter_37 = StreamFilter(Gate=create_model_8, Stream1=python_6.models)
vizbytype = HBVisualizeByType(hb_objs=python_6.models)  # -> walls, interior_walls, roofs, ceilings, exterior_floors, interior_floors, air_walls, apertures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; plug-in component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
hasdata_9 = DataExists(Data=python_6.models)
hasdata_10 = DataExists(Data=filter_37)
honeybee_model_possible = RemoteSender(hasdata_9)
freeze_gate_38 = StreamFreezeGate(Data=filter_37, PassingSwitch=hasdata_10, Hold=True)
panel_124 = Panel(vizbytype.apertures)
data_21 = Data(vizbytype.outdoor_shades)
vizbytype_2 = HBVisualizeByType(hb_objs=freeze_gate_38)  # -> walls, interior_walls, roofs, ceilings, exterior_floors, interior_floors, air_walls, apertures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; plug-in component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
vizbybc = HBVisualizeByBC(hb_objs=freeze_gate_38)  # -> outdoors, surface, ground, adiabatic, other, wire_frame; disabled; plug-in component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
deconstructmodel = HBDeconstructModel(model=freeze_gate_38)  # -> rooms, faces, apertures, doors, shades; plug-in component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
hasdata_11 = DataExists(Data=freeze_gate_38)
honeybee_model_ready = RemoteSender(hasdata_11)
panel_125 = Panel(freeze_gate_38)
panel_126 = Panel(hasdata_11)
geoprop = HBGeometryProperties(rooms=deconstructmodel.rooms)  # -> ext_wall_area, ext_win_area, volume, floor_area, floor_ep_constr; plug-in component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
null_17 = NullItem(Item=[vizbytype_2.walls, vizbytype_2.interior_walls, vizbytype_2.roofs, vizbytype_2.ceilings, vizbytype_2.exterior_floors, vizbytype_2.interior_floors, vizbytype_2.air_walls, vizbytype_2.apertures, vizbytype_2.interior_apertures, vizbytype_2.doors, vizbytype_2.interior_doors, vizbytype_2.outdoor_shades, vizbytype_2.indoor_shades])  # -> NullFlags, InvalidFlags, Description
cull_12 = CullPattern(List=null_17.NullFlags, CullPattern=invert(null_17.NullFlags))
panel_127 = Panel(geoprop.floor_area)
gate_34 = StreamGate(Stream=[vizbytype_2.indoor_shades, vizbytype_2.outdoor_shades], Gate=show_honeybee_context_3)  # -> Target0, Target1
gate_35 = StreamGate(Stream=[vizbytype_2.apertures, vizbytype_2.interior_apertures], Gate=show_honeybee_windows_3)  # -> Target0, Target1
gate_36 = StreamGate(Stream=[vizbytype_2.doors, vizbytype_2.interior_doors], Gate=show_honeybee_doors_3)  # -> Target0, Target1
gate_37 = StreamGate(Stream=vizbytype_2.roofs, Gate=show_honeybee_roof_3)  # -> Target0, Target1
gate_38 = StreamGate(Stream=vizbytype_2.interior_floors, Gate=show_honeybee_floors_3)  # -> Target0, Target1
gate_39 = StreamGate(Stream=vizbytype_2.exterior_floors, Gate=show_honeybee_ground_3)  # -> Target0, Target1
gate_40 = StreamGate(Stream=[vizbytype_2.walls, vizbytype_2.interior_walls, vizbytype_2.air_walls], Gate=show_honeybee_walls_3)  # -> Target0, Target1
lng_19 = ListLength(List=cull_12)
honeybee_model_exists = RemoteSender(lng_19)
data_22 = Data(gate_36.Target1)
data_23 = Data(gate_37.Target1)
data_24 = Data(gate_35.Target1)
data_25 = Data(gate_34.Target1)
data_26 = Data(gate_40.Target1)
data_27 = Data(gate_38.Target1)
data_28 = Data(gate_39.Target1)

# ----
honeybee_model_exists_2 = RemoteReceiver(honeybee_model_exists)
and_31 = GateAnd(A=honeybee_model_exists_2, B=freeze_gate_2)
filter_38 = StreamFilter(Gate=and_31, Stream0="Create model", Stream1="Update model")
setbtn = SetButton(ButtonToModify=button_2, ButtonName=filter_38)
honeybee_model_exists_3 = RemoteReceiver(honeybee_model_exists)
honeybee_model_possible_2 = RemoteReceiver(honeybee_model_possible)
hideshow_24 = HideShowElement(ElementToHideShow=button_3, Show=True, Collapse=True, Disable=invert(honeybee_model_exists_3))
honeybee_model_exists_4 = RemoteReceiver(honeybee_model_exists)
bool_33 = Boolean(honeybee_model_possible_2)
filter_39 = StreamFilter(Gate=bool_33, Stream0=Slider(500, range=0..1000), Stream1=Slider(1000000, range=0..1000000))
filter_40 = StreamFilter(Gate=bool_33, Stream0="Import geometry before creating the model", Stream1=" ")
hideshow_25 = HideShowElement(ElementToHideShow=border, Show=honeybee_model_exists_4, Collapse=invert(True), Disable=False)
tooltip_13 = AttachTooltipToElement(ElementsToAttachTo=button_2, TooltipContent=filter_40, ShowDelay=filter_39, Duration=2000)

entwine_118 = Entwine(
    Branch00=data_26,
    Branch01=data_23,
    Branch02=data_27,
    Branch03=data_28,
    Branch04=data_24,
    Branch05=data_22,
    Branch06=data_25,
    FlattenInputs=True)
clean_16 = CleanTree(RemoveNulls=True, RemoveInvalid=True, RemoveEmpty=False, Tree=entwine_118)
lng_20 = ListLength(List=clean_16)
repeat_10 = RepeatData(Data=ef_att_4.Attributes, Length=lng_20)
bake_2 = BakeObjects(Geometry=clean_16, Attributes=repeat_10, Bake=bake_model_2, createGroups=False, preset="Moderate")  # -> Message, Ghosts

epw_file_url = Data(freeze_gate_38)

honeybee_model_ready_2 = RemoteReceiver(honeybee_model_ready)
# Simple energy simulation
honeybee_model_ready_3 = RemoteReceiver(honeybee_model_ready)
honeybee_model_ready_4 = RemoteReceiver(honeybee_model_ready)
honeybee_model_ready_5 = RemoteReceiver(honeybee_model_ready)
honeybee_model_ready_6 = RemoteReceiver(honeybee_model_ready)
honeybee_model_ready_7 = RemoteReceiver(honeybee_model_ready)
honeybee_model_ready_8 = RemoteReceiver(honeybee_model_ready)
filter_41 = StreamFilter(Gate=honeybee_model_ready_2, Stream0=Slider(500, range=0..1000), Stream1=Slider(1000000, range=0..1000000))
filter_42 = StreamFilter(Gate=honeybee_model_ready_2, Stream0="Create a model before running the simulation", Stream1=" ")
honeybee_model_ready_9 = RemoteReceiver(honeybee_model_ready)
filter_43 = StreamFilter(Gate=honeybee_model_ready_3, Stream0=Slider(500, range=0..1000), Stream1=Slider(1000000, range=0..1000000))
filter_44 = StreamFilter(Gate=honeybee_model_ready_3, Stream0="Create a model before running the simulation", Stream1=" ")
filter_45 = StreamFilter(Gate=honeybee_model_ready_4, Stream0=Slider(500, range=0..1000), Stream1=Slider(1000000, range=0..1000000))
filter_46 = StreamFilter(Gate=honeybee_model_ready_4, Stream0="Create a model before running the simulation", Stream1=" ")
filter_47 = StreamFilter(Gate=honeybee_model_ready_5, Stream0=Slider(500, range=0..1000), Stream1=Slider(1000000, range=0..1000000))
filter_48 = StreamFilter(Gate=honeybee_model_ready_5, Stream0="Create a model before running the simulation", Stream1=" ")
hideshow_26 = HideShowElement(ElementToHideShow=button_13, Show=True, Collapse=True, Disable=invert(honeybee_model_ready_6))
tooltip_14 = AttachTooltipToElement(ElementsToAttachTo=button_13, TooltipContent=filter_42, ShowDelay=filter_41, Duration=2000)
hideshow_27 = HideShowElement(ElementToHideShow=button_15, Show=True, Collapse=True, Disable=invert(honeybee_model_ready_7))
tooltip_15 = AttachTooltipToElement(ElementsToAttachTo=button_15, TooltipContent=filter_44, ShowDelay=filter_43, Duration=2000)
hideshow_28 = HideShowElement(ElementToHideShow=button_16, Show=True, Collapse=True, Disable=invert(honeybee_model_ready_8))
tooltip_16 = AttachTooltipToElement(ElementsToAttachTo=button_16, TooltipContent=filter_46, ShowDelay=filter_45, Duration=2000)
hideshow_29 = HideShowElement(ElementToHideShow=button_18, Show=True, Collapse=True, Disable=invert(honeybee_model_ready_9))
tooltip_17 = AttachTooltipToElement(ElementsToAttachTo=button_18, TooltipContent=filter_48, ShowDelay=filter_47, Duration=2000)

# ---- group: Analyse context and model
# Weather visualisation
# # Weather visualisation
# This cluster visualises weather data from a .epw file including solar radiation and temperature, as applied to a target geometry
# 
# ## Instructions
# Enter all the inputs and visualise wind, sky view and temperature,  set `Run direct sun hours study` and `Run incident radiation study` to visualise solar radiation
# 
# ## Inputs
# - `EPW file URL` - the URL for a EPW file which describes the location
# - `Target Geometry` - geometry on which to apply irradiation study
# - `Context Geometry` - geometry which shades the target geometry
# - `Run direct sun hours study` - set to True to run the direct sun hours study
# - `Run incident radiation study` - set to True to run the incident radiation study
# - `Sky mask centre point` - point at which to generate sky mask
# 
# ## Outputs
# - `Sky dome` - mesh visualising the directions where solar radiation comes from during the year at the location
# - `Sky mask - mesh visualising what portions of the sky are visible at the specified point
# - `Wind rose` - mesh visualising wind directions and velocities during the year
# - `Dry bulb temperature line chart` - mesh visualising dry bulb temperature during the year
# - `Dry bulb temperature 2D chart` - mesh visualising dry bulb temperature for each hour of the year
# - `Direct sun hours` - mesh visualising the number of direct sun hours on the target geometry
# - `Incident radiation` - mesh visualising the incident radiation [kWh/m2] on the target geometry
# 
# ## Interpretation
# To be added...
# Visualise properties
# # Visualise properties
# This cluster visualises room and face attributes of a Honeybee model
# 
# ## Instructions
# Input the Honeybee model to be visualised and select room/face attributes using the HB Room Attributes/HB Room Energy Attibrutes/HB Face Attributes/HB Face Energy Attributes dropdown components. Adjust precision of the attributes using the `Number of decimals` inputs
# 
# ## Inputs
# - `Honeybee model` - Honeybee model to be visualised
# - `Room attribute` - Honeybee Room  or Room Energy attribute to visualise
# - `Number of decimals (room)` - Precision of room attribute output
# - `Face attribute` - Honeybee Face  or Face Energy attribute to visualise
# - `Number of decimals (face)` - Precision of face attribute output
# 
# ## Outputs
# - `Visualised room attributes` - mesh representing the selected room attribute
# - `Visualised face attributes` - mesh representing the selected face attribute
# 
# ## Interpretation
# To be added...
run_weather_visualisation_3 = RemoteReceiver(run_weather_visualisation)
run_weather_visualisation_4 = RemoteReceiver(run_weather_visualisation)
gate_41 = StreamGate(Stream="Heath geometry type", Gate=run_weather_visualisation_3)  # -> Target0, Target1
gate_42 = StreamGate(Stream="Heath geometry type", Gate=run_weather_visualisation_4)  # -> Target0, Target1
roomenergyattr = HBRoomEnergyAttributes({"Program": "properties.energy.program_type.display_name", "Construction Set": "properties.energy.construction_set.display_name", "Is Conditioned": "properties.energy.is_conditioned", "People per Area [ppl/m2]": "properties.energy.people.people_per_area", "Area per Person [m2/ppl]": "properties.energy.people.area_per_person", "Lighting per Area [W/m2]": "properties.energy.lighting.watts_per_area"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}, selected="Program")
refkv_9 = ReferenceByKeyValue(Key=gate_41.Target1, Val="Room", lightweight=False)
refkv_10 = ReferenceByKeyValue(Key=gate_42.Target1, Val="Context", lightweight=False)
pt_15 = ConstructPoint(XCoordinate=Slider(21, range=0..100), YCoordinate=Slider(15, range=0..100), ZCoordinate=0)
faceenergyattr = HBFaceEnergyAttributes({"Construction": "properties.energy.construction.display_name", "Materials": "properties.energy.construction.layers", "Thickness [m]": "properties.energy.construction.thickness", "Density [kg/m2]": "properties.energy.construction.mass_area_density", "Heat Capacity [J/K-m2]": "properties.energy.construction.area_heat_capacity", "Construction R-Value [m2-K/W]": "properties.energy.construction.r_value", "Construction U-Value [W/m2-K]": "properties.energy.construction.u_value", "Construction U-Factor [W/m2-K]": "properties.energy.construction.u_factor", "Construction SHGC [Unshaded]": "properties.energy.construction.shgc", "R-Factor [m2-K/W]": "properties.energy.r_factor", "U-Factor [W/m2-K]": "properties.energy.u_factor", "SHGC [Unshaded]": "properties.energy.shgc", "Solar Transmitance [Unshaded]": "properties.energy.construction.solar_transmittance", "Visible Transmitance [Unshaded]": "properties.energy.construction.visible_transmittance", "Solar Reflectance [Outside]": "properties.energy.construction.outside_solar_reflectance", "Solar Reflectance [Inside]": "properties.energy.construction.inside_solar_reflectance", "Fraction Area Operable": "properties.energy.vent_opening.fraction_area_operable", "Fraction Height Operable": "properties.energy.vent_opening.fraction_height_operable", "Discharge Coefficient": "properties.energy.vent_opening.discharge_coefficient"}, selected="Construction SHGC [Unshaded]")
room_attribute_visualize_3 = RemoteReceiver(room_attribute_visualize)
room_energy_attribute_2 = RemoteReceiver(room_energy_attribute)
face_attribute_visualize_3 = RemoteReceiver(face_attribute_visualize)
face_energy_attribute_2 = RemoteReceiver(face_energy_attribute)
run_weather_visualisation_5 = RemoteReceiver(run_weather_visualisation)
roomattr = HBRoomAttributes({"Display Name": "display_name", "Simulation Name (Identifier)": "identifier", "Multiplier": "multiplier", "Floor Area Excluded": "exclude_floor_area", "Story": "story", "Volume": "volume", "Gross Floor Area": "floor_area", "Exposed Area": "exposed_area", "Exterior Wall Area": "exterior_wall_area", "Exterior Aperture Area": "exterior_aperture_area", "Average Floor Elevation": "average_floor_height"}, selected="Exterior Aperture Area")
faceattr = HBFaceAttributes({"Display Name": "display_name", "Simulation Name (Identifier)": "identifier", "Boundary Condition": "boundary_condition", "Has Parent": "has_parent", "Parent": "parent", "Azimuth": "azimuth", "Altitude": "altitude", "Area": "area", "Perimeter": "perimeter", "Face Type": "type", "Aperture Is Operable": "is_operable", "Door Is Glass": "is_glass"}, selected="Face Type")
room_attribute_2 = RemoteReceiver(room_attribute)
face_attribute_2 = RemoteReceiver(face_attribute)
pt_16 = Point(pt_15)
data_29 = Data(panel_36)
filter_49 = StreamFilter(Gate=face_attribute_visualize_3, Stream0=face_energy_attribute_2, Stream1=face_attribute_2)
filter_50 = StreamFilter(Gate=room_attribute_visualize_3, Stream0=room_energy_attribute_2, Stream1=room_attribute_2)
data_30 = Data(freeze_gate_38)
weather_visualisation = WeatherVisualisation(
    _1=data_29,
    run_weather_visualisation=run_weather_visualisation_5,
    target_geometry_2=refkv_9,
    target_geometry=refkv_10,
    run_direct_sun_hours_study=run_weather_visualisation_5,
    run_incident_radiation_study=run_weather_visualisation_5,
    sky_mask_centre_point=pt_16)  # -> sky_dome, sky_mask, wind_rose, dry_bulb_temperature_line_chart, dry_bulb_temperature_2d_chart, direct_sun_hours_2, incident_radiation
visualise_properties = VisualiseProperties(
    honeybee_model=data_30,
    room_attribute=filter_50,
    number_of_decimals_room=Slider(4, range=0..10),
    face_attribute=filter_49,
    number_of_decimals_face=Slider(4, range=0..10))  # -> visualised_room_attributes_2, visualised_face_attributes_2
room_energy_attribute_visualize_3 = RemoteReceiver(room_energy_attribute_visualize)
face_energy_attribute_visualize_3 = RemoteReceiver(face_energy_attribute_visualize)
room_attribute_visualize_4 = RemoteReceiver(room_attribute_visualize)
face_attribute_visualize_4 = RemoteReceiver(face_attribute_visualize)
weather_visualization_type_2 = RemoteReceiver(weather_visualization_type)
or_22 = GateOr(A=room_attribute_visualize_4, B=room_energy_attribute_visualize_3)
or_23 = GateOr(A=face_attribute_visualize_4, B=face_energy_attribute_visualize_3)
weather_visualization_show_2 = RemoteReceiver(weather_visualization_show)
gate_43 = StreamGate(Stream=visualise_properties.visualised_room_attributes_2, Gate=or_22)  # -> Target0, Target1
gate_44 = StreamGate(Stream=visualise_properties.visualised_face_attributes_2, Gate=or_23)  # -> Target0, Target1
weather_visualization_show_3 = RemoteReceiver(weather_visualization_show)
equals_27 = Equality(FirstNumber="3", SecondNumber=weather_visualization_type_2)  # -> Equality, Inequality
equals_28 = Equality(FirstNumber="4", SecondNumber=weather_visualization_type_2)  # -> Equality, Inequality
equals_29 = Equality(FirstNumber="5", SecondNumber=weather_visualization_type_2)  # -> Equality, Inequality
equals_30 = Equality(FirstNumber="6", SecondNumber=weather_visualization_type_2)  # -> Equality, Inequality
data_31 = Data(gate_43.Target1)
data_32 = Data(gate_44.Target1)
nor_2 = GateNor(A=equals_27.Equality, B=equals_28.Equality)
or_24 = GateOr(A=equals_29.Equality, B=equals_30.Equality)
and_32 = GateAnd(A=weather_visualization_show_3, B=or_24)
weather_visualisation_wireframe = RemoteSender(and_32)
weather_visualization_show_4 = RemoteReceiver(weather_visualization_show)
swatch = ColourSwatch(SwatchColor=RGB(84, 84, 84))
gate_45 = StreamGate(Stream=swatch, Gate=weather_visualization_show_4)  # -> Target0, Target1

# ----
entwine_119 = Entwine(
    Branch00=weather_visualisation.sky_dome,
    Branch01=weather_visualisation.sky_mask,
    Branch02=weather_visualisation.wind_rose,
    Branch03=weather_visualisation.dry_bulb_temperature_line_chart,
    Branch04=weather_visualisation.dry_bulb_temperature_2d_chart,
    Branch05=weather_visualisation.direct_sun_hours_2,
    Branch06=weather_visualisation.incident_radiation,
    FlattenInputs=True)
freeze_gate_39 = StreamFreezeGate(Data=entwine_119, PassingSwitch=run_weather_visualisation_2, Hold=True)
bang_10 = ExplodeTree(Data=freeze_gate_39)  # -> Branch0, Branch1, Branch2, Branch3, Branch4, Branch5, Branch6

# ---- group: Analyse context and model (continued)
null_18 = NullItem(Item=flatten(freeze_gate_39))  # -> NullFlags, InvalidFlags, Description
filter_51 = StreamFilter(
    Gate=weather_visualization_type_2,
    Stream0=bang_10.Branch0,
    Stream1=bang_10.Branch1,
    Stream2=bang_10.Branch2,
    Stream3=bang_10.Branch3,
    Stream4=bang_10.Branch4,
    Stream5=bang_10.Branch5,
    Stream6=bang_10.Branch6)
cull_13 = CullPattern(List=null_18.NullFlags, CullPattern=invert(null_18.NullFlags))
gate_46 = StreamGate(Stream=filter_51, Gate=weather_visualization_show_2)  # -> Target0, Target1
lng_21 = ListLength(List=cull_13)
gate_47 = StreamGate(Stream=gate_46.Target1, Gate=nor_2)  # -> Target0, Target1
weather_visualisation_exists = RemoteSender(lng_21)
mesh = Mesh([gate_47.Target1, gate_47.Target0])
sortbytype = SortObjectsByType(RhinoObjects=gate_47.Target0)  # -> Points, Curves, Surfaces, Breps, Meshes, TextObjects, HatchObjects, LightObjects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
bbox = BoundingBox(Content=mesh, Plane=PlaneXY(0, 0, 0), UnionBox=True)  # -> Box, Box_2
line = Line(sortbytype.Curves)
zoom_weather_visualization_bounding_box = RemoteSender(bbox.Box)
null_19 = NullItem(Item=line)  # -> NullFlags, InvalidFlags, Description
data_33 = Data([sortbytype.Other, sortbytype.Meshes])
sift = SiftPattern(List=sortbytype.Curves, SiftPattern=null_19.NullFlags)  # -> Output0, Output1
preview_17 = CustomPreview(Geometry=[sift.Output1, data_33], Material=swatch)
preview_18 = CustomPreview(Geometry=gate_47.Target1, Material=gate_45.Target1)

# ----
weather_visualisation_exists_2 = RemoteReceiver(weather_visualisation_exists)
weather_visualisation_exists_3 = RemoteReceiver(weather_visualisation_exists)
hideshow_30 = HideShowElement(ElementToHideShow=button_5, Show=True, Collapse=True, Disable=invert(weather_visualisation_exists_2))
hideshow_31 = HideShowElement(ElementToHideShow=button_6, Show=True, Collapse=True, Disable=invert(weather_visualisation_exists_2))
hideshow_32 = HideShowElement(ElementToHideShow=stack_12, Show=weather_visualisation_exists_3, Collapse=True, Disable=False)

# ----
# Zoom weather visualization module
zoom_weather_visualization_bounding_box_2 = RemoteReceiver(zoom_weather_visualization_bounding_box)
zoom_weather_visualization_2 = RemoteReceiver(zoom_weather_visualization)
zbb = ZoomBoundingBox(Box=zoom_weather_visualization_bounding_box_2, Run=zoom_weather_visualization_2)

weather_visualisation_wireframe_2 = RemoteReceiver(weather_visualisation_wireframe)

# ----
# Bake model
panel_128 = Panel("""Heath::weather::Sky dome
Heath::weather::Sky mask
Heath::weather::Wind rose
Heath::weather::Dry bulb temperature line chart
Heath::weather::Dry bulb temperature 2D chart
Heath::weather::Direct sun hours
Heath::weather::Incident radiation""")
merge_11 = Merge(Data1=sift.Output1, Data2=data_33, Data3=gate_47.Target1)
weather_visualization_type_3 = RemoteReceiver(weather_visualization_type)
item_30 = ListItem(List=panel_128, Index=weather_visualization_type_3, Wrap=True)
ef_layer_3 = EleFrontLayer(FullPath=item_30)  # -> Layer, FullPath, Hidden, Locked, DisplayColour, MaterialName, Linetype, PrintColour, PrintWidth
weather_visualisation_bake_2 = RemoteReceiver(weather_visualisation_bake)
ef_att_5 = EleFrontAttributes(Layer=ef_layer_3.Layer)  # -> Attributes, Keys, Values, Name, Layer, ColourSource, DisplayColour, MaterialSource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

clean_17 = CleanTree(RemoveNulls=True, RemoveInvalid=True, RemoveEmpty=False, Tree=merge_11)

lng_22 = ListLength(List=clean_17)
repeat_11 = RepeatData(Data=ef_att_5.Attributes, Length=lng_22)
bake_3 = BakeObjects(Geometry=clean_17, Attributes=repeat_11, Bake=weather_visualisation_bake_2, createGroups=False, preset="Moderate")  # -> Message, Ghosts

panel_129 = Panel(bake_3.Ghosts)

# ----
# Detailed energy simulations
# https://energyplus-weather.s3.amazonaws.com/africa_wmo_region_1/LBY/LBY_Tripoli.620100_IWEC/LBY_Tripoli.620100_IWEC.zip
# # Detailed energy simulations
# This cluster simulates energy balance over a year and outputs the total energy use intensity (EUI), divided into end uses, and detailed graphs of the energy balance, peak cooling/heating, and cooling/heating load profiles
# 
# ## Instructions
# Enter all inputs and set `Run Energy Simulation` to true to run the energy simulation
# 
# ## Inputs
# - `EPW file URL` - the URL for a EPW file which describes the location
# - `Honeybee model` - the Honeybee model for analysis
# - `Run Energy Simulation` - set to True to run the energy simulation
# 
# ## Outputs
# - `Energy use intensity [kWh/m2a]` - A number representing the total energy use of the model
# - `Energy use intensity per end use [kWh/m2a]` - A list of values with the energy uses split into different end uses
# - `End uses` - A list of text strings representing the different end uses
# - `Annual hourly energy results` - various meshes representing different energy results over the hours of the year
# - `Monthly energy balance` - A monthly breakdown of the energy balance, with energy sources in the top and energy sinks in the bottom
# - `Peak cooling` - A number representing the peak cooling load in each zone
# - `Peak heating` - A number representing the peak heating load in each zone
# - `Cooling load profile` - A mesh representing the cooling load profile during the design day
# - `Heating load profile` - A mesh representing the heating load profile during the design day
# 
# ## Interpretation
# To be added...
data_34 = Data(freeze_gate_38)
data_35 = Data(panel_36)
epw_file_url_2 = Data(data_35)
honeybee_model = Data(data_34)
downloadepw = LBDownloadWeather(weather_URL=epw_file_url_2)  # -> epw_file, stat_file, ddy_file; plug-in component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
data_36 = Data(honeybee_model)
number_slider_39 = Slider(50, range=0..100)

# ---- group: Simulate
run_energy_simulation = Boolean(run_detailed_energy_simulations_2)
modeltoosm = HBModelToOSM(
    model=honeybee_model,
    epw_file=downloadepw.epw_file,
    sim_par=simpar,
    write=run_energy_simulation,
    run=run_energy_simulation)  # -> report, jsons, osw, osm, idf, sql, zsz, rdd, html; plug-in component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
eui = HBEndUseIntensity(sql=modeltoosm.sql)  # -> eui, eui_end_use, end_uses, gross_floor; plug-in component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
panel_130 = Panel(eui.eui)
panel_131 = Panel(eui.end_uses)
panel_132 = Panel(eui.eui_end_use)

# ---- group: Peak loads
readhvac = HBReadHVACSizing(sql=modeltoosm.sql)  # -> zone_names, zone_peak_cool, zone_peak_heat, comp_types, comp_properties, comp_values; plug-in component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
readzsz = HBReadZoneSizing(zsz=modeltoosm.zsz)  # -> cooling_load, heating_load; plug-in component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
toggle_6 = BooleanToggle(True)
toggle_7 = BooleanToggle(True)
panel_133 = Panel([readhvac.zone_peak_heat, readhvac.zone_peak_cool])
monthlychart = LBMonthlyChart(data=readzsz.heating_load, x_dim=Slider(40, range=0..100), stack=toggle_6, time_marks=toggle_6)  # -> report, data_mesh, data_lines, col_lines, legend, borders, labels, y_title, title, vis_set; plug-in component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
monthlychart_2 = LBMonthlyChart(data=readzsz.cooling_load, x_dim=Slider(40, range=0..100), stack=toggle_7, time_marks=toggle_7)  # -> report, data_mesh, data_lines, col_lines, legend, borders, labels, y_title, title, vis_set; plug-in component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
heating_load_profile = Data(flatten([monthlychart.data_mesh, monthlychart.data_lines, monthlychart.col_lines, monthlychart.legend, monthlychart.borders, monthlychart.labels, monthlychart.y_title, monthlychart.title]))
cooling_load_profile = Data(flatten([monthlychart_2.data_mesh, monthlychart_2.data_lines, monthlychart_2.col_lines, monthlychart_2.legend, monthlychart_2.borders, monthlychart_2.labels, monthlychart_2.y_title, monthlychart_2.title]))
peak_cooling = Data(readhvac.zone_peak_cool)
zone_names = Data(readhvac.zone_names)
peak_heating = Data(readhvac.zone_peak_heat)

# ---- group: Load previous model
falsestart = LBFalseStartToggle(False)
item_31 = ListItem(List=modeltoosm.jsons, Index=0, Wrap=True)
loadobjects_2 = HBLoadObjects(hb_file=item_31, load=falsestart)  # -> report, hb_objs; plug-in component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

# ---- group: extract and visualise data
roomenergyresult = HBReadRoomEnergyResult(sql=modeltoosm.sql)  # -> cooling, heating, lighting, electric_equip, gas_equip, process, hot_water, fan_electric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; plug-in component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
merge_12 = Merge(
    Data1=roomenergyresult.heating,
    Data2=roomenergyresult.cooling,
    Data3=roomenergyresult.lighting,
    Data4=roomenergyresult.electric_equip,
    Data5=roomenergyresult.hot_water,
    Data6=roomenergyresult.people_gain,
    Data7=roomenergyresult.solar_gain)
hourlyplot = LBHourlyPlot(data=merge_12)  # -> report, mesh, legend, borders, labels, title, vis_set; plug-in component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
xdata = LBDeconstructData(data=roomenergyresult.cooling)  # -> header, values; plug-in component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

# ---- group: Energy balance
faceresult = HBReadFaceResult(sql=modeltoosm.sql)  # -> face_indoor_temp, face_outdoor_temp, face_energy_flow; plug-in component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
loadbalance = HBThermalLoadBalance(
    rooms_model=flatten(data_36),
    cooling=roomenergyresult.cooling,
    heating=roomenergyresult.heating,
    lighting=roomenergyresult.lighting,
    electric_equip=roomenergyresult.electric_equip,
    hot_water=roomenergyresult.hot_water,
    people_gain=roomenergyresult.people_gain,
    solar_gain=roomenergyresult.solar_gain,
    infiltration_load=roomenergyresult.infiltration_load,
    mech_vent_load=roomenergyresult.mech_vent_load,
    face_energy_flow=faceresult.face_energy_flow)  # -> report, balance, balance_stor, norm_bal, norm_bal_stor; plug-in component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
timeop = LBTimeIntervalOperation(data=loadbalance.norm_bal_stor)  # -> daily, monthly, mon_per_hr; plug-in component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
colrange_3 = LBColorRange(index=Slider(19, range=0..100))  # -> colors; plug-in component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
neg_2 = Negative(Value=number_slider_39)
legendpar = LBLegendParameters(min=neg_2, max=number_slider_39, colors=colrange_3)  # -> leg_par; plug-in component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
monthlychart_3 = LBMonthlyChart(data=timeop.monthly, stack=Toggle(True), legend_par=legendpar)  # -> report, data_mesh, data_lines, col_lines, legend, borders, labels, y_title, title, vis_set; plug-in component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

# ----
energy_use_intensity = Data(eui.eui)
energy_use_intensity_per_end_use = Data(eui.eui_end_use)
end_uses = Data(eui.end_uses)
monthly_energy_balance = Data(flatten([monthlychart_3.data_mesh, monthlychart_3.data_lines, monthlychart_3.col_lines, monthlychart_3.legend, monthlychart_3.borders, monthlychart_3.labels, monthlychart_3.y_title, monthlychart_3.title]))
annual_hourly_energy_results = Data(flatten([hourlyplot.mesh, hourlyplot.legend, hourlyplot.borders, hourlyplot.labels, hourlyplot.title]))
cooling_load_profile_2 = Data(cooling_load_profile)
monthly_energy_balance_2 = Data(monthly_energy_balance)
energy_use_intensity_2 = Data(energy_use_intensity)
peak_cooling_2 = Data(peak_cooling)
heating_load_profile_2 = Data(heating_load_profile)
energy_use_intensity_per_end_use_2 = Data(energy_use_intensity_per_end_use)
end_uses_2 = Data(end_uses)
peak_heating_2 = Data(peak_heating)
annual_hourly_energy_results_2 = Data(annual_hourly_energy_results)
panel_134 = Panel(peak_cooling_2)
panel_135 = Panel(peak_heating_2)
panel_136 = Panel(energy_use_intensity_per_end_use_2)
panel_137 = Panel(energy_use_intensity_2)
panel_138 = Panel(end_uses_2)

peak_cooling_3 = Data(zone_names)

run_detailed_energy_simulations_3 = RemoteReceiver(run_detailed_energy_simulations)
entwine_120 = Entwine(
    Branch00=annual_hourly_energy_results_2,
    Branch01=monthly_energy_balance_2,
    Branch02=energy_use_intensity_2,
    Branch03=energy_use_intensity_per_end_use_2,
    Branch04=end_uses_2,
    Branch05=peak_cooling_3,
    Branch06=peak_cooling_2,
    Branch07=peak_heating_2,
    Branch08=cooling_load_profile_2,
    Branch09=heating_load_profile_2,
    FlattenInputs=True)
freeze_gate_40 = StreamFreezeGate(Data=entwine_120, PassingSwitch=run_detailed_energy_simulations_3, Hold=True)
bang_11 = ExplodeTree(Data=freeze_gate_40)  # -> Branch0, Branch1, Branch2, Branch3, Branch4, Branch5, Branch6, Branch7, Branch8, Branch9
detailed_energy_simulation_type_2 = RemoteReceiver(detailed_energy_simulation_type)
peak_heating_3 = Data(bang_11.Branch7)
peak_cooling_4 = Data(bang_11.Branch6)
annual_hourly_energy_results_3 = Data(bang_11.Branch0)
monthly_energy_balance_3 = Data(bang_11.Branch1)
cooling_load_profile_3 = Data(bang_11.Branch8)
heating_load_profile_3 = Data(bang_11.Branch9)
energy_use_intensity_per_end_use_3 = Data(bang_11.Branch3)
end_uses_3 = Data(bang_11.Branch4)
energy_use_intensity_3 = Data(bang_11.Branch2)
current_tab_28 = RemoteReceiver(current_tab)
filter_52 = StreamFilter(
    Gate=detailed_energy_simulation_type_2,
    Stream0=annual_hourly_energy_results_3,
    Stream1=monthly_energy_balance_3,
    Stream2=cooling_load_profile_3,
    Stream3=heating_load_profile_3)
expression_69 = Expression(x="Analysis module", y=current_tab_28, Expression="x=y")
hasdata_12 = DataExists(Data=energy_use_intensity_3)
filter_53 = StreamFilter(Gate=hasdata_12, Stream0="False", Stream1=energy_use_intensity_3)
gate_48 = StreamGate(Stream=filter_52, Gate=expression_69)  # -> Target0, Target1
detailed_energy_data_exists = RemoteSender(filter_53)
data_37 = Data(gate_48.Target1)
bbox_2 = BoundingBox(Content=data_37, Plane=PlaneXY(0, 0, 0), UnionBox=True)  # -> Box, Box_2
zoom_detailed_energy_simulation_bounding = RemoteSender(bbox_2.Box)  # "zoom_detailed_energy_simulation_bounding_box"

detailed_energy_data_exists_2 = RemoteReceiver(detailed_energy_data_exists)

zoom_detailed_energy_simulation_bounding_2 = RemoteReceiver(zoom_detailed_energy_simulation_bounding)  # "zoom_detailed_energy_simulation_bounding_box"
zbb_2 = ZoomBoundingBox(Box=zoom_detailed_energy_simulation_bounding_2, Run=zoom_detailed_energy_simulation_2)

zone_names_2 = Data(bang_11.Branch5)

detailed_energy_data_exists_3 = RemoteReceiver(detailed_energy_data_exists)
detailed_energy_data_exists_4 = RemoteReceiver(detailed_energy_data_exists)
or_25 = GateOr(A=detailed_energy_data_exists_3, B=filter_5)
rec_16 = DataRecorder(or_25, DataLimit=-10, RecordData=True)
hideshow_33 = HideShowElement(ElementToHideShow=true_button_9, Show=detailed_energy_data_exists_2, Collapse=True, Disable=False)
hideshow_34 = HideShowElement(ElementToHideShow=button_17, Show=detailed_energy_data_exists_4, Collapse=True, Disable=False)
ma_9 = MassAddition(Input=flatten(rec_16))  # -> Result, PartialResults
mod = Modulus(A=ma_9.Result, B=Slider(2, range=0..10))
bool_34 = Boolean(mod)
detailed_energy_data_exists_5 = RemoteReceiver(detailed_energy_data_exists)
detailed_energy_data_exists_6 = RemoteReceiver(detailed_energy_data_exists)
filter_54 = StreamFilter(Gate=bool_34, Stream0="Simulation failed...", Stream1="Daylight simulation is running...")
gate_49 = StreamGate(Stream=filter_54, Gate=freeze_gate_15)  # -> Target0, Target1
bool_35 = Boolean(invert(detailed_energy_data_exists_5))
hideshow_35 = HideShowElement(ElementToHideShow=stack_37, Show=detailed_energy_data_exists_6, Collapse=True, Disable=False)
settextblock_9 = SetTextBlockContents(TextBlockToModify=tb_10, NewTextBlockContents=gate_49.Target1)
hideshow_36 = HideShowElement(ElementToHideShow=tb_10, Show=bool_35, Collapse=detailed_energy_data_exists_5, Disable=False)

# ---- group: Analyse performance
# Simple energy simulations
run_simple_energy_simulations_4 = RemoteReceiver(run_simple_energy_simulations)
honeybee_rooms = Data(deconstructmodel.rooms)
data_38 = Data(deconstructmodel.shades)
data_39 = Data(panel_36)
downloadepw_2 = LBDownloadWeather(weather_URL=data_39)  # -> epw_file, stat_file, ddy_file; plug-in component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
run_peak_loads = Boolean(run_simple_energy_simulations_4)
run_energy_balance = Boolean(run_simple_energy_simulations_4)
data_40 = Data(honeybee_rooms)
data_41 = Data()
annualloads = HBAnnualLoads(
    rooms=flatten(data_40),
    shades=data_41,
    epw_file=downloadepw_2.epw_file,
    run_bal=run_energy_balance,
    run=run_energy_balance)  # -> report, total_load, cooling, heating, lighting, equip, process, hot_water, balance; plug-in component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
total_load_eui = Data(annualloads.total_load)
annual_energy_balance_data = Data(annualloads.balance)
panel_139 = Panel(annualloads.total_load)
colrange_4 = LBColorRange(index=Slider(0, range=0..26))  # -> colors; plug-in component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
colrange_5 = LBColorRange(index=Slider(26, range=0..26))  # -> colors; plug-in component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
number_slider_40 = Slider(760000, range=0..1000000)
neg_3 = Negative(Value=Slider(100000, range=0..100000))
pt_17 = ConstructPoint(XCoordinate=Slider(80, range=0..100), YCoordinate=Slider(5, range=0..100), ZCoordinate=0)
simple_energy_simulation_base_point = RemoteSender(pt_17)
simple_energy_simulation_base_point_2 = RemoteReceiver(simple_energy_simulation_base_point)
simple_energy_simulation_base_point_3 = RemoteReceiver(simple_energy_simulation_base_point)
simple_energy_simulation_base_point_4 = RemoteReceiver(simple_energy_simulation_base_point)
simple_energy_simulation_base_point_5 = RemoteReceiver(simple_energy_simulation_base_point)
simple_energy_simulation_base_point_6 = RemoteReceiver(simple_energy_simulation_base_point)

# ----
panel_140 = Panel(run_simple_energy_simulations_4)
# # Simple energy simulations
# Streamlined energy simulations which calculate energy balance across the year, and peak loads on the design day, for the input Honeybee rooms.
# 
# ## Instructions
# Enter all inputs and set `Run Energy Balance` or `Run Peak Loads`to True to investigate energy use for the specified Honeybee rooms considering the specified Honeybee shade objects. Adjust the y axis of output graphs using the `Graph max` input.
# 
# ## Inputs
# - `EPW file URL` - the URL for a EPW file which describes the location
# - `Honeybee rooms` - the Honeybee rooms which shall be analysed
# - `Shading objects` - Honeybee shade objects which block solar radiation toward the simulated rooms
# - `Run Energy Balance` - set to True to run the energy balance simulation
# - `Run Peak Loads` - set to True to run the peak loads simulation
# - `Graph max` - max value for the y axis of output graphs
# 
# ## Outputs
# - `Annual energy balance` - mesh visualising energy balance of each month of the year broken down into energy sources/sinks
# - `Daily cooling profile` - mesh visualising the cooling need during the design day (hottest day of the year)
# - `Daily heating profile` - mesh visualising the heating need during the design day (coldest day of the year)
# - `Cooling balance (design day)` - mesh visualising the cooling sources and sinks during the design day (hottest day of the year)
# - `Heating balance (design day)` - mesh visualising the heating sources and sinks during the design day (coldest day of the year)
# 
# ## Interpretation
# To be added...
panel_141 = Panel(annualloads.report)
honeybee_rooms_2 = Data(honeybee_rooms)
data_42 = Data(downloadepw_2.ddy_file)
peakloads = HBPeakLoads(rooms=honeybee_rooms_2, shades=shading_geometry, ddy_file=data_42, run_bal=run_peak_loads, run=run_peak_loads)  # -> report, peak_cool, peak_heat, cooling, heating, cool_bal, heat_bal; plug-in component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
panel_142 = Panel(peakloads.report)
annual_energy_balance_data_2 = Data(peakloads.cooling)
annual_energy_balance_data_3 = Data(peakloads.cool_bal)
annual_energy_balance_data_4 = Data(peakloads.heating)
annual_energy_balance_data_5 = Data(peakloads.heat_bal)
entwine_121 = Entwine(
    Branch00=total_load_eui,
    Branch01=annual_energy_balance_data,
    Branch02=annual_energy_balance_data_2,
    Branch03=annual_energy_balance_data_4,
    Branch04=annual_energy_balance_data_3,
    Branch05=annual_energy_balance_data_5,
    FlattenInputs=True)
freeze_gate_41 = StreamFreezeGate(Data=entwine_121, PassingSwitch=run_simple_energy_simulations_3, Hold=True)
bang_12 = ExplodeTree(Data=freeze_gate_41)  # -> Branch0, Branch1, Branch2, Branch3, Branch4, Branch5

# ---- group: Analyse performance
xdata_2 = LBDeconstructData(data=bang_12.Branch2)  # -> header, values; plug-in component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
xdata_3 = LBDeconstructData(data=bang_12.Branch1)  # -> header, values; plug-in component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
xdata_4 = LBDeconstructData(data=bang_12.Branch3)  # -> header, values; plug-in component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
xdata_5 = LBDeconstructData(data=bang_12.Branch4)  # -> header, values; plug-in component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
xdata_6 = LBDeconstructData(data=bang_12.Branch5)  # -> header, values; plug-in component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
smaller = SmallerThan(FirstNumber=xdata_4.values, SecondNumber="0")  # -> SmallerThan, OrEqualTo
smaller_2 = SmallerThan(FirstNumber=xdata_2.values, SecondNumber="0")  # -> SmallerThan, OrEqualTo
smaller_3 = SmallerThan(FirstNumber=xdata_3.values, SecondNumber="0")  # -> SmallerThan, OrEqualTo
smaller_4 = SmallerThan(FirstNumber=xdata_5.values, SecondNumber="0")  # -> SmallerThan, OrEqualTo
smaller_5 = SmallerThan(FirstNumber=xdata_6.values, SecondNumber="0")  # -> SmallerThan, OrEqualTo
sift_2 = SiftPattern(List=xdata_4.values, SiftPattern=smaller.OrEqualTo)  # -> Output0, Output1
sift_3 = SiftPattern(List=xdata_3.values, SiftPattern=smaller_3.OrEqualTo)  # -> Output0, Output1
sift_4 = SiftPattern(List=xdata_2.values, SiftPattern=smaller_2.OrEqualTo)  # -> Output0, Output1
sift_5 = SiftPattern(List=xdata_5.values, SiftPattern=smaller_4.OrEqualTo)  # -> Output0, Output1
sift_6 = SiftPattern(List=xdata_6.values, SiftPattern=smaller_5.OrEqualTo)  # -> Output0, Output1
flip = FlipMatrix(Data=sift_4.Output0)
flip_2 = FlipMatrix(Data=sift_4.Output1)
flip_3 = FlipMatrix(Data=sift_2.Output0)
flip_4 = FlipMatrix(Data=sift_2.Output1)
flip_5 = FlipMatrix(Data=sift_6.Output0)
flip_6 = FlipMatrix(Data=sift_6.Output1)
flip_7 = FlipMatrix(Data=sift_3.Output0)
flip_8 = FlipMatrix(Data=sift_3.Output1)
flip_9 = FlipMatrix(Data=sift_5.Output0)
flip_10 = FlipMatrix(Data=sift_5.Output1)
ma_10 = MassAddition(Input=flip_2)  # -> Result, PartialResults
ma_11 = MassAddition(Input=flip_4)  # -> Result, PartialResults
ma_12 = MassAddition(Input=flip)  # -> Result, PartialResults
ma_13 = MassAddition(Input=flip_6)  # -> Result, PartialResults
ma_14 = MassAddition(Input=flip_8)  # -> Result, PartialResults
ma_15 = MassAddition(Input=flip_3)  # -> Result, PartialResults
ma_16 = MassAddition(Input=flip_10)  # -> Result, PartialResults
ma_17 = MassAddition(Input=flip_5)  # -> Result, PartialResults
ma_18 = MassAddition(Input=flip_7)  # -> Result, PartialResults
ma_19 = MassAddition(Input=flip_9)  # -> Result, PartialResults
extremes = MinMax(Number=flatten(ma_12.Result))  # -> Minimum, Maximum
extremes_2 = MinMax(Number=flatten(ma_10.Result))  # -> Minimum, Maximum
extremes_3 = MinMax(Number=flatten(ma_15.Result))  # -> Minimum, Maximum
extremes_4 = MinMax(Number=flatten(ma_11.Result))  # -> Minimum, Maximum
extremes_5 = MinMax(Number=flatten(ma_17.Result))  # -> Minimum, Maximum
extremes_6 = MinMax(Number=flatten(ma_18.Result))  # -> Minimum, Maximum
extremes_7 = MinMax(Number=flatten(ma_13.Result))  # -> Minimum, Maximum
extremes_8 = MinMax(Number=flatten(ma_14.Result))  # -> Minimum, Maximum
extremes_9 = MinMax(Number=flatten(ma_19.Result))  # -> Minimum, Maximum
extremes_10 = MinMax(Number=flatten(ma_16.Result))  # -> Minimum, Maximum
cooling_balance_min = RemoteSender(extremes_10.Minimum)
heating_balance_min = RemoteSender(extremes_7.Minimum)
daily_heating_profile_min = RemoteSender(extremes_4.Minimum)
cooling_balance_max = RemoteSender(extremes_9.Maximum)
daily_cooling_profile_max = RemoteSender(extremes.Maximum)
daily_cooling_profile_min = RemoteSender(extremes_2.Minimum)
heating_balance_max = RemoteSender(extremes_5.Maximum)
annual_energy_balance_max = RemoteSender(extremes_6.Maximum)
annual_energy_balance_min = RemoteSender(extremes_8.Minimum)
daily_heating_profile_max = RemoteSender(extremes_3.Maximum)

# ----
# Daylight Glare Probability (DGP)
# # Daylight Glare Probability
# This cluster calculates the DGP for a specific view.
# 
# ## Instructions
# Enter all inputs and set `Run Glare analysis`to True to investigate glare potential for the set viewport and time. For a simple model this simulation takes around 50-60s.
# 
# ## Inputs
# - `EPW file URL` - the URL for a EPW file which describes the location
# - `Honeybee model` - the Honeybee model for analysis
# - `Viewport name` - the string name of a viewport in the Rhino model which shall be analysed
# - `Month` - month of the analysis period (1-12)
# - `Day` - date of the analysis period (1-31)
# - `Hour` - hour of the analysis period (0-23)
# - `Run Glare analysis` - set to True to run the analysis
# 
# ## Outputs
# - `Daylight glare probability (DGP)` - a value for the probability of glare occuring in this view at this time [%]
# - `HDR image` - a HDR image which can be visualised using LB ImageViewer to show what areas cause glare
# - `HDR false color image` - a HDR image with modified colors to more clearly see causes of glare
# 
# ## Interpretation
# To be added...
number_slider_41 = Slider(6, range=1..12)
txt_3 = Text("Perspective")
data_43 = Data(panel_36)
num_8 = Number(calculate_glare_probability_2)
num_9 = Number(calculate_glare_probability_2)

day = Number(Slider(21, range=1..31))
hour = Number(Slider(12, range=0..23))
month = Number(number_slider_41)

# ----
# Daylight (Illuminance, DA and UDI)
# Create analysis grid
# Alternatively create grid from surface
# # Daylight (Illuminance, DA and UDI)
# This cluster simulates illuminance for a specified hour of the year and daylight autonomy (DA) and useful daylight illuminance (UDI) for the entire year across an analysis surface.
# 
# ## Instructions
# Enter all inputs and set `Run Illuminance` or `Run Annual Daylight Simulation`to True to investigate daylight. The illuminance study covers a specified time step whereas the annual daylight simulation covers the full year. The `grid size` and `detail level` inputs can be used to improve the fidelity of the simulation at the cost of simulation time. The study can take several minutes, depending on the grid size and detail level.
# 
# ## Inputs
# - `EPW file URL` - the URL for a EPW file which describes the location
# - `Honeybee model` - the Honeybee model for analysis
# - `Grid size` - the resolution of the analysis grid in metres
# - `Detail level (0-2)` - level of detail for the daylight simulation, the higher value, the higher detail and the slower the simulation
# - `Month (illuminance)` - month of the analysis period  for the illuminance simulation (1-12)
# - `Day (illuminance)` - date of the analysis period for the illuminance simulation (1-31)
# - `Hour (illuminance)` - hour of the analysis period for the illuminance simulation (0-23)
# - `Run Illuminance` - set to True to run the illuminance analysis for the specified timestep
# - `Run Annual Daylight Simulation` - set to True to run the full year daylight simulation
# 
# ## Outputs
# - `Illuminance [Lux]` - a mesh visualising the amount of incident radiation which hits the analysis surface at the specified timestep
# - `Spatial Daylight Autonomy [-]` - the mean SDA for the entire analysis surface
# - `Daylight autonomy [%]` - a mesh visualising the value of DA across the analysis surface
# - `UDI [%]` - a mesh visualising the value of Useful Daylight Illuminance across the analysis surface
# - `UDI <50 [%]` - a mesh visualising the percentage of time that the lower treshold of illuminance is not achieved across the analysis surface
# - `UDI >3000 [%]` - a mesh visualising the percentage of time that the upper treshold of illuminance is exceeded across the analysis surface
# 
# ## Interpretation
# To be added...
number_slider_42 = Slider(12, range=0..23)
run_daylight_simulations_2 = RemoteReceiver(run_daylight_simulations)
number_slider_43 = Slider(0, range=0..2)
data_44 = Data(panel_36)
honeybee_model_2 = Data(freeze_gate_38)
epw_file_url_3 = Data(data_44)
downloadepw_3 = LBDownloadWeather(weather_URL=epw_file_url_3)  # -> epw_file, stat_file, ddy_file; plug-in component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
deconstructmodel_2 = HBDeconstructModel(model=honeybee_model_2)  # -> rooms, faces, apertures, doors, shades; plug-in component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
decnstrobj = HBDeconstructObject(hb_obj=deconstructmodel_2.rooms)  # -> faces, apertures, doors, shades; plug-in component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
vizquick = HBVisualizeQuick(hb_objs=decnstrobj.faces)  # -> geo; plug-in component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
area = Area(Geometry=vizquick)  # -> Area, Centroid
detail_level_0_2 = Number(number_slider_43)
pdecon = Deconstruct(Point=area.Centroid)  # -> XComponent, YComponent, ZComponent
sort = SortList(Keys=pdecon.ZComponent, ValuesA=vizquick)  # -> Keys, ValuesA
grid_size = Number(Slider(1, range=0..10))
honeybee_model_3 = Data(honeybee_model_2)
run_annual_daylight_simulation = Boolean(run_daylight_simulations_2)
detail_level_0_2_2 = Number(number_slider_43)
run_illuminance = Boolean(run_daylight_simulations_2)
cluster_6 = Cluster_6()
X = UnitX(Factor=Slider(0, range=0..400))

panel_143 = Panel(run_daylight_simulations_2)

# ---- group: Set up sensor grids
srf = Surface(sort.ValuesA)
item_32 = ListItem(List=srf, Index=Slider(0, range=0..5), Wrap=True)
flip_11 = Flip(Surface=item_32)  # -> Surface, Result
genpts = LBGeneratePointGrid(geometry=flip_11.Surface, grid_size=Slider(1, range=0..5), offset_dist=Slider(0.7, range=0..5))  # -> points, vectors, face_areas, mesh; plug-in component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
gridrooms = HBSensorGridFromRooms(rooms=honeybee_model_3, grid_size=grid_size, dist_floor=Slider(0.7, range=0..5))  # -> grid, points, mesh; plug-in component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
sensorgrid = HBSensorGrid(positions=genpts.points, directions=genpts.vectors, mesh=genpts.mesh)  # -> grid; plug-in component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
assigngridsviews = HBAssignGridsAndViews(model=honeybee_model_3, grids=flatten(gridrooms.grid))  # -> model; plug-in component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

# ----
# Revised LCA calculation
# # Life Cycle Assessment (LCA)
# This cluster calculates the embodied carbon for the input Honeybee model
# 
# ## Instructions
# Enter the inputs to calculate the GWP (Global Warming Potential), i.e. the embodied carbon, for the materials in the Honeybee model
# 
# ## Inputs
# - `Honeybee model` - the Honeybee model for analysis
# 
# ## Outputs
# - `Total GWP` - total GWP for the modules A1-A5.1 [kg CO2eq]
# - `GWP by element type` - GWP of each element type for the modules A1-A5.1 [kg CO2eq]
# - `Element types` - list of element types in the model
# 
# ## Interpretation
# To be added...
data_45 = Data(freeze_gate_38)
calculate_honeybee_model = BrimstoneCalculateEmbodiedCarbonOfHoneybeeModel(hb_model=data_45, kdb_json_data=get_categories.json_data)  # -> tot_emb_carbon, elements, el_emb_carbon
# ---------- calculate_honeybee_model: Python ----------
"""
Calculates embodied carbon for the elements of a Honeybee model if data is available
This component was inspired by the 'HB Color Face Attributes' component of Ladybug Tools 1.6.0

    Args:
        hb_model: Honeybee model for analysis
        kdb_json_data: Optional json data object for materials which do not include impact data

    Returns:
        tot_emb_carbon: total embodied carbon of model
        elements: element types in the model
        el_emb_carbon: embodied carbon for each element type in the model
"""

import scriptcontext
import brimstone
ghenv.Component.Message = brimstone.globals.version
import Grasshopper
import os
import csv, codecs

ghenv.Component.Name = 'Brimstone - Calculate Embodied Carbon of Honeybee Model'
ghenv.Component.NickName = 'Calculate Honeybee Model'

try:  # import the core honeybee dependencies
    from honeybee.model import Model
    from honeybee.properties import FaceProperties
    from honeybee.typing import clean_ep_string
except ImportError as e:
    raise ImportError('\nFailed to import honeybee:\n\t{}'.format(e))
    

# todo: magic string here - not good!
gwp_data_string = "Global Warming potential"
gwp_data_points = [
    "A1-A3 Conservative",
    "A4",
    "A5.1",
]

def main(hb_model):
    tot_emb_carbon = 0
    elements = []
    el_emb_carbon = []
    if not isinstance(hb_model, Model):
        raise Exception("hb_model input must be a valid honeybee model")
    faces = []
    apertures = []
    model_mats = []
    face_types = {}
    
    energy_properties = hb_model.properties.energy
    
    for material in energy_properties.materials:
        model_mats.append(material)
    for room in hb_model.rooms:
        faces.extend(room.faces)
        faces.extend(room.shades)
    faces.extend(hb_model.orphaned_faces)
    faces.extend(hb_model.orphaned_apertures)
    faces.extend(hb_model.orphaned_doors)
    faces.extend(hb_model.orphaned_shades)
    
    for face_obj in faces:
        if isinstance(face_obj.properties, FaceProperties):
            face_area = face_obj.area - face_obj.aperture_area
            face_type = face_obj.type
            
            face_impact = 0
            for lyr in face_obj.properties.energy.construction.layers:
                face_impact += get_face_impact(model_mats, lyr, face_area)
                """
                if lyr not in model_mats:
                    model_mats[lyr] = { area: face_area }
                else:
                    model_mats[lyr].area = model_mats[lyr].area + face_area
                """
                       
            if face_type not in face_types:
                face_types[face_type] = { "impact": face_impact }
            else:
                face_types[face_type]["impact"] += face_impact
                
            
            for aperture in face_obj.apertures:
                aperture_impact = get_aperture_impact(aperture)
                if "Aperture" not in face_types:
                    face_types["Aperture"] = { "impact": aperture_impact }
                else:
                    face_types["Aperture"]["impact"] += aperture_impact
    for face_type in face_types.items():
        face_impact = face_type[1]["impact"]
        tot_emb_carbon += face_impact
        elements.append(face_type[0])
        el_emb_carbon.append(face_impact)
    return tot_emb_carbon, elements, el_emb_carbon

def get_face_impact(materials, layer_name, face_area):
    for material in materials:
        if material.identifier == layer_name:
            abs_impact = 0
            gwp_data_keys = ["gwp_a1_a3", "gwp_a4", "gwp_a5_1"]
            if material.user_data and all(key in material.user_data.keys() for key in gwp_data_keys):
                impact = sum(float(material.user_data[key]) for key in gwp_data_keys)
                abs_impact = material.density*impact
            else:
                abs_impact = get_face_impact_from_material_name(material.identifier)
            return material.thickness*abs_impact*face_area
    brimstone.utils.warn(ghenv, "The calculation may be faulty as material " + layer_name + " was not found among the energy materials in the model.")
    return 0

# Gets material impact data from a honeybee material by referencing names in .csv file
def get_face_impact_from_material_name(material_name):
    csv_data_file = brimstone.globals.hb_kdb_csv_path
    csv_data_file_path = os.path.join(Grasshopper.Folders.UserObjectFolders[0], csv_data_file)
    if not os.path.exists(csv_data_file_path):
        raise Exception("Failed to open csv file, it should reside in [UserComponents folder]/brimstone_data/")
    kdb_name = check_name_in_kdb(material_name)
    if not kdb_name:
        with open(csv_data_file_path, 'r') as csv_file:
            file_reader = csv.DictReader(csv_file, delimiter=",")
            for row in file_reader:
                if row["HB Name"] == material_name:
                    kdb_name = clean_ep_string(row["Klimatdatabas name"])
                    if not kdb_name or kdb_name == "missing":
                        brimstone.utils.warn(ghenv, "The calculation may be faulty as impact data is missing for some of the materials in the model: " + material_name)
                        return 0
                    break
    if not kdb_name:
        brimstone.utils.warn(ghenv, "The calculation may be faulty as material " + material_name + " could not be matched to any material in the brimstone material database.")
        return 0
    
    return get_impact_from_json_data(kdb_name)

def check_name_in_kdb(material_name):
    if not kdb_json_data:
        brimstone.utils.warn(ghenv, "The calculation may be faulty as kdb_json_data is missing")
    else: 
        for resource in kdb_json_data["Resources"]:
            if clean_ep_string(resource["Name"]) == material_name:
                return material_name
    return ""
    
# TODO: currently only works for KDB windows
def get_aperture_impact(aperture):
    if hasattr(aperture.properties.energy.construction.properties, "conv_value"):
        c = aperture.properties.energy.construction
        return (float(c.properties.gwp_a1_a3) + float(c.properties.gwp_a4))\
            * float(c.properties.conv_value) * aperture.area
    if not len(aperture.properties.energy.construction.layers) == 1:
        brimstone.utils.warn(ghenv, "The calculation may be faulty as only one layer window constructions can be calculated.")
        return 0
    
    window_material = aperture.properties.energy.construction.layers[0]
    return get_impact_from_json_data(window_material)*aperture.area

def get_impact_from_json_data(kdb_name):
    if not kdb_json_data:
        brimstone.utils.warn(ghenv, "The calculation may be faulty as kdb_json_data is missing")
        return 0
    for resource in kdb_json_data["Resources"]:
        if clean_ep_string(resource["Name"]) == kdb_name:
            conv = resource["Conversions"][0]["Value"]
            
            for data_item in resource["DataItems"]:
                if data_item["PropertyName"] == gwp_data_string:
                    abs_impact = 0
                    for data_pt in gwp_data_points:
                        for data_val_item in data_item["DataValueItems"]:
                            if data_val_item["DataModuleCode"] == data_pt:
                                abs_impact += data_val_item["Value"]
                    return abs_impact*conv
            brimstone.utils.warn(ghenv, "The calculation may be faulty as material " + kdb_name + " has no GWP data in kdb_json_data")
            return 0
    brimstone.utils.warn(ghenv, "The calculation may be faulty as material " + kdb_name + " was not found in kdb_json_data")
    return 0

if __name__ == "__main__":
    try:
        flying = scriptcontext.sticky["brimstone_flying"]
    except:
        raise Exception("The 'Brimstone - Fly' component needs to exist on the canvas")
    tot_emb_carbon, elements, el_emb_carbon = main(hb_model)
# ---------- end calculate_honeybee_model ----------
get_resources = BrimstoneGetResources(json_data=get_categories.json_data, category="Energy and fuel")  # -> out, json_data, resources
# ---------- get_resources: Python ----------
"""Extracts resource names from a Klimatdatabas json object
    Inputs:
        json_data: dictionary with json data
        category: readable name of category to extract resources from
    Output:
        resources: List of resources in category"""

import scriptcontext

import brimstone
ghenv.Component.Message = brimstone.globals.version

ghenv.Component.Name = 'Brimstone - Get Resources'
ghenv.Component.NickName = 'Get Resources'

def main(json_data, category):
    resources = get_resources(json_data, category)
    return resources
    
def get_resources(json_data, category):
    pred = lambda v: v["Text"] == category
    resources = []
    for resource in json_data["Resources"]:
        if len(filter(pred, resource["Categories"])) > 0:
            resources.append(resource["Name"])
    return resources

if __name__ == "__main__":
    if not scriptcontext.sticky["brimstone_flying"]:
        raise Exception("The 'Brimstone - Fly' component needs to exist on the canvas")
    print json_data
    resources = main(json_data, category)
    
    json_data = [json_data]
# ---------- end get_resources ----------
list_11 = ItemSelector(
    get_resources.resources,
    {"Electricity, Swedish mix", "Diesel, reduction obligation  (2021)": "Diesel, reduction obligation (2021)", "Diesel, fossil", "Petrol, reduction obligation  (2021)": "Petrol, reduction obligation (2021)", "Petrol, 100% fossil", "District heating, Swedish average", "HVO100", "Gasol", "Wood pellets", "E85 ethanol", "Biogas", "Fuel oil 1", "Fuel oil 2-5", "FAME100", "ED95"}, selected="Electricity, Swedish mix")
total_gwp_2 = Data(calculate_honeybee_model.tot_emb_carbon)
panel_144 = Panel(total_gwp_2)
get_lca_data = BrimstoneGetLCAData(json_data=get_resources.json_data, resources="District heating, Swedish average")  # -> out, json_data, lca_data, indicators, values; inputs resources: list, addtl_indicators: list
#   port json_data: List of resources in category
# ---------- get_lca_data: Python ----------
"""Extracts LCA indicators and values from a Klimatdatabas json for a specific resource
    Inputs:
        json_data: dictionary with json data
        resources: list of readable names of resources
        addtl_indicators: list of additional keys to retrieve from resource
    Output:
        lca_data: list of dictionaries with LCA data for each resource
        indicators: list of indicators
        values: list of indicator values"""

import scriptcontext
import ghpythonlib.treehelpers as th
from collections import OrderedDict
import copy

import brimstone
ghenv.Component.Message = brimstone.globals.version

ghenv.Component.Name = 'Brimstone - Get LCA Data'
ghenv.Component.NickName = 'Get LCA Data'

# todo: magic string here - not good!
gwp_data_string = "Global Warming potential"

# keys: names in output dict, values: DataModuleCode in json db
gwp_data_entries = {
    "GWPA1A3Conservative": "A1-A3 Conservative",
    "GWPA1A3Typical": "A1-A3 Typical",
    "GWPA4": "A4",
    "GWPA5.1": "A5.1",
}

def main(json_data, resource, addtl_indicators):
    lca_data, indicators, values = [], [], []

    for i, resource in enumerate(resources):
        lca_data.append(get_lca_data(json_data, resource, addtl_indicators))
        resource_indicators, resource_values = get_indicator_values(lca_data[i], addtl_indicators)
        indicators.append(resource_indicators)
        values.append(resource_values)
    return lca_data, indicators, values
    
def get_lca_data(json_data, resource_name, addtl_indicators):
    resource_data = copy.deepcopy(
        find_obj_in_array(
            json_data["Resources"],
            "Name",
            resource_name
        )
    )
    
    if not resource_data:
        raise Exception(
            "Resource with name {resource_name} was not found in database."
            .format(resource_name = resource_name)
       )
    try:
        lca_data = extract_lca_data(resource_data, addtl_indicators)
    except KeyError:
        raise Exception("Format of JSON data is not supported.")
    return lca_data

def extract_lca_data(resource_data, addtl_indicators):
    lca_data = OrderedDict()
    resource_name = resource_data["Name"]
    
    lca_data["Name"] = resource_name
    
    if "Conversions" in resource_data:
        # can a resource have multiple conversions?
        lca_data["ConversionUnit"] = resource_data["Conversions"][0]["Unit"]
        lca_data["ConversionValue"] = resource_data["Conversions"][0]["Value"]
    
    if "InventoryUnit" in resource_data:
        lca_data["InventoryUnit"] = resource_data["InventoryUnit"]
    
    for data_prop in resource_data["DataItems"]:
        if data_prop["PropertyName"] == gwp_data_string:
            gwp_data = copy.deepcopy(data_prop)
            break
            
    if not gwp_data:
        raise Exception("GWP data not found for {resource_name}"
            .format(resource_name = resource_name))
    
    lca_data["GWPUnit"] = gwp_data["PropertyUnitCode"]
    for key in gwp_data_entries:
        value = find_obj_in_array(
            gwp_data["DataValueItems"],
            "DataModuleCode",
            gwp_data_entries[key]
        )
        if value is not None:
            lca_data[key] = value["Value"]
            
    for addtl_indicator in addtl_indicators:
        if addtl_indicator in resource_data:
            lca_data[addtl_indicator] = resource_data[addtl_indicator]
    
    return lca_data

def find_obj_in_array(array, key, value):
    return next((x for x in array if x[key] == value), None)

def get_indicator_values(lca_data, addtl_indicators):
    indicator_dict = OrderedDict([
        ("Name", "Name"),
        ("InventoryUnit", "Inventory unit"),
        ("ConversionUnit", "Conversion unit"),
        ("ConversionValue", "Conversion value"),
        ("GWPUnit", "GWP unit"),
        ("GWPA1A3Conservative", "GWP (A1-A3 Conservative)"),
        ("GWPA1A3Typical", "GWP (A1-A3 Typical)"),
        ("GWPA4", "GWP (A4)"),
        ("GWPA5.1", "GWP (A5.1)"),
    ])
    
    for addtl_indicator in addtl_indicators:
        indicator_dict[addtl_indicator] = addtl_indicator
    
    indicators, values = [], []
    
    for key, indicator_name in indicator_dict.items():
        indicator_value = lca_data[key] if key in lca_data else None
        if indicator_value:
            indicators.append(indicator_name)
            values.append(indicator_value)
    
    return indicators, values

if __name__ == "__main__":
    if not scriptcontext.sticky["brimstone_flying"]:
        raise Exception("The 'Brimstone - Fly' component needs to exist on the canvas")
    lca_data, indicators, values = main(json_data, resources, addtl_indicators)
    
    lca_data_treeable = []
    
    for resource_lca_data in lca_data:
        lca_data_treeable.append([resource_lca_data.keys(), resource_lca_data.values()])
    lca_data = th.list_to_tree(lca_data_treeable)
    indicators = th.list_to_tree(indicators)
    values = th.list_to_tree(values)
    json_data = [json_data]
# ---------- end get_lca_data ----------
area_m2 = Data(geoprop.floor_area)
energy_use_intensity_kwh_m2 = Data()
panel_145 = Panel("kg CO2eq")

# ----
# Wrong names?
gwp_by_element_type_2 = Data(calculate_honeybee_model.elements)
element_types_2 = Data(calculate_honeybee_model.el_emb_carbon)

panel_148 = Panel(gwp_by_element_type_2)
panel_149 = Panel(element_types_2)

# ----
# Calculate operational emissions
list_12 = ValueList({"Conservative": "conservative", "Typical": "typical"}, selected="Conservative")
calculate_operational_emissions = BrimstoneCalculateOperationalEmissions(lca_data=get_lca_data.lca_data, eui=energy_use_intensity_kwh_m2, area=area_m2, mode=list_12)  # -> out, gwp_total; inputs lca_data: tree
# ---------- calculate_operational_emissions: Python ----------
"""Calculates operational emissions based on energy resource, EUI and floor area
    Inputs:
        lca_data: tree containing GWP information for the selected resource
        eui: energy use intensity of building in kWh/m2
        gfa: gross floor area of building
        mode: mode of GWP calculation ("typical" or "conservative")
        
    Output:
        gwp_total: total GWP for the selected space"""

import scriptcontext
import brimstone
reload(brimstone)
ghenv.Component.Message = brimstone.globals.version

ghenv.Component.Name = 'Brimstone - Calculate Operational Emissions'
ghenv.Component.NickName = 'Calculate Operational Emissions'

import rhinoscriptsyntax as rs
import ghpythonlib.treehelpers as th

from collections import OrderedDict

inv_unit_string = 'kWh'
gwp_unit_string = 'kg CO2 eq./kWh' # GWP

def main(lca_data, eui, area, mode):
    if not lca_data.BranchCount:
        brimstone.utils.warn(ghenv, "LCA data is missing")
        return
    if eui != 0 and not eui:
        brimstone.utils.warn(ghenv, "EUI is missing")
        return
    if area != 0 and not area:
        brimstone.utils.warn(ghenv, "Area is missing")
        return
    
    lca_data = th.tree_to_list(lca_data)
    lca_data = [OrderedDict(zip(l[0], l[1])) for l in lca_data]
    gwp_total =  []
    
    for resource_lca_data in lca_data:
        try:
            gwp_total.append(calculate_gwp_total(resource_lca_data, eui, area, mode))
        except KeyError as e:
            raise Exception("GWP value could not be calculated: {error}".format(error = e))
    
    return gwp_total
    
def calculate_gwp_total(lca_data, eui, area, mode):    
    inv_unit = lca_data["InventoryUnit"]
    
    if inv_unit != inv_unit_string:
        raise Exception("Wrong unit for calculation of operational energy")    
    
    gwp_unit = lca_data["GWPUnit"]
    if gwp_unit != gwp_unit_string:
        raise Exception("Wrong unit for GWP calculation")
    
    if mode == "conservative":
        gwp_a1_a3_str = "GWPA1A3Conservative"
    elif mode == "typical":
        gwp_a1_a3_str = "GWPA1A3Typical"
    else:
        raise Exception("Mode not recognised (must be conservative or typical)")
    
    gwp_impact = (
        float(lca_data[gwp_a1_a3_str])
    )
    
    gwp_total = (
        float(lca_data[gwp_a1_a3_str])
    ) * area * eui
        
    return gwp_total

if __name__ == "__main__":
    if not scriptcontext.sticky["brimstone_flying"]:
        raise Exception("The 'Brimstone - Fly' component needs to exist on the canvas")   
    gwp_total = main(lca_data, eui, area, mode)
    gwp_total = th.list_to_tree(gwp_total)
# ---------- end calculate_operational_emissions ----------
operational_gwp_total_kg_co2eq_year = Data(calculate_operational_emissions.gwp_total)
panel_150 = Panel(operational_gwp_total_kg_co2eq_year)
panel_151 = Panel("kg CO2eq/year")
multiplication_2 = Multiplication(A=Slider(50, range=0..100), B=panel_150)
lca_operational_gwp_total = RemoteSender(multiplication_2)

lca_operational_gwp_total_2 = RemoteReceiver(lca_operational_gwp_total)
expression_70 = Expression(x=lca_operational_gwp_total_2, Expression="Round(x, 2)")
format_8 = Format(Format=panel_43, Culture=127, Data0=expression_70)
setlabel_4 = SetLabelContents(LabelToModify=label_27, NewLabelContents=format_8)

# ---- group: Glare analysis
epw_file_url_4 = Data(data_43)
viewport_name = Data(txt_3)
pt_18 = ConstructPoint(XCoordinate=Slider(6, range=0..10), YCoordinate=Slider(5, range=0..10), ZCoordinate=Slider(2, range=0..10))
viewport = HBViewFromViewport(name=viewport_name, viewport=viewport_name, view_type=Slider(4, range=0..5))  # -> view; plug-in component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
pt_19 = ConstructPoint(XCoordinate=Slider(4, range=0..10), YCoordinate=Slider(4, range=0..10), ZCoordinate=Slider(1.6, range=0..10))
vec2pt = Vector2Pt(PointA=pt_19, PointB=pt_18, Unitize=False)  # -> Vector, Length
assigngridsviews_2 = HBAssignGridsAndViews(model=epw_file_url, views=flatten(viewport))  # -> model; plug-in component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
view = HBView(position=pt_19, direction=vec2pt.Vector, view_type=Slider(4, range=0..5))  # -> view; plug-in component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
hoy = LBCalculateHOY(month=month, day=day, hour=hour)  # -> flatten(hoy), flatten(doy), flatten(date); plug-in component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

# ----
downloadepw_4 = LBDownloadWeather(weather_URL=epw_file_url_4)  # -> epw_file, stat_file, ddy_file; plug-in component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

# ---- group: Glare analysis (continued)
importloc = LBImportLocation(epw_file=downloadepw_4.epw_file)  # -> location; plug-in component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
ciesky = HBCIEStandardSky(location=importloc, month=month, day=day, hour=hour, type=0)  # -> sky; plug-in component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
pitview = HBPointInTimeViewBased(model=assigngridsviews_2, sky=ciesky, run=run_glare_analysis)  # -> report, results; plug-in component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
glare = HBGlarePostprocess(hdr=pitview.results)  # -> DGP, category, glare_indices, check_hdr; plug-in component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
merge_13 = Merge(Data1=hoy.date, Data2=glare.category, Data3=glare.DGP)
daylight_glare_probability_dgp = Data(glare.DGP)
join_2 = TextJoin(Text=merge_13)
falsecolor = HBFalseColor(hdr=pitview.results, max=Slider(2300, range=0..10000), contour_lines=Toggle(True))  # -> hdr; plug-in component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
adjusthdr = HBAdjustHDR(hdr=pitview.results, adj_expos=Toggle(True), label=join_2)  # -> hdr; plug-in component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
hdr_false_color_image = Data(falsecolor)
hdr_image = Data(adjusthdr)

# ----
lca_gwp_by_element_type_3 = RemoteReceiver(lca_gwp_by_element_type)
lca_operational_gwp_total_3 = RemoteReceiver(lca_operational_gwp_total)
lca_element_types_3 = RemoteReceiver(lca_element_types)
lca_total_gwp_4 = RemoteReceiver(lca_total_gwp)
entwine_122 = Entwine(
    Branch00=lca_element_types_3,
    Branch01=lca_gwp_by_element_type_3,
    Branch02=lca_total_gwp_4,
    Branch03=lca_operational_gwp_total_3,
    FlattenInputs=True)  # -> flatten(Result)
hasdata_13 = DataExists(Data=entwine_122)
filter_55 = StreamFilter(Gate=hasdata_13, Stream0="False", Stream1=entwine_122)
lng_23 = ListLength(List=filter_55)

# ----
# [Temporary]
honeybee_model_exists_5 = RemoteReceiver(honeybee_model_exists)
and_33 = GateAnd(A=honeybee_model_exists_5, B=lng_23)

lca_data_exists = RemoteSender(and_33)

lca_data_exists_2 = RemoteReceiver(lca_data_exists)
lca_data_exists_3 = RemoteReceiver(lca_data_exists)
hideshow_37 = HideShowElement(ElementToHideShow=label_25, Show=invert(lca_data_exists_3), Collapse=True, Disable=False)
hideshow_38 = HideShowElement(ElementToHideShow=[label_26, label_27, true_button_7], Show=lca_data_exists_2, Collapse=True, Disable=False)

# ---- group: Analyse performance (continued)
daily_heating_profile_max_2 = RemoteReceiver(daily_heating_profile_max)
daily_heating_profile_min_2 = RemoteReceiver(daily_heating_profile_min)
daily_cooling_profile_max_2 = RemoteReceiver(daily_cooling_profile_max)
daily_cooling_profile_min_2 = RemoteReceiver(daily_cooling_profile_min)
heating_balance_max_2 = RemoteReceiver(heating_balance_max)
heating_balance_min_2 = RemoteReceiver(heating_balance_min)
cooling_balance_max_2 = RemoteReceiver(cooling_balance_max)
cooling_balance_min_2 = RemoteReceiver(cooling_balance_min)
annual_energy_balance_max_2 = RemoteReceiver(annual_energy_balance_max)
annual_energy_balance_min_2 = RemoteReceiver(annual_energy_balance_min)

# ----
cluster_7 = Cluster_4(int=heating_balance_max_2)
cluster_8 = Cluster_5(x=daily_cooling_profile_min_2)
cluster_9 = Cluster_4(int=daily_cooling_profile_max_2)
cluster_10 = Cluster_4(int=cooling_balance_max_2)
cluster_11 = Cluster_5(x=heating_balance_min_2)
cluster_12 = Cluster_5(x=cooling_balance_min_2)
cluster_13 = Cluster_5(x=daily_heating_profile_min_2)
cluster_14 = Cluster_4(int=daily_heating_profile_max_2)
cluster_15 = Cluster_5(x=annual_energy_balance_min_2)
cluster_16 = Cluster_4(int=annual_energy_balance_max_2)

# ---- group: Analyse performance / Simple energy balance
colrange_6 = LBColorRange(index=Slider(19, range=0..100))  # -> colors; plug-in component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
legendpar_2 = LBLegendParameters(min=cluster_15, max=cluster_16, colors=colrange_6)  # -> leg_par; plug-in component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
monthlychart_4 = LBMonthlyChart(
    data=bang_12.Branch1,
    base_pt=simple_energy_simulation_base_point_2,
    x_dim=simple_energy_simulation_width_2,
    y_dim=simple_energy_simulation_height_2,
    stack=Toggle(True),
    legend_par=legendpar_2)  # -> report, data_mesh, data_lines, col_lines, legend, borders, labels, y_title, title, vis_set; plug-in component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

# ---- group: Analyse performance (continued)
legendpar_3 = LBLegendParameters(min=cluster_11, max=cluster_7)  # -> leg_par; plug-in component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
cluster_17 = Cluster_3(min=cluster_12, max=cluster_10, colors=colrange_4)
cluster_18 = Cluster_3(min=cluster_13, max=cluster_14, colors=colrange_5)
annual_energy_balance = Data(flatten([monthlychart_4.data_mesh, monthlychart_4.data_lines, monthlychart_4.col_lines, monthlychart_4.legend, monthlychart_4.borders, monthlychart_4.labels, monthlychart_4.y_title, monthlychart_4.title]))

# ---- group: Analyse performance / Simple peak loads
legendpar_4 = LBLegendParameters(min=cluster_8, max=cluster_9)  # -> leg_par; plug-in component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
toggle_8 = BooleanToggle(True)
toggle_9 = BooleanToggle(True)
toggle_10 = BooleanToggle(True)
toggle_11 = BooleanToggle(True)
monthlychart_5 = LBMonthlyChart(
    data=bang_12.Branch4,
    base_pt=simple_energy_simulation_base_point_4,
    x_dim=simple_energy_simulation_width_4,
    y_dim=simple_energy_simulation_height_4,
    stack=toggle_8,
    time_marks=toggle_8,
    legend_par=cluster_18)  # -> report, data_mesh, data_lines, col_lines, legend, borders, labels, y_title, title, vis_set; plug-in component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
monthlychart_6 = LBMonthlyChart(
    data=bang_12.Branch2,
    base_pt=simple_energy_simulation_base_point_3,
    x_dim=simple_energy_simulation_width_3,
    y_dim=simple_energy_simulation_height_3,
    stack=toggle_9,
    time_marks=toggle_9,
    legend_par=legendpar_4)  # -> report, data_mesh, data_lines, col_lines, legend, borders, labels, y_title, title, vis_set; plug-in component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
monthlychart_7 = LBMonthlyChart(
    data=bang_12.Branch4,
    base_pt=simple_energy_simulation_base_point_5,
    x_dim=simple_energy_simulation_width_5,
    y_dim=simple_energy_simulation_height_5,
    stack=toggle_10,
    time_marks=toggle_10,
    legend_par=cluster_17)  # -> report, data_mesh, data_lines, col_lines, legend, borders, labels, y_title, title, vis_set; plug-in component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
monthlychart_8 = LBMonthlyChart(
    data=bang_12.Branch5,
    base_pt=simple_energy_simulation_base_point_6,
    x_dim=simple_energy_simulation_width_6,
    y_dim=simple_energy_simulation_height_6,
    stack=toggle_11,
    time_marks=toggle_11,
    legend_par=legendpar_3)  # -> report, data_mesh, data_lines, col_lines, legend, borders, labels, y_title, title, vis_set; plug-in component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
daily_heating_profile = Data(flatten([monthlychart_5.data_mesh, monthlychart_5.data_lines, monthlychart_5.col_lines, monthlychart_5.legend, monthlychart_5.borders, monthlychart_5.labels, monthlychart_5.y_title, monthlychart_5.title]))
daily_cooling_profile = Data(flatten([monthlychart_6.data_mesh, monthlychart_6.data_lines, monthlychart_6.col_lines, monthlychart_6.legend, monthlychart_6.borders, monthlychart_6.labels, monthlychart_6.y_title, monthlychart_6.title]))
heating_balance_design_day = Data(flatten([monthlychart_8.data_mesh, monthlychart_8.data_lines, monthlychart_8.col_lines, monthlychart_8.legend, monthlychart_8.borders, monthlychart_8.labels, monthlychart_8.y_title, monthlychart_8.title]))
cooling_balance_design_day = Data(flatten([monthlychart_7.data_mesh, monthlychart_7.data_lines, monthlychart_7.col_lines, monthlychart_7.legend, monthlychart_7.borders, monthlychart_7.y_title, monthlychart_7.labels, monthlychart_7.title]))

# ----
panel_152 = Panel(legendpar_2)

simple_energy_simulation_type_2 = RemoteReceiver(simple_energy_simulation_type)
data_46 = Data(flatten(bang_12.Branch1))
daily_cooling_profile_2 = Data(flatten(annual_energy_balance))
daily_cooling_profile_3 = Data(flatten(daily_cooling_profile))
daily_cooling_profile_4 = Data(flatten(daily_heating_profile))
daily_cooling_profile_5 = Data(flatten(cooling_balance_design_day))
daily_cooling_profile_6 = Data(flatten(heating_balance_design_day))
data_47 = Data(flatten(bang_12.Branch0))
xdata_7 = LBDeconstructData(data=data_46)  # -> header, values; plug-in component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
filter_56 = StreamFilter(
    Gate=simple_energy_simulation_type_2,
    Stream0=daily_cooling_profile_2,
    Stream1=daily_cooling_profile_3,
    Stream2=daily_cooling_profile_4,
    Stream3=daily_cooling_profile_5,
    Stream4=daily_cooling_profile_6)
item_33 = ListItem(List=data_47, Index=0, Wrap=True)
total_load_eui_2 = RemoteSender(data_47)
null_20 = NullItem(Item=item_33)  # -> NullFlags, InvalidFlags, Description
annual_energy_balance_data_header = RemoteSender(xdata_7.header)
annual_energy_balance_data_values = RemoteSender(xdata_7.values)
bool_36 = Boolean(invert(null_20.NullFlags))
sortbytype_2 = SortObjectsByType(RhinoObjects=filter_56)  # -> Points, Curves, Surfaces, Breps, Meshes, TextObjects, HatchObjects, LightObjects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
current_tab_29 = RemoteReceiver(current_tab)
simple_energy_data_exists = RemoteSender(bool_36)
line_2 = Line(sortbytype_2.Curves)
expression_71 = Expression(x="Analysis module", y=current_tab_29, Expression="x=y")
bbox_3 = BoundingBox(Content=sortbytype_2.Meshes, Plane=PlaneXY(0, 0, 0), UnionBox=True)  # -> Box, Box_2
null_21 = NullItem(Item=line_2)  # -> NullFlags, InvalidFlags, Description
data_48 = Data([sortbytype_2.Other, sortbytype_2.Meshes])
sift_7 = SiftPattern(List=sortbytype_2.Curves, SiftPattern=null_21.NullFlags)  # -> Output0, Output1
gate_50 = StreamGate(Stream=bbox_3.Box, Gate=expression_71)  # -> Target0, Target1
preview_19 = CustomPreview(Geometry=sift_7.Output1, Material=ColourSwatch(SwatchColor=RGB(84, 84, 84)))
zoom_simple_energy_simulation_bounding_b = RemoteSender(gate_50.Target1)  # "zoom_simple_energy_simulation_bounding_box"

zoom_simple_energy_simulation_bounding_b_2 = RemoteReceiver(zoom_simple_energy_simulation_bounding_b)  # "zoom_simple_energy_simulation_bounding_box"
zbb_3 = ZoomBoundingBox(Box=zoom_simple_energy_simulation_bounding_b_2, Run=zoom_simple_energy_simulation_2)

simple_energy_data_exists_2 = RemoteReceiver(simple_energy_data_exists)
simple_energy_data_exists_3 = RemoteReceiver(simple_energy_data_exists)
simple_energy_data_exists_4 = RemoteReceiver(simple_energy_data_exists)
or_26 = GateOr(A=simple_energy_data_exists_2, B=filter_4)
rec_17 = DataRecorder(or_26, DataLimit=-10, RecordData=True)
hideshow_39 = HideShowElement(ElementToHideShow=true_button_8, Show=simple_energy_data_exists_3, Collapse=True, Disable=False)
hideshow_40 = HideShowElement(ElementToHideShow=button_14, Show=simple_energy_data_exists_4, Collapse=True, Disable=False)
ma_20 = MassAddition(Input=flatten(rec_17))  # -> Result, PartialResults
mod_2 = Modulus(A=ma_20.Result, B=Slider(2, range=0..10))
bool_37 = Boolean(mod_2)
simple_energy_data_exists_5 = RemoteReceiver(simple_energy_data_exists)
simple_energy_data_exists_6 = RemoteReceiver(simple_energy_data_exists)
filter_57 = StreamFilter(Gate=bool_37, Stream0="Simulation failed...", Stream1="Daylight simulation is running...")
gate_51 = StreamGate(Stream=filter_57, Gate=freeze_gate_13)  # -> Target0, Target1
bool_38 = Boolean(invert(simple_energy_data_exists_5))
hideshow_41 = HideShowElement(ElementToHideShow=stack_36, Show=simple_energy_data_exists_6, Collapse=True, Disable=False)
hideshow_42 = HideShowElement(ElementToHideShow=tb_9, Show=bool_38, Collapse=simple_energy_data_exists_5, Disable=False)
settextblock_10 = SetTextBlockContents(TextBlockToModify=tb_9, NewTextBlockContents=gate_51.Target1)

annual_energy_balance_data_header_2 = RemoteReceiver(annual_energy_balance_data_header)
split_6 = TextSplit(Text=annual_energy_balance_data_header_2, Separators=":")
item_34 = ListItem(List=split_6, Index="-1", Wrap=True)
annual_energy_balance_data_values_2 = RemoteReceiver(annual_energy_balance_data_values)
fragment_4 = TextFragment(Text=item_34, Start="1")  # -> flatten(Fragment)
panel_153 = Panel(fragment_4)
num_10 = Number(annual_energy_balance_data_values_2)
long = LongestList(ListA=fragment_4, ListB=entwine_69, PaddingMode=2)  # -> ListA, ListB
short = ShortestList(ListA=fragment_4, ListB=entwine_69, TrimMode=2)  # -> ListA, ListB
lng_24 = ListLength(List=fragment_4)
lng_25 = ListLength(List=long.ListA)
equals_31 = Equality(FirstNumber=lng_24, SecondNumber=lng_25)  # -> Equality, Inequality
filter_58 = StreamFilter(Gate=equals_31.Inequality, Stream0=long.ListB, Stream1=short.ListB)
panel_154 = Panel(annual_energy_balance_data_header_2)

txt_4 = Text(filter_58)
pt_20 = Point(txt_4)

division_3 = Division(A=pt_20, B="255")
len_5 = TextLength(Text=division_3)
subtraction_7 = Subtraction(A=len_5, B=Slider(2, range=0..10))
fragment_5 = TextFragment(Text=division_3, Start="1", Count=subtraction_7)
py3_29 = Python3Script(file_location=nextfile_3, title="Energy Intensity (kWh/m2)", labels=fragment_4, values=num_10, colors=fragment_5)  # -> out, a; inputs labels: list, values: tree, colors: list
# ---------- py3_29: Python ----------
# requirements: matplotlib
# requirements: numpy

import matplotlib.pyplot as plt
import random as rd
import numpy as np
import matplotlib.colors as mplcolors
import ghpythonlib.treehelpers as th


fig, ax = plt.subplots()

x = ["Jan", "Feb", "Mar", "Apr", "May", "Jun",
"Jul", "Aug", "Sep", "Oct", "Nov", "Dec"]

values = th.tree_to_list(values)

bar_labels = labels

for i in range(len(colors)):
    colors[i] = colors[i].split(',')
    colors[i] = [float(j) for j in colors[i]]
    colors[i] = tuple(colors[i])

fig, ax = plt.subplots(figsize=(14, 6))

positive = np.zeros(len(x))
negative = np.zeros(len(x))


for i in range(len(values)):
    color = colors[i]
    if sum(values[i]) >= 0:
        ax.bar(x, values[i], label=bar_labels[i], color=colors[i],
        bottom=positive, align="edge")
        positive += values[i]
    elif sum(values[i]) < 0:
        ax.bar(x, values[i], label=bar_labels[i], color=colors[i],
        bottom=negative, align="edge")
        negative += values[i]


ax.set_ylabel(title)
ax.set_title(title)

y_max, y_min = max(positive)*1.1, min(negative)*1.1
ax.set_ylim(y_min, y_max)

plt.subplots_adjust(right=0.8)

ax.legend(title="Energy intensity", bbox_to_anchor=(1.0, 1),
loc='upper left', reverse=True)

plt.savefig(file_location)
a = file_location

#plt.show()
# ---------- end py3_29 ----------
panel_155 = Panel(py3_29.a)
panel_156 = Panel(py3_29.out)

total_load_eui_3 = RemoteReceiver(total_load_eui_2)
ma_21 = MassAddition(Input=total_load_eui_3)  # -> Result, PartialResults
round = Round(Number=ma_21.Result)  # -> Nearest, Floor, Ceiling
format_9 = Format(Format=panel_59, Culture=127, Data0=round.Nearest)
settextblock_11 = SetTextBlockContents(TextBlockToModify=tb_13, NewTextBlockContents=format_9)
setimg_2 = SetImage(ImageToModify=image_4, NewImagePath=py3_29.a)

# ---- group: Daylight Factor
# Daylight Factor [%]
number_slider_44 = Slider(0, range=0..2)
falsestart_2 = LBFalseStartToggle(False)
radpar = HBRadianceParameter(recipe_type=number_slider_44, detail_level=detail_level_0_2)  # -> rad_par; plug-in component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
run_daylight_factor = Data(falsestart_2)
cluster_19 = Cluster_6()

# ----
grid_mesh = Data(gridrooms.mesh)
honeybee_model_4 = Data(assigngridsviews)
honeybee_model_5 = Data(honeybee_model_4)

# ---- group: Daylight Factor (continued)
daylightfactor = HBDaylightFactor(model=honeybee_model_5, radiance_par=radpar, run=run_daylight_factor)  # -> report, results; plug-in component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
median = GhPythonScript(list=daylightfactor.results)  # -> out, median; inputs list: list
# ---------- median: Python ----------
"""Provides a scripting component.
    Inputs:
        list: list of numeric values to retrieve median
    Output:
        median: median value in list

__author__ = "sawen"
__version__ = "2024.06.14"
"""

import statistics

def main(list):
    return statistics.median(list)

if __name__ == "__main__":
    if list:
        median = main(list)
# ---------- end median ----------
heatmap = LBSpatialHeatmap(values=flatten(daylightfactor.results), legend_par=cluster_19, legend_title="Daylight Factor [%]")  # -> mesh, legend, title, colors, legend_par, vis_set; plug-in component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
daylight_factor = Data(flatten([heatmap.mesh, heatmap.legend, heatmap.title]))

# ---- group: Simulate illuminance
importloc_2 = LBImportLocation(epw_file=downloadepw_3.epw_file)  # -> location; plug-in component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
day_illuminance = Number(Slider(21, range=1..31))
hour_illuminance = Number(number_slider_42)
month_illuminance = Number(Slider(6, range=1..12))
radpar_2 = HBRadianceParameter(recipe_type=Slider(0, range=0..2), detail_level=detail_level_0_2_2)  # -> rad_par; plug-in component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
ciesky_2 = HBCIEStandardSky(location=importloc_2, month=month_illuminance, day=day_illuminance, hour=hour_illuminance, type=0)  # -> sky; plug-in component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
mjoin = MeshJoin(Meshes=grid_mesh)
legendpar_5 = LBLegendParameters(max=Slider(2000, range=0..10000))  # -> leg_par; plug-in component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
pitgrid = HBPointInTimeGridBased(model=honeybee_model_4, sky=ciesky_2, radiance_par=radpar_2, run=run_illuminance)  # -> report, flatten(results); plug-in component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
heatmap_2 = LBSpatialHeatmap(values=pitgrid.results, mesh=mjoin, legend_par=legendpar_5, legend_title="Lux", global_title="Illuminance")  # -> mesh, legend, title, colors, legend_par, vis_set; plug-in component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

# ----
num_11 = Number(daylight_glare_probability_dgp)

data_49 = Data(num_11)
data_50 = Data(hdr_image)
data_51 = Data(hdr_false_color_image)
calculate_glare_probability_3 = RemoteReceiver(calculate_glare_probability)
entwine_123 = Entwine(Branch00=data_49, Branch01=data_50, Branch02=data_51, FlattenInputs=True)
freeze_gate_42 = StreamFreezeGate(Data=entwine_123, PassingSwitch=calculate_glare_probability_3, Hold=True)
bang_13 = ExplodeTree(Data=freeze_gate_42)  # -> Branch0, Branch1, Branch2
hasdata_14 = DataExists(Data=bang_13.Branch0)
data_52 = Data(bang_13.Branch1)
data_53 = Data(bang_13.Branch2)
data_54 = Data(bang_13.Branch0)
glare_data_exists = RemoteSender(hasdata_14)
glare__hdr_false_color_image = RemoteSender(data_53)
glare__hdr_image = RemoteSender(data_52)
glare_daylight_probability = RemoteSender(data_54)

imageviewer = LBImageViewer(ImagePath_=data_52, _scale_="1", DisableClickable=False, SaveImgWithCoords=False, scale=1)  # -> ImagePath, Values, GIF
imageviewer_2 = LBImageViewer(ImagePath_=data_53, _scale_="1", DisableClickable=False, SaveImgWithCoords=False, scale=1)  # -> ImagePath, Values, GIF

panel_157 = Panel(imageviewer_2.Values)
panel_158 = Panel(imageviewer_2.GIF)
panel_159 = Panel(imageviewer_2.ImagePath)

glare_daylight_probability_2 = RemoteReceiver(glare_daylight_probability)
glare__hdr_false_color_image_2 = RemoteReceiver(glare__hdr_false_color_image)
glare__hdr_image_2 = RemoteReceiver(glare__hdr_image)
expression_72 = Expression(x=glare_daylight_probability_2, Expression="Round(x, 2)")
glare_data_exists_2 = RemoteReceiver(glare_data_exists)
py3_30 = Python3Script(hdr_file_path=glare__hdr_false_color_image_2)  # -> png_file_path
# ---------- py3_30: Python ----------
# requirements: pillow
# requirements: numpy

from PIL import Image
import numpy as np
import imageio.v2 as imageio

# Load the HDR image
hdr_image = imageio.imread(hdr_file_path)

height, width, channels = hdr_image.shape

hdr_image = hdr_image.reshape((height, width, channels))

# Step 2: Tone mapping (simple normalization)
hdr_min = hdr_image.min()
hdr_max = hdr_image.max()

ldr_image = (hdr_image - hdr_min) / (hdr_max - hdr_min) * 255.0
ldr_image = ldr_image.astype(np.uint8)

# Step 3: Convert numpy array to an image using Pillow
ldr_image_pil = Image.fromarray(ldr_image)

# Step 4: Save the image as a PNG or JPG
save_path = r"C:\Users\Isac\Desktop\Toivo_Chalmers\Heath local\png_image_false_color.png"
ldr_image_pil.save(save_path)  # or 'output_image.jpg'

png_file_path = save_path
# ---------- end py3_30 ----------
py3_31 = Python3Script(hdr_file_path=glare__hdr_image_2)  # -> png_file_path
# ---------- py3_31: Python ----------
# requirements: pillow
# requirements: numpy

from PIL import Image
import numpy as np
import imageio.v2 as imageio
import os

# Load the HDR image
hdr_image = imageio.imread(hdr_file_path)

height, width, channels = hdr_image.shape

hdr_image = hdr_image.reshape((height, width, channels))

# Step 2: Tone mapping (simple normalization)
hdr_min = hdr_image.min()
hdr_max = hdr_image.max()

ldr_image = (hdr_image - hdr_min) / (hdr_max - hdr_min) * 255.0
ldr_image = ldr_image.astype(np.uint8)

# Step 3: Convert numpy array to an image using Pillow
ldr_image_pil = Image.fromarray(ldr_image)

# Step 4: Save the image as a PNG or JPG
save_path = r"C:\Users\Isac\Desktop\Toivo_Chalmers\Heath local\png_image_original_color_.png"
if os.path.exists(save_path):
  os.remove(save_path) # one file at a time
ldr_image_pil.save(save_path)  # or 'output_image.jpg'

print("HDR image converted to PNG/JPG successfully.")

png_file_path = save_path
# ---------- end py3_31 ----------
format_10 = Format(Format=panel_42, Culture=127, Data0=expression_72)
or_27 = GateOr(A=glare_data_exists_2, B=filter_2)
setlabel_5 = SetLabelContents(LabelToModify=label_28, NewLabelContents=format_10)
rec_18 = DataRecorder(or_27, DataLimit=-10, RecordData=True)
setimg_3 = SetImage(ImageToModify=image, NewImagePath=py3_30)
setimg_4 = SetImage(ImageToModify=image_2, NewImagePath=py3_31)
panel_160 = Panel(py3_31)
ma_22 = MassAddition(Input=flatten(rec_18))  # -> Result, PartialResults
mod_3 = Modulus(A=ma_22.Result, B=Slider(2, range=0..10))
bool_39 = Boolean(mod_3)
glare_data_exists_3 = RemoteReceiver(glare_data_exists)
filter_59 = StreamFilter(Gate=bool_39, Stream0="Simulation failed...", Stream1="Daylight simulation is running...")
glare_data_exists_4 = RemoteReceiver(glare_data_exists)
gate_52 = StreamGate(Stream=filter_59, Gate=freeze_gate_10)  # -> Target0, Target1
bool_40 = Boolean(invert(glare_data_exists_3))
settextblock_12 = SetTextBlockContents(TextBlockToModify=tb_11, NewTextBlockContents=gate_52.Target1)
hideshow_43 = HideShowElement(ElementToHideShow=tb_11, Show=bool_40, Collapse=glare_data_exists_3, Disable=False)
hideshow_44 = HideShowElement(ElementToHideShow=[label_28, image_2, image, expander], Show=glare_data_exists_4, Collapse=True, Disable=False)

# ---- group: Spatial climate based daylight
panel_161 = Panel("-t 50 -lt 200 -ut 2000")
radpar_3 = HBRadianceParameter(recipe_type=Slider(2, range=0..2), detail_level=detail_level_0_2, additional_par="-ab 4")  # -> rad_par; plug-in component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
wea = HBWeaFromEPW(epw_file=downloadepw_3.epw_file)  # -> wea; plug-in component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
analysis_mesh = Mesh(grid_mesh)
annualdaylight = HBAnnualDaylight(
    model=honeybee_model_5,
    wea=wea,
    schedule="Generic Office Occupancy",
    radiance_par=radpar_3,
    run=run_annual_daylight_simulation)  # -> report, results, DA, cDA, UDI, UDI_low, UDI_up; plug-in component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
panel_162 = Panel(radpar_3)
mjoin_2 = MeshJoin(Meshes=analysis_mesh)
cluster_20 = Cluster_6()
cluster_21 = Cluster_6()
cluster_22 = Cluster_6()
heatmap_3 = LBSpatialHeatmap(values=flatten(annualdaylight.UDI_up), mesh=mjoin_2, legend_par=cluster_20, legend_title="UDI >3000 [%]")  # -> mesh, legend, title, colors, legend_par, vis_set; plug-in component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
heatmap_4 = LBSpatialHeatmap(values=flatten(annualdaylight.UDI_low), mesh=mjoin_2, legend_par=cluster_21, legend_title="UDI <50 [%]")  # -> mesh, legend, title, colors, legend_par, vis_set; plug-in component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
heatmap_5 = LBSpatialHeatmap(values=flatten(annualdaylight.UDI), mesh=mjoin_2, legend_par=cluster_22, legend_title="UDI [%]")  # -> mesh, legend, title, colors, legend_par, vis_set; plug-in component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
sda = HBSpatialDaylightAutonomy(DA=flatten(annualdaylight.DA), mesh=mjoin_2)  # -> report, sDA, pass_fail; plug-in component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
heatmap_6 = LBSpatialHeatmap(values=flatten(annualdaylight.DA), mesh=mjoin_2, legend_par=cluster_6, legend_title="Daylight autonomy [%]")  # -> mesh, legend, title, colors, legend_par, vis_set; plug-in component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
X_2 = UnitX(Factor=Slider(150, range=0..400))
X_3 = UnitX(Factor=Slider(100, range=0..400))
X_4 = UnitX(Factor=Slider(50, range=0..400))
panel_163 = Panel(sda.sDA)

# ---- group: Extract hourly data from annual results
facen = FaceNormals(Mesh=mjoin_2)  # -> Centers, Normals
pt_21 = Point(facen.Centers)
flatten = FlattenTree(Tree=pt_21, Path="{0}")
item_35 = ListItem(List=flatten, Index=Slider(581, range=0..1000), Wrap=True)
number_slider_45 = Slider(0.1, range=0..0.1)
annualtodata = HBAnnualResultsToData(results=annualdaylight.results, sel_pts=flatten(item_35), all_pts=pt_21)  # -> report, data; plug-in component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
legendpar_6 = LBLegendParameters(max=Slider(3000, range=0..3000))  # -> leg_par; plug-in component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
multiplication_3 = Multiplication(A=number_slider_45, B=4)
pt_22 = Point(Point(0, 35, 0))
hourlyplot_2 = LBHourlyPlot(data=annualtodata.data, base_pt=pt_22, x_dim=number_slider_45, y_dim=multiplication_3, legend_par=legendpar_6)  # -> report, mesh, legend, borders, labels, title, vis_set; plug-in component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
sph = Sphere(Base=item_35, Radius=Slider(1.2, range=0..5))
merge_14 = Merge(Data1=sph, Data2=hourlyplot_2.mesh, Data3=hourlyplot_2.legend, Data4=hourlyplot_2.labels)  # -> flatten(Result)

# ----
merge_15 = Merge(Data1=heatmap_2.mesh, Data2=heatmap_2.legend, Data3=heatmap_2.title)  # -> flatten(Result)
illuminance_lux = Data(merge_15)
udi_50 = Data(flatten([heatmap_4.mesh, heatmap_4.legend, heatmap_4.title]))
udi_3000 = Data(flatten([heatmap_3.mesh, heatmap_3.legend, heatmap_3.title]))
udi = Data(flatten([heatmap_5.mesh, heatmap_5.legend, heatmap_5.title]))
daylight_autonomy = Data(flatten([heatmap_6.mesh, heatmap_6.legend, heatmap_6.title]))
move = Move(Geometry=daylight_autonomy, Motion=X)  # -> Geometry, Transform
hourly_results_in_one_point = Data(merge_14)
spatial_daylight_autonomy = Data(sda.sDA)

# ---- group: Spatial climate based daylight (continued)
move_2 = Move(Geometry=udi_3000, Motion=X_2)  # -> Geometry, Transform
move_3 = Move(Geometry=udi_50, Motion=X_3)  # -> Geometry, Transform
move_4 = Move(Geometry=udi, Motion=X_4)  # -> Geometry, Transform
merge_16 = Merge(Data1=move.Geometry, Data2=move_4.Geometry, Data3=move_3.Geometry, Data4=move_2.Geometry)

# ----
data_55 = Data(merge_16)

data_56 = Data(spatial_daylight_autonomy)
data_57 = Data(illuminance_lux)
data_58 = Data(daylight_autonomy)
data_59 = Data(udi)
data_60 = Data(udi_50)
data_61 = Data(udi_3000)
run_daylight_simulations_3 = RemoteReceiver(run_daylight_simulations)
entwine_124 = Entwine(
    Branch00=data_56,
    Branch01=data_57,
    Branch02=data_58,
    Branch03=data_59,
    Branch04=data_60,
    Branch05=data_61,
    FlattenInputs=True)
freeze_gate_43 = StreamFreezeGate(Data=entwine_124, PassingSwitch=run_daylight_simulations_3, Hold=True)
daylight_simulation_type_3 = RemoteReceiver(daylight_simulation_type)
bang_14 = ExplodeTree(Data=freeze_gate_43)  # -> Branch0, Branch1, Branch2, Branch3, Branch4, Branch5
null_22 = NullItem(Item=flatten(freeze_gate_43))  # -> NullFlags, InvalidFlags, Description
cull_14 = CullPattern(List=null_22.NullFlags, CullPattern=invert(null_22.NullFlags))
data_62 = Data(bang_14.Branch2)
data_63 = Data(bang_14.Branch3)
data_64 = Data(bang_14.Branch4)
data_65 = Data(bang_14.Branch0)
data_66 = Data(bang_14.Branch1)
data_67 = Data(bang_14.Branch5)
lng_26 = ListLength(List=cull_14)
filter_60 = StreamFilter(Gate=daylight_simulation_type_3, Stream0=data_66, Stream1=data_62, Stream2=data_63, Stream3=data_64, Stream4=data_67)

spatialdaylightautonomy = RemoteSender(data_65)
bool_41 = Boolean(data_65)
hasdata_15 = DataExists(Data=bool_41)
filter_61 = StreamFilter(Gate=hasdata_15, Stream0="False", Stream1=bool_41)
gate_53 = StreamGate(Stream=filter_60, Gate=expression_20)  # -> Target0, Target1

daylight_data_exists = RemoteSender(filter_61)
data_68 = Data(gate_53.Target1)
bbox_4 = BoundingBox(Content=data_68, Plane=PlaneXY(0, 0, 0), UnionBox=True)  # -> Box, Box_2
zoom_daylight_simulation_bounding_box = RemoteSender(bbox_4.Box)

spatialdaylightautonomy_2 = RemoteReceiver(spatialdaylightautonomy)
expression_73 = Expression(x=spatialdaylightautonomy_2, Expression="Round(x*100, 1)")
daylight_data_exists_2 = RemoteReceiver(daylight_data_exists)
format_11 = Format(Format=panel_40, Culture=127, Data0=expression_73)
daylight_data_exists_3 = RemoteReceiver(daylight_data_exists)
or_28 = GateOr(A=daylight_data_exists_2, B=filter_3)
setlabel_6 = SetLabelContents(LabelToModify=label_24, NewLabelContents=format_11)
rec_19 = DataRecorder(or_28, DataLimit=-10, RecordData=True)
hideshow_45 = HideShowElement(ElementToHideShow=button_12, Show=daylight_data_exists_3, Collapse=True, Disable=False)
ma_23 = MassAddition(Input=flatten(rec_19))  # -> Result, PartialResults
mod_4 = Modulus(A=ma_23.Result, B=Slider(2, range=0..10))
daylight_data_exists_4 = RemoteReceiver(daylight_data_exists)
bool_42 = Boolean(mod_4)
filter_62 = StreamFilter(Gate=bool_42, Stream0="Simulation failed...", Stream1="Daylight simulation is running...")
daylight_data_exists_5 = RemoteReceiver(daylight_data_exists)
daylight_data_exists_6 = RemoteReceiver(daylight_data_exists)
bool_43 = Boolean(invert(daylight_data_exists_4))
gate_54 = StreamGate(Stream=filter_62, Gate=freeze_gate_11)  # -> Target0, Target1
hideshow_46 = HideShowElement(ElementToHideShow=tb_8, Show=bool_43, Collapse=daylight_data_exists_4, Disable=False)
settextblock_13 = SetTextBlockContents(TextBlockToModify=tb_8, NewTextBlockContents=gate_54.Target1)
hideshow_47 = HideShowElement(ElementToHideShow=label_24, Show=daylight_data_exists_6, Collapse=True, Disable=False)
hideshow_48 = HideShowElement(ElementToHideShow=pulldown_13, Show=daylight_data_exists_5, Collapse=True, Disable=False)

zoom_daylight_simulation_bounding_box_2 = RemoteReceiver(zoom_daylight_simulation_bounding_box)
zbb_4 = ZoomBoundingBox(Box=zoom_daylight_simulation_bounding_box_2, Run=zoom_daylight_simulation_2)

daylight_data_exists_7 = RemoteReceiver(daylight_data_exists)
and_34 = GateAnd(A=equals_11.Inequality, B=daylight_data_exists_7, C=expression_19)

or_29 = GateOr(
    A=preview_16,
    B=room_attribute_visualize_2,
    C=room_energy_attribute_visualize_2,
    D=face_attribute_visualize_2,
    E=face_energy_attribute_visualize_2,
    F=show_honeybee_walls_2,
    G=show_honeybee_roof_2,
    H=show_honeybee_floors_2,
    I=show_honeybee_ground_2,
    J=show_honeybee_windows_2,
    K=show_honeybee_doors_2,
    L=show_honeybee_context_2,
    M=weather_visualisation_wireframe_2,
    N=and_34)
filter_63 = StreamFilter(Gate=or_29, Stream0="Shaded", Stream1="Wireframe")
mod_viewport = ModifyViewport(DisplayMode=filter_63, AnimateRestore=False, RestoreFrames=10)

# ==== cluster VisualiseProperties
number_of_decimals_room = ClusterInput()
face_attribute = ClusterInput()
honeybee_model = ClusterInput()
number_of_decimals_face = ClusterInput()
room_attribute = ClusterInput()
face_attribute_2 = Text(face_attribute)
honeybee_model_2 = Data(honeybee_model)
room_attribute_2 = Text(room_attribute)
number_of_decimals_face_2 = Number(number_of_decimals_face)
legendpar = LBLegendParameters(num_decimals=number_of_decimals_face_2)  # -> leg_par; plug-in component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
number_of_decimals_room_2 = Number(number_of_decimals_room)
legendpar_2 = LBLegendParameters(num_decimals=number_of_decimals_room_2)  # -> leg_par; plug-in component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
colorfaceattr = HBColorFaceAttributes(hb_objs=flatten(honeybee_model_2), attribute=face_attribute_2, legend_par=legendpar)  # -> mesh, legend, wire_frame, values, colors, vis_set; plug-in component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
colorroomattr = HBColorRoomAttributes(rooms_model=flatten(honeybee_model_2), attribute=room_attribute_2, legend_par=legendpar_2)  # -> mesh, legend, wire_frame, values, colors, vis_set; plug-in component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
visualised_face_attributes = Data([colorfaceattr.mesh, colorfaceattr.legend, colorfaceattr.wire_frame])
visualised_room_attributes = Data([colorroomattr.mesh, colorroomattr.legend, colorroomattr.wire_frame])
visualised_face_attributes_2 = ClusterOutput(visualised_face_attributes)
visualised_room_attributes_2 = ClusterOutput(visualised_room_attributes)

# ==== cluster AddDynamicShades
base_construction_set = ClusterInput()
setpoint = ClusterInput()
base_construction_set_2 = Data(base_construction_set)
decnstrconstrset = HBDeconstructConstructionSet(constr_set=base_construction_set_2)  # -> exterior_wall, exterior_roof, exposed_floor, ground_wall, ground_roof, ground_floor, window, skylight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; plug-in component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
setpoint_2 = Data(setpoint)
shademat = HBShadeMaterial(thickness=Slider(0.01, range=0..0.01), transmittance=Slider(0.4, range=0..1))  # -> mat; plug-in component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
windowconstrshd = HBWindowConstructionShade(
    name="Simple Glazing Window",
    win_constr=decnstrconstrset.window,
    shd_material=shademat,
    shd_location="Exterior",
    control_type=Slider(1, range=0..8),
    setpoint=setpoint_2)  # -> constr; plug-in component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
subfacesubset = HBSubfaceSubset(window=windowconstrshd, operable=windowconstrshd)  # -> subface_set; plug-in component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
constructionset = HBConstructionSet(base_constr_set=base_construction_set_2, subface_subset=subfacesubset)  # -> constr_set; plug-in component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
construction_set = Data(constructionset)
construction_set_2 = ClusterOutput(construction_set)

# ==== cluster Cluster
materials = ClusterInput()
materials_2 = Data(materials)
opaqueconstr = HBOpaqueConstruction(materials=materials_2)  # -> constr; plug-in component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
thicknesses = ClusterInput()
thicknesses_2 = Number(thicknesses)
decnstrconstr = HBDeconstructConstruction(constr=opaqueconstr)  # -> materials, layers, r_val_si, r_val_ip, u_fac_si, u_fac_ip, shgc, t_sol, t_vis; plug-in component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
nullrep = ReplaceNulls(Items=thicknesses_2, Replacements="0")  # -> Items, Count
construction_name = ClusterInput()
modify_layer_thicknesses = BrimstoneModifyThicknessesOfHoneybeeMaterials(hb_materials=decnstrconstr.materials, thicknesses=nullrep.Items)  # -> out, mod_materials; inputs hb_materials: list, thicknesses: list
# ---------- modify_layer_thicknesses: Python ----------
"""
Calculates embodied carbon for the elements of a Honeybee model if data is available
This component was inspired by the 'HB Color Face Attributes' component of Ladybug Tools 1.6.0

    Args:
        hb_materials: List of Honeybee materials which should get new thickness
        thicknesses: List of new material thicknesses

    Returns:
        mod_materials: Modified Honeybee materials
"""

import scriptcontext
#import brimstone

ghenv.Component.Message = ""#brimstone.globals.version

ghenv.Component.Name = 'Brimstone - Modify thicknesses of Honeybee materials'
ghenv.Component.NickName = 'Modify layer thicknesses'

try:  # import the core honeybee dependencies
    from honeybee_energy.material.opaque import EnergyMaterial
    from honeybee_energy.material.opaque import EnergyMaterialNoMass
except ImportError as e:
    raise ImportError('\nFailed to import honeybee:\n\t{}'.format(e))

def main(hb_materials, thicknesses):
    mod_materials = []
    assert len(hb_materials) == len(thicknesses), "Materials and thickness list must be of the same length"
    for (i, material) in enumerate(hb_materials):
        if not isinstance(material, EnergyMaterial):
            if isinstance(material, EnergyMaterialNoMass):
                mod_material = material.duplicate()
                mod_materials.append(mod_material)
            else:
                raise Exception("All materials must be valid Honeybee Energy Materials or Energy Materials (No Mass)")
        else: # if material is EnergyMaterial
            mod_material = material.duplicate()
            mod_material.thickness = thicknesses[i]
            mod_materials.append(mod_material)
    return mod_materials

if __name__ == "__main__":
    try:
        pass#flying = scriptcontext.sticky["brimstone_flying"]
    except:
        raise Exception("The 'Brimstone - Fly' component needs to exist on the canvas")
    mod_materials = main(hb_materials, thicknesses)
# ---------- end modify_layer_thicknesses ----------
construction_name_2 = Text(construction_name)
opaqueconstr_2 = HBOpaqueConstruction(name=construction_name_2, materials=modify_layer_thicknesses.mod_materials)  # -> constr; plug-in component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
error = Data(modify_layer_thicknesses.out)
error_2 = ClusterOutput(error)
construction = Data(opaqueconstr_2)
construction_2 = ClusterOutput(construction)

# ==== cluster Cluster_2
window_construction = ClusterInput()
window_construction_2 = Data(window_construction)
fly = BrimstoneFly()
# ---------- fly: Python ----------
"""This component sets up global information for Brimstone
    Inputs:
    Output:
        """

import Grasshopper
import sys
sys.path.append(Grasshopper.Folders.UserObjectFolders[0])

import brimstone
reload(brimstone)

import scriptcontext

ghenv.Component.Name = 'Brimstone - Fly!'
ghenv.Component.NickName = 'Fly!'

scriptcontext.sticky["brimstone_flying"] = 'true'
ghenv.Component.Message = brimstone.globals.version
# ---------- end fly ----------
subfacesubset = HBSubfaceSubset(window=window_construction_2)  # -> subface_set; plug-in component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
panel = Panel(subfacesubset)
constructionset = HBConstructionSet(subface_subset=subfacesubset)  # -> constr_set; plug-in component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
density_kg_m2 = ClusterInput()
gwp_a1_a3 = ClusterInput()
gwp_a4 = ClusterInput()
decnstrconstrset = HBDeconstructConstructionSet(constr_set=constructionset)  # -> exterior_wall, exterior_roof, exposed_floor, ground_wall, ground_roof, ground_floor, window, skylight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; plug-in component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
gwp_a1_a3_2 = Data(gwp_a1_a3)
gwp_a4_2 = Data(gwp_a4)
density_kg_m2_2 = Data(density_kg_m2)
add_life_cycle_info_construction = BrimstoneAddLifeCycleInfoToHoneybeeConstruction(hb_construction=decnstrconstrset.window, gwp_a1_a3=gwp_a1_a3_2, gwp_a4=gwp_a4_2, density=density_kg_m2_2)  # -> mod_construction
# ---------- add_life_cycle_info_construction: Python ----------
"""
Adds GWP info to a Honeybee Construction

    Args:
        hb_construction: Honeybee Construction to be updated
        gwp_a1_a3: GWP (A1-A3) [kg CO2eq/m2]
        gwp_a4: GWP (A4) [kg CO2eq/m2]
        gwp_a5_1: GWP (A5.1) [kg CO2eq/m2]

    Returns:
        mod_construction: Updated Honeybee Construction
"""

import scriptcontext
import brimstone
ghenv.Component.Message = brimstone.globals.version
import Grasshopper

ghenv.Component.Name = 'Brimstone - Add Life Cycle Info to Honeybee Construction'
ghenv.Component.NickName = 'Add Life Cycle Info (Construction)'

try:  # import the core honeybee dependencies
    from honeybee_energy.construction.window import WindowConstruction
    from honeybee_energy.construction.opaque import OpaqueConstruction
except ImportError as e:
    raise ImportError('\nFailed to import honeybee:\n\t{}'.format(e))

def main(hb_construction, gwp_a1_a3, gwp_a4, density):
    if not isinstance(hb_construction, WindowConstruction)\
        and not isinstance(hb_construction, OpaqueConstruction):
        raise Exception("Currently only Window and Opaque constructions are supported")
    mod_construction = hb_construction.duplicate()
    mod_construction.properties.gwp_a1_a3 = gwp_a1_a3
    mod_construction.properties.gwp_a4 = gwp_a4
    mod_construction.properties.conv_value = density
    return mod_construction

if __name__ == "__main__":
    try:
        flying = scriptcontext.sticky["brimstone_flying"]
    except:
        raise Exception("The 'Brimstone - Fly' component needs to exist on the canvas")
    mod_construction = main(hb_construction, gwp_a1_a3, gwp_a4, density)
# ---------- end add_life_cycle_info_construction ----------
panel_2 = Panel(decnstrconstrset.window)
updated_construction = Data(add_life_cycle_info_construction)
panel_3 = Panel(add_life_cycle_info_construction)
updated_construction_2 = ClusterOutput(updated_construction)

# ==== cluster WeatherVisualisation
target_geometry = ClusterInput()
run_direct_sun_hours_study = ClusterInput()
_1 = ClusterInput()
run_incident_radiation_study = ClusterInput()
run_weather_visualisation = ClusterInput()
target_geometry_2 = ClusterInput()
sky_mask_centre_point = ClusterInput()
run_weather_visualisation_2 = Boolean(run_weather_visualisation)
filter = StreamFilter(Gate=run_weather_visualisation_2, Stream1=_1)
epw_file_url = Data(filter)

# ---- group: Get weather data
downloadepw = LBDownloadWeather(weather_URL=epw_file_url)  # -> epw_file, stat_file, ddy_file; plug-in component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
falsestart = LBFalseStartToggle(False)
epwtoddy = LBEPWToDDY(weather_file=downloadepw.epw_file, write=falsestart)  # -> ddy_file; plug-in component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
importloc = LBImportLocation(epw_file=downloadepw.epw_file)  # -> location; plug-in component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
importstat = LBImportSTAT(stat_file=downloadepw.stat_file)  # -> location, ashrae_zone, koppen_zone, clear_dir_norm_rad, clear_diff_horiz_rad, ann_heat_dday_996, ann_heat_dday_990, ann_cool_dday_004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; plug-in component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
constrloc = LBConstructLocation(elevation=0)  # -> location; plug-in component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
importepw = LBImportEPW(epw_file=downloadepw.epw_file)  # -> location, dry_bulb_temperature, dew_point_temperature, relative_humidity, wind_speed, wind_direction, direct_normal_rad, diffuse_horizontal_rad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; plug-in component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
importddy = LBImportDDY(ddy_file=downloadepw.ddy_file)  # -> location, design_days; plug-in component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

# ----
panel = Panel(importloc)

# ---- group: Wind rose
analysisperiod = LBAnalysisPeriod(
    start_month=Slider(1, range=1..12),
    start_day=Slider(1, range=1..31),
    start_hour=Slider(0, range=0..23),
    end_month=Slider(12, range=1..12),
    end_day=Slider(31, range=1..31),
    end_hour=Slider(23, range=0..23))  # -> period, hoys, dates; plug-in component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
windrose = LBWindRose(data=importepw.wind_speed, wind_direction=importepw.wind_direction, show_calm=Toggle(True), period=analysisperiod.period)  # -> report, mesh, compass, orient_line, freq_line, windrose_line, legend, title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; plug-in component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

# ---- group: Sun path
analysisperiod_2 = LBAnalysisPeriod(
    start_month=Slider(1, range=1..12),
    start_day=Slider(1, range=1..31),
    start_hour=Slider(0, range=0..23),
    end_month=Slider(12, range=1..12),
    end_day=Slider(31, range=1..31),
    end_hour=Slider(23, range=0..23))  # -> period, hoys, dates; plug-in component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
panel_2 = Panel("a>24")
sunpath = LBSunPath(location=importloc, hoys=analysisperiod_2.hoys, scale=1, data=importepw.dry_bulb_temperature)  # -> report, vectors, altitudes, azimuths, hoys, sun_pts, analemma, daily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; plug-in component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
msphere = MeshSphere(Base=sunpath.sun_pts, Radius=Slider(3, range=0..10), UCount=10, VCount=20)

# ---- group: Graph data
timeop = LBTimeIntervalOperation(data=importepw.dry_bulb_temperature)  # -> daily, monthly, mon_per_hr; plug-in component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
legendpar = LBLegendParameters(
    min=Slider(-15, range=-15..30),
    max=Slider(25, range=0..100),
    num_decimals=Slider(0, range=0..100),
    larger_smaller=Toggle(True),
    vert_or_horiz=Toggle(False))  # -> leg_par; plug-in component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
monthlychart = LBMonthlyChart(data=timeop.daily)  # -> report, data_mesh, data_lines, col_lines, legend, borders, labels, y_title, title, vis_set; plug-in component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
hourlyplot = LBHourlyPlot(data=importepw.dry_bulb_temperature, z_dim=Slider(0, range=0..100), reverse_y=Toggle(True), legend_par=legendpar)  # -> report, mesh, legend, borders, labels, title, vis_set; plug-in component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

# ----
run_incident_radiation_study_2 = Boolean(run_incident_radiation_study)

# ---- group: Sky matrix and incident radiation
analysisperiod_3 = LBAnalysisPeriod(
    start_month=Slider(1, range=1..12),
    start_day=Slider(1, range=1..31),
    start_hour=Slider(0, range=0..23),
    end_month=Slider(12, range=1..12),
    end_day=Slider(31, range=1..31),
    end_hour=Slider(23, range=0..23))  # -> period, hoys, dates; plug-in component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
skymatrix = LBCumulativeSkyMatrix(
    location=importepw.location,
    direct_rad=importepw.direct_normal_rad,
    diffuse_rad=importepw.diffuse_horizontal_rad,
    hoys=analysisperiod_3.hoys,
    high_density=Toggle(False))  # -> report, sky_mtx; plug-in component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
context_geometry = Geometry(target_geometry)
target_geometry_3 = Geometry(target_geometry_2)
incidentradiation = LBIncidentRadiation(
    sky_mtx=skymatrix.sky_mtx,
    geometry=flatten(target_geometry_3),
    context=flatten(context_geometry),
    grid_size=Slider(1, range=0..1),
    offset_dist=Slider(0.1, range=0..0.1),
    run=run_incident_radiation_study_2)  # -> report, points, results, total, mesh, legend, title, int_mtx; plug-in component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
skydome = LBSkyDome(sky_mtx=skymatrix.sky_mtx)  # -> report, mesh, compass, legend, title, patch_vecs, patch_values, mesh_values, vis_set; plug-in component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

# ----
merge = Merge(
    Data1=windrose.mesh,
    Data2=windrose.compass,
    Data3=windrose.orient_line,
    Data4=windrose.freq_line,
    Data5=windrose.windrose_line,
    Data6=windrose.legend,
    Data7=windrose.title)
run_direct_sun_hours_study_2 = Boolean(run_direct_sun_hours_study)

# ---- group: Direct sun hours
toggle = BooleanToggle(True)
target_geometry_4 = Geometry(target_geometry_2)
context_geometry_2 = Geometry(target_geometry)
directsunhours = LBDirectSunHours(
    vectors=flatten(sunpath.vectors),
    geometry=flatten(target_geometry_4),
    context=flatten(context_geometry_2),
    grid_size=Slider(1, range=0..10),
    offset_dist=Slider(0.1, range=0..1),
    run=run_direct_sun_hours_study_2)  # -> report, points, results, mesh, legend, title, int_mtx; plug-in component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

# ---- group: Sky mask
sky_mask_centre_point_2 = Point(sky_mask_centre_point)
symask = LBSkyMask(
    context=context_geometry_2,
    density=Slider(3, range=0..10),
    center=sky_mask_centre_point_2,
    scale=Slider(0.1, range=0..1))  # -> report, context_mask, orient_mask, strategy_mask, sky_mask, context_view, orient_view, strategy_view, sky_view; plug-in component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

# ----
merge_2 = Merge(Data1=skydome.mesh, Data2=skydome.compass, Data3=skydome.legend, Data4=skydome.title)  # -> flatten(SkyDome)
merge_3 = Merge(
    Data1=monthlychart.data_mesh,
    Data2=monthlychart.legend,
    Data3=monthlychart.borders,
    Data4=monthlychart.labels,
    Data5=monthlychart.y_title,
    Data6=monthlychart.title)  # -> flatten(DryBulbTemperatureLineChart)
merge_4 = Merge(Data1=incidentradiation.mesh, Data2=incidentradiation.legend, Data3=incidentradiation.title)  # -> flatten(IncidentRadiation)
merge_5 = Merge(
    Data1=hourlyplot.mesh,
    Data2=hourlyplot.legend,
    Data3=hourlyplot.borders,
    Data4=hourlyplot.labels,
    Data5=hourlyplot.title)
sky_dome = ClusterOutput(merge_2)
wind_rose = ClusterOutput(merge)
dry_bulb_temperature_line_chart = ClusterOutput(merge_3)
dry_bulb_temperature_2d_chart = ClusterOutput(merge_5)
direct_sun_hours = Merge(Data1=directsunhours.mesh, Data2=directsunhours.legend, Data3=directsunhours.title)  # -> flatten(DirectSunHours)
direct_sun_hours_2 = ClusterOutput(direct_sun_hours)
incident_radiation = ClusterOutput(merge_4)
merge_6 = Merge(Data1=symask.context_mask, Data2=symask.sky_mask)
sky_mask = ClusterOutput(merge_6)

# ==== cluster Cluster_3
min = ClusterInput()
max = ClusterInput()
colors = ClusterInput()
legendpar = LBLegendParameters(min=min, max=max, colors=colors)  # -> leg_par; plug-in component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
leg_par = ClusterOutput(legendpar)

# ==== cluster Cluster_4
int = ClusterInput()
number_slider = Slider(2, range=0..10)
int_2 = Integer(int)
fragment = TextFragment(Text=int_2, Start="0", Count=number_slider)
fragment_2 = TextFragment(Text=int_2, Start=number_slider)
len = TextLength(Text=fragment_2)
addition = Addition(A=fragment, B="1")
equals = Equality(FirstNumber="0", SecondNumber=fragment)  # -> Equality, Inequality
filter = StreamFilter(Gate=equals.Equality, Stream0=addition, Stream1=fragment)
_10º = PowerOf10(Value=len)
multiplication = Multiplication(A=_10º, B=filter)
R = ClusterOutput(multiplication)

# ==== cluster Cluster_5
x = ClusterInput()
abs = Absolute(Value=x)
number_slider = Slider(2, range=0..10)
int = Integer(abs)
fragment = TextFragment(Text=int, Start="0", Count=number_slider)
fragment_2 = TextFragment(Text=int, Start=number_slider)
equals = Equality(FirstNumber="0", SecondNumber=fragment)  # -> Equality, Inequality
len = TextLength(Text=fragment_2)
addition = Addition(A=fragment, B="1")
filter = StreamFilter(Gate=equals.Equality, Stream0=addition, Stream1=fragment)
_10º = PowerOf10(Value=len)
multiplication = Multiplication(A=_10º, B=filter)
neg = Negative(Value=multiplication)
y = ClusterOutput(neg)

# ==== cluster Cluster_6
legendpar = LBLegendParameters(min=Slider(0, range=0..100), max=Slider(100, range=0..100), num_decimals=Slider(0, range=0..100))  # -> leg_par; plug-in component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
leg_par = ClusterOutput(legendpar)
